# Grasshopper definition localization.ghx (Grasshopper 1.0.7)

path = FilePath("C:\rcf_robotcontrol\06_localization\01_frames_from_script\2020-12-15T21.16.24.json")

# ---- group: reload module
bang = Button()
unload = PythonScript(bang=bang, module="rapid_clay_formations_fab")
# ---------- unload: Python ----------
import sys

def unload_modules(top_level_module_name):
    """Unloads all modules named starting with the specified string.

    This function eases the development workflow when editing a library that is
    used from Rhino/Grasshopper.

    Args:
        top_level_module_name (:obj:`str`): Name of the top-level module to unload.

    Returns:
        list: List of unloaded module names.
    """
    modules = filter(lambda m: m.startswith(top_level_module_name), sys.modules)

    for module in modules:
        sys.modules.pop(module)

    return modules

unload_modules(module)
# ---------- end unload ----------

# ----
# CSV reading
read_data = Button()
file_path = FilePath("C:\rcf_robotcontrol\06_localization\TotalStation_RawData\201215A.csv")
datasource = ValueList({"Total Station": 1, "File": 2}, selected="File")
panel = Panel(file_path)
import_ts_cartesian_coordinates = PythonScript(data_source=datasource, read_data=read_data, filepath_to_read=file_path, prefixes="201215ALP")  # -> out, ids, pts; inputs data_source: Int32, read_data: Boolean, prefixes: list
# ---------- import_ts_cartesian_coordinates: Python ----------
import urllib2
import csv
import os

from collections import OrderedDict

import rhinoscriptsyntax as rs
import Rhino.Geometry as rg

from compas.geometry import Point

if len(prefixes) < 1:
    select_all = True
else:
    select_all = False
    prefixes = [prefix.upper() for prefix in prefixes]

class MeasurementPt(object):
    def __init__(self, pt_name, xyz, attrs={}):
        self.pt_name = pt_name
        self.xyz = xyz
        self.x, self.y, self.z = xyz
        self.attrs = attrs

        self.split_pt_name()

    def __repr__(self):
        return "Point ID: {}, Location: {}, {}, {}".format(self.pt_name, *self.xyz)

    def as_cgpoint(self):
        return Point(*self.xyz)

    def as_rgpoint(self):
        return rg.Point3d(*self.xyz)

    def split_pt_name(self):
        idx = ""

        for n, elem in enumerate(self.pt_name[::-1]):
            if elem.isdigit():
                idx = elem + idx # add to front of str
            else:
                idx_last_char_idx = len(self.pt_name) - n
                break

        self.prefix = self.pt_name[:idx_last_char_idx]

        try:
            self.idx = int(idx)
        except ValueError:
            self.idx = 0

if cache_dir is None:
    cache_dir = os.path.dirname(rs.DocumentPath())

cache_file = os.path.join(cache_dir, 'localization_data_cache.csv')

if data_source == 1:
    file_to_process = cache_file
else:
    file_to_process = filepath_to_read

if read_data and data_source == 1:

    # Fetch file
    data_raw = urllib2.urlopen(total_station_file)

    with open(cache_file, 'w') as f:
        f.write(data_raw.read())

# Read the data from the cached file.
measured_pts = []
if os.path.exists(file_to_process):
    with open(file_to_process, 'r') as fp:
        reader = csv.DictReader(fp, dialect="excel", delimiter=";")

        for pt_data in reader:
            xyz = [pt_data.pop("X"), pt_data.pop("Y"), pt_data.pop("Z")]

            # check if our three values are convertable to float
            try:
                xyz = [float(c) for c in xyz]
            except ValueError:
                continue

            xyz = [c * 1000 for c in xyz]

            pt_name = pt_data.pop("NAME")
            #print(pt_name)
            measured_pts.append(MeasurementPt(pt_name, xyz, attrs=pt_data))

# raise if no points found
if len(measured_pts) == 0:
    raise Exception("No pts found")

measured_pts.sort(key=lambda pt: (pt.prefix, pt.idx))

if not select_all:
    measured_pts = [pt for pt in measured_pts if pt.prefix in prefixes]

pts = [pt.as_rgpoint() for pt in measured_pts]
ids = [pt.pt_name for pt in measured_pts]
# ---------- end import_ts_cartesian_coordinates ----------
panel_2 = Panel(import_ts_cartesian_coordinates.ids)

panel_3 = Panel(path)
python = GhPythonScript(file_path_to_rcs_json=path)  # -> out, rcs_planes
# ---------- python: Python ----------
import json

from compas.utilities import DataDecoder

from rapid_clay_formations_fab.rhino import cgframe_to_rgplane

with open(file_path_to_rcs_json, mode="r") as fp:
    frames = json.load(fp, cls=DataDecoder)
rcs_planes = [cgframe_to_rgplane(f) for f in frames]
# ---------- end python ----------
pt = Point(python.rcs_planes)
cull_i = CullIndex(List=pt, Indices=Slider(9, range=0..10), Wrap=True)
lng = ListLength(List=cull_i)
split = SplitList(List=cull_i, Index=expr("x-1", lng))  # -> ListA, ListB

# ---- group: RCS
pt_2 = Point(split.ListA)

# ---- group: RCS Test
pt_3 = Point(split.ListB)

# ----
pt_4 = Point(import_ts_cartesian_coordinates.pts)
cull_i_2 = CullIndex(List=pt_4, Indices=Slider(9, range=0..10), Wrap=True)

# ---- group: WCS
pt_5 = Point([Point(10880.49, 21515.076, 4373.638), Point(10035.549, 20444.487, 3827.035), Point(10956.619, 19817.349, 2867.966), Point(11551.891, 19286.534, 3930.984), Point(12517.343, 19239.399, 3382.394), Point(13027.837, 19381.48, 4696.274)])

# ---- group: RCS
pt_6 = Point([Point(122.6505051, -1041.475952, 401.1485291), Point(1186.927368, -1888.021729, -144.9249725), Point(1812.583862, -970.343811, -1109.360474), Point(2350.837646, -375.7471619, -49.4438324), Point(2397.757812, 589.6455688, -597.7266235), Point(2261.406738, 1098.268311, 717.2722778)])

# ----
lng_2 = ListLength(List=cull_i_2)
split_2 = SplitList(List=cull_i_2, Index=expr("x-1", lng_2))  # -> ListA, ListB

# ---- group: WCS Test
pt_7 = Point(split_2.ListB)

# ---- group: WCS
pt_8 = Point(split_2.ListA)

# ----
# 3-Point Localization
panel_4 = Panel("t_A057_ClayTool02_Prism")
set_localization_position = Button()
move_to_first_position_origin = Button()
move_to_second_position_x_axis = Button()
move_to_third_position_y_axis = Button()
set_localization_position_2 = PythonScript(read_position=set_localization_position, tool=panel_4)  # -> out, localization_origin_plane, localization_origin_frame; inputs read_position: Boolean
# ---------- set_localization_position_2: Python ----------
from __future__ import absolute_import
from __future__ import division
from __future__ import print_function

from scriptcontext import sticky

from compas.geometry import Frame
from compas_fab.backends.ros import RosClient
from compas_rrc import AbbClient
from compas_rrc import GetFrame
from compas_rrc import SetAcceleration
from compas_rrc import SetMaxSpeed
from compas_rrc import SetTool
from compas_rrc import SetWorkObject

from rapid_clay_formations_fab.rhino import cgframe_to_rgplane

TIMEOUT = 5 # controller communicaton timeout

if not tool:
    tool = "tool0"
if not wobj:
    wobj = "wobj0"

if not sticky.get("localization_origin"):
    sticky["localization_origin"] = None

if read_position:
    # Create Ros Client
    with RosClient() as ros:
        # Create ABB Client
        abb = AbbClient(ros)
        abb.run(timeout=TIMEOUT)

        # Set prism TCP
        abb.send(SetTool(tool))

        # Unset any active WorkObject
        abb.send(SetWorkObject(wobj))

        # Get location of TCP
        tcp_frame = abb.send_and_wait(GetFrame(), timeout=TIMEOUT)

        sticky["localization_origin"] = tcp_frame

localization_origin_frame = sticky["localization_origin"]
if localization_origin_frame:
    localization_origin_plane = cgframe_to_rgplane(localization_origin_frame)
# ---------- end set_localization_position_2 ----------
distance = Slider(1000, range=100..1000)
localization_positions = PythonScript(
    localization_origin_frame=set_localization_position_2.localization_origin_frame,
    move_to_origin=move_to_first_position_origin,
    move_to_x_pt=move_to_second_position_x_axis,
    move_to_y_pt=move_to_third_position_y_axis,
    distance=distance,
    tool=panel_4)  # -> out, o_pt, x_pt, y_pt
# ---------- localization_positions: Python ----------
from __future__ import absolute_import
from __future__ import division
from __future__ import print_function

from compas.geometry import Frame
from compas.geometry import Translation

from rapid_clay_formations_fab.robots import standalone_move_to_frame
from rapid_clay_formations_fab.rhino import cgframe_to_rgplane

if localization_origin_frame is None:
    raise Exception("No origin supplied.")

kwargs = {}

if tool:
    kwargs["tool"] = tool

Tx = Translation.from_vector([distance, 0, 0])
Ty = Translation.from_vector([0, distance, 0])

o_frame = localization_origin_frame
x_frame = o_frame.transformed(Tx)
y_frame = o_frame.transformed(Ty)

o_pt = cgframe_to_rgplane(o_frame).Origin
x_pt = cgframe_to_rgplane(x_frame).Origin
y_pt = cgframe_to_rgplane(y_frame).Origin

# pick which point to send
if move_to_origin:
    frame = o_frame
    frame_name = "Origin"
elif move_to_x_pt:
    frame = x_frame
    frame_name = "X axis point"
elif move_to_y_pt:
    frame = y_frame
    frame_name = "Y axis point"
else:
    frame = None
    frame_name = None

if frame:
    standalone_move_to_frame(frame, **kwargs)
else:
    print("No motion command sent")
# ---------- end localization_positions ----------
pln = Plane(set_localization_position_2.localization_origin_plane)
panel_5 = Panel(pln)
panel_6 = Panel(localization_positions.out)
merge = Merge(Data1=localization_positions.o_pt, Data2=localization_positions.x_pt, Data3=localization_positions.y_pt)
calculate_transformation = PythonScript(rcs_coords=merge)  # -> out, transformation; inputs rcs_coords: list of Point3d, wcs_coords: list of Point3d
# ---------- calculate_transformation: Python ----------
from rapid_clay_formations_fab.localization import three_pts_localization
from rapid_clay_formations_fab.localization import worldxy_to_robot_base_xform
from rapid_clay_formations_fab.rhino import matrix_to_rgtransform
from rapid_clay_formations_fab.rhino import rgpoint_to_cgpoint
from compas.geometry import Transformation, Frame
from compas import PRECISION

PRECISION = "3f"
print(PRECISION)

if len(rcs_coords) == 0 or len(wcs_coords) == 0:
    raise Exception("No points supplied.")

rcs_coords = [rgpoint_to_cgpoint(pt) for pt in rcs_coords]
wcs_coords = [rgpoint_to_cgpoint(pt) for pt in wcs_coords]

print("Points in RCF")
print("Origin: {}".format(rcs_coords[0]))
print("X: {}".format(rcs_coords[1]))
print("Y: {}".format(rcs_coords[2]))
print("")

print("Points in WCF")
print("Origin: {}".format(wcs_coords[0]))
print("X: {}".format(wcs_coords[1]))
print("Y: {}".format(wcs_coords[2]))
print("")

wcs_robot_base = three_pts_localization(rcs_coords, wcs_coords)

print("RCS X vector in WCS: {}".format(wcs_robot_base.xaxis))
print("RCS Y vector in WCS: {}".format(wcs_robot_base.yaxis))
print("RCS Z vector in WCS: {}".format(wcs_robot_base.zaxis))
print("")

print("Robot base origin in WCS: {}".format(wcs_robot_base.point))

_transformation = worldxy_to_robot_base_xform(wcs_robot_base)

transformation = matrix_to_rgtransform(_transformation)

print(PRECISION)
# ---------- end calculate_transformation ----------
panel_7 = Panel(calculate_transformation.out)
matrix = TransformMatrix(calculate_transformation.transformation, Digits=3)

# ---- group: RCS
pt_9 = Point(pt_6)

# ---- group: WCS
pt_10 = Point(pt_5)

# ----
# Arbitrary Points
button = Button()
calculate_transformation_2 = PythonScript(rcs_coords=pt_9, wcs_coords=pt_10, create_plot_files=Toggle(False), maxiter=Slider(300, range=0..500), run=button)  # -> out, transformation, rg_transform; inputs rcs_coords: list of Point3d, wcs_coords: list of Point3d, create_plot_files: Boolean, maxiter: Int32, run: Boolean
# ---------- calculate_transformation_2: Python ----------
from scriptcontext import sticky

from compas.geometry import Frame
from compas.rpc import Proxy

from rapid_clay_formations_fab.rhino import rgpoint_to_cgpoint
from rapid_clay_formations_fab.localization import worldxy_to_robot_base_xform
from rapid_clay_formations_fab.rhino import matrix_to_rgtransform

kwargs = {}

if create_plot_files is not None:
    kwargs["plot_results"] = create_plot_files
if maxiter is not None:
    kwargs["maxiter"] = maxiter

if not sticky.get("apl_result"):
    sticky["apl_result"] = None

if len(rcs_coords) == 0 or len(wcs_coords) == 0:
    raise Exception("No points supplied.")

rcs_coords = [rgpoint_to_cgpoint(pt) for pt in rcs_coords]
wcs_coords = [rgpoint_to_cgpoint(pt) for pt in wcs_coords]

if run:
    with Proxy("rapid_clay_formations_fab.localization", max_conn_attempts=5) as localization:
        try:
            result = localization.arbitrary_pts_localization(
                rcs_coords, wcs_coords, **kwargs
            )
            print(result)
            sticky["apl_result"] = Frame(*result)
        except:
            sticky["apl_result"] = None
            raise

print(sticky["apl_result"])

if sticky["apl_result"] is not None:
    transformation = worldxy_to_robot_base_xform(sticky["apl_result"])
    rg_transform = matrix_to_rgtransform(transformation.matrix)
    print(transformation)
# ---------- end calculate_transformation_2 ----------
matrix_2 = TransformMatrix(calculate_transformation_2.rg_transform, Digits=3)
panel_8 = Panel(calculate_transformation_2.out)

transform = Transform(calculate_transformation_2.rg_transform)
transform_2 = Transform(calculate_transformation.transformation)
