# Grasshopper definition create_rapid_tooldata.ghx (Grasshopper 1.0.7)

# ----
# Project number
# Rapid tooldata setup from Rhino geometry
panel = Panel("t_A057_")

# ----
# Tooldata for prism attached to ClayTool02
panel_2 = Panel("ClayTool02_Prism")
tolerance = Slider(-3, range=-8..0, expression="10^x")
Z = UnitZ(Factor=1)
X = UnitX(Factor=1)

# ---- group: TCP 1
line = Line(Line((0, 0, 0), (0, -301.4092329, 265.7422016)))

# ---- group: TCP 2
line_2 = Line(Line((0, 0, 0), (-1.426640056e-12, -2.47268872e-12, 359.9497928)))

# ---- group: TCP 3
line_3 = Line(Line((0, 0, 0), (1.60783567e-10, 301.4092329, 265.7422016)))

# ----
number_slider = Slider(5, range=0..10)
tolerance_2 = Slider(-3, range=-8..0, expression="10^x")
X_2 = UnitX(Factor=1)

# ----
# Tooldata for distance sensor attached to ClayTool02
panel_3 = Panel("t_A057_ClayTool02_DistSensor")
tolerance_3 = Slider(-3, range=-8..0, expression="10^x")
Z_2 = UnitZ(Factor=1)
X_3 = UnitX(Factor=1)

# ----
# Tooldata for trident tool
end = EndPoints(Curve=line)  # -> Start, End
end_2 = EndPoints(Curve=line_2)  # -> Start, End
end_3 = EndPoints(Curve=line_3)  # -> Start, End
python = GhPythonScript(
    origin=end.End,
    x_vector=X_2,
    z_vector=line,
    prefix=panel,
    name="ClayTrident00",
    weight=number_slider,
    tolerance=tolerance_2)  # -> out, tooldata, plane; inputs origin: Point3d, x_vector: Vector3d, z_vector: Vector3d, cog_pt: Point3d
# ---------- python: Python ----------
import Rhino.Geometry as rg

from rapid_clay_formations_fab.robots import RapidToolData

kwargs = {}
if cog_pt:
    kwargs.update({"cog_pt": cog_pt})
if name:
    if prefix:
        name = prefix + name
    kwargs.update({"name": name})
if weight:
    kwargs.update({"weight": weight})
if tolerance:
    kwargs.update({"tolerance": tolerance})

y_vector = rg.Vector3d.CrossProduct(x_vector, z_vector)

plane = rg.Plane(origin, x_vector, y_vector)

plane.Flip()

tool = RapidToolData.from_plane_point(plane, **kwargs)
tooldata = tool.get_rapid_tooldata()
# ---------- end python ----------
python_2 = GhPythonScript(
    origin=end_2.End,
    x_vector=X_2,
    z_vector=line_2,
    prefix=panel,
    name="ClayTrident01",
    weight=number_slider,
    tolerance=tolerance_2)  # -> out, tooldata, plane; inputs origin: Point3d, x_vector: Vector3d, z_vector: Vector3d, cog_pt: Point3d; same code as python
python_3 = GhPythonScript(
    origin=end_3.End,
    x_vector=X_2,
    z_vector=line_3,
    prefix=panel,
    name="ClayTrident02",
    weight=number_slider,
    tolerance=tolerance_2)  # -> out, tooldata, plane; inputs origin: Point3d, x_vector: Vector3d, z_vector: Vector3d, cog_pt: Point3d; same code as python

pt = ConstructPoint(
    XCoordinate=Slider(111.624, range=-200..200),
    YCoordinate=Slider(-18.776, range=-18.776..0),
    ZCoordinate=Slider(189.561, range=0..1000))
python_4 = GhPythonScript(origin=pt, x_vector=X, z_vector=Z, prefix=panel, name=panel_2, weight=Slider(1, range=0..10), tolerance=tolerance)  # -> out, tooldata, plane; inputs origin: Point3d, x_vector: Vector3d, z_vector: Vector3d, cog_pt: Point3d; same code as python

pt_2 = ConstructPoint(
    XCoordinate=Slider(-113.66, range=-200..200),
    YCoordinate=Slider(-18.776, range=-18.776..0),
    ZCoordinate=Slider(212.41, range=0..1000))
python_5 = GhPythonScript(
    origin=pt_2,
    x_vector=X_3,
    z_vector=Z_2,
    prefix=panel,
    name=panel_3,
    weight=Slider(1, range=0..10),
    tolerance=tolerance_3)  # -> out, tooldata, plane; inputs origin: Point3d, x_vector: Vector3d, z_vector: Vector3d, cog_pt: Point3d; same code as python

bang = Button()
unload = PythonScript(bang=bang, module="rapid_clay_formations_fab")
# ---------- unload: Python ----------
import sys

def unload_modules(top_level_module_name):
    """Unloads all modules named starting with the specified string.

    This function eases the development workflow when editing a library that is
    used from Rhino/Grasshopper.

    Args:
        top_level_module_name (:obj:`str`): Name of the top-level module to unload.

    Returns:
        list: List of unloaded module names.
    """
    modules = filter(lambda m: m.startswith(top_level_module_name), sys.modules)

    for module in modules:
        sys.modules.pop(module)

    return modules

unload_modules(module)
# ---------- end unload ----------
panel_4 = Panel(python_5.tooldata)
join = TextJoin(Text=[python.tooldata, python_2.tooldata, python_3.tooldata])
panel_5 = Panel(join)
panel_6 = Panel(python_4.tooldata)
panel_7 = Panel(python.tooldata)
panel_8 = Panel(python_2.tooldata)
panel_9 = Panel(python_3.tooldata)
