# Grasshopper definition abb_robot_control.gh (Grasshopper 1.0.7)

# ---- group: ROS client
disconnect = Button()
connect = Button()
restart = Button()
ros = PythonScript(restart=restart)  # -> out, ros_client
# ---------- ros: Python ----------
import sys
import time
import logging
import scriptcontext as sc

from compas_fab.backends import RosClient

from compas_rrc import AbbClient

from System import TimeSpan
from System.Threading import ManualResetEventSlim

LOGGER = logging.getLogger('roslibpy')

key = 'rosclient_%s' % str(ghenv.Component.InstanceGuid)
previous_client = sc.sticky.get(key, None)
if previous_client:
    previous_client.terminate()


ros_client = AbbClient(RosClient('localhost', 9090))
sc.sticky[key] = ros_client

waitLock = ManualResetEventSlim(False)

ros_client.ros.on_ready(lambda: waitLock.Set())

if not waitLock.Wait(TimeSpan.FromSeconds(5)):
    raise Exception('Unable to connect to ROS')

LOGGER.info('ROS connection opened')
# ---------- end ros ----------
connect_2 = PythonScript(ros_client=ros.ros_client, connect=connect, disconnect=disconnect)  # -> out, ros_client
# ---------- connect_2: Python ----------
import logging
from System import TimeSpan
from System.Threading import ManualResetEventSlim

LOGGER = logging.getLogger('roslibpy')

if connect:
    if not ros_client.is_connected:
        LOGGER.debug('Connecting...')
        waitLock = ManualResetEventSlim(False)
        ros_client.on_ready(lambda: waitLock.Set())
        ros_client.connect()

        if not waitLock.Wait(TimeSpan.FromSeconds(5)):
            raise Exception('Unable to connect to ROS')
        LOGGER.debug('Reconnected')

if disconnect:
    if ros_client.is_connected:
        ros_client.terminate()
        LOGGER.debug('Terminated')
# ---------- end connect_2 ----------

# ----
reload = Button()

a1 = Slider(0, range=-360..360)
a4 = Slider(0, range=-360..360)
a5 = Slider(0, range=-360..360)
a6 = Slider(0, range=-360..360)
a2 = Slider(0, range=-360..360)
a3 = Slider(0, range=-360..360)
forward_kinematics = PythonScript(a1=a1, a2=a2, a3=a3, a4=a4, a5=a5, a6=a6)  # -> configuration
# ---------- forward_kinematics: Python ----------
import math

joint_positions = [a1, a2, a3, a4, a5, a6]
configuration = [math.radians(a) for a in joint_positions]
# ---------- end forward_kinematics ----------

py = PythonScript(reload=reload)
# ---------- py: Python ----------
from compas_rhino.utilities.misc import get_tolerance
from compas_rhino.utilities.misc import unload_modules

from compas_ghpython import unload_modules
unload_modules("compas")
unload_modules("compas_fab")
unload_modules("roslibpy")
# ---------- end py ----------

# ----
# Robot
set = PythonScript(client=connect_2.ros_client)
# ---------- set: Python ----------
if robot and client:
    robot.client = client
# ---------- end set ----------

# ---- group: MoveJ to Frame
# MoveJ to plane
python = GhPythonScript(client=connect_2.ros_client)  # -> out; inputs planes: list of Plane, speed: Int32
# ---------- python: Python ----------
from compas_rrc import MoveToFrame
from compas_rrc import SetAcceleration
from compas_rrc import SetTool
from compas_rrc import SetWorkObject
from compas_rrc import Zone

from compas_rcf.utils.util_funcs import ensure_frame

TIMEOUT = 5 
TIMEOUT_LONG = 30 

if tool_name is None:
    tool_name = "tool0"
if wobj_name is None:
    wobj_name = "wobj0"
if speed is None:
    speed = 100

if run:
    if not client.is_connected:
        raise Exception("Not connected to ROS")
        
    client.send(SetTool(tool_name))
    client.send(SetWorkObject(wobj_name))
    client.send(SetAcceleration(100, 100))
    client.send(SetMaxSpeed(100, 150))
    
    for plane in planes:
        frame = ensure_frame(plane)
        client.send_and_wait(MoveToFrame(frame, speed, Zone.FINE), timeout=TIMEOUT)
# ---------- end python ----------

# MoveL to plane
python_2 = GhPythonScript(client=connect_2.ros_client)  # -> out; inputs planes: list of Plane, speed: Int32, run: Boolean
# ---------- python_2: Python ----------
from compas_rrc import MoveToFrame
from compas_rrc import SetAcceleration
from compas_rrc import SetTool
from compas_rrc import SetWorkObject
from compas_rrc import Zone
from compas_rrc import Motion

from compas_rcf.utils.util_funcs import ensure_frame

TIMEOUT = 5 
TIMEOUT_LONG = 30 

if tool_name is None:
    tool_name = "tool0"
if wobj_name is None:
    wobj_name = "wobj0"
if speed is None:
    speed = 100

if run:
    if not client.is_connected:
        raise Exception("Not connected to ROS")
        
    client.send(SetTool(tool_name))
    client.send(SetWorkObject(wobj_name))
    client.send(SetAcceleration(100, 100))
    client.send(SetMaxSpeed(100, 150))
    
    for plane in planes:
        frame = ensure_frame(plane)
        client.send_and_wait(
                              MoveToFrame(frame,
                                           speed,
                                           Zone.FINE,
                                           Motion.LINEAR),
                              timeout=TIMEOUT)
# ---------- end python_2 ----------

# Move to joint configuration
python_3 = GhPythonScript(client=connect_2.ros_client, configurations=forward_kinematics)  # -> out; inputs configurations: list, run: Boolean
# ---------- python_3: Python ----------
from compas_rrc import SetAcceleration
from compas_rrc import SetMaxSpeed
from compas_rrc import MoveToJoints

from compas_rcf.utils.util_funcs import ensure_frame

TIMEOUT = 5 
TIMEOUT_LONG = 30 

if speed is None:
    speed = 100

if run:
    if not client.is_connected:
        raise Exception("Not connected to ROS")

    client.send(SetAcceleration(100, 100))
    client.send(SetMaxSpeed(100, 150))
    
    for confs in configurations:
        client.send_and_wait(
                              MoveToJoints(conf,
                                            [],
                                            speed,
                                            Zone.FINE,
                                            ),
                              timeout=TIMEOUT)
# ---------- end python_3 ----------

# Get joint configuration and frame
python_4 = GhPythonScript(client=connect_2.ros_client)  # -> out, plane, joint_values; inputs run: Boolean
# ---------- python_4: Python ----------
from compas_rrc import GetFrame
from compas_rrc import GetJoints

from compas_rcf.rhino import cgframe_to_rgplane

TIMEOUT = 5 
TIMEOUT_LONG = 30 

if run:
    if not client.is_connected:
        raise Exception("Not connected to ROS")
        
    frame = client.send_and_wait(GetFrame(), timeout=TIMEOUT_LONG)
    plane = cgframe_to_rgplane(frame)
    joints = str(client.send_and_wait(GetJoints(), timeout=TIMEOUT_LONG))
# ---------- end python_4 ----------

# ----
panel = Panel(python_4.joint_values)
pln = Plane(python_4.plane)
