# Grasshopper definition create_rapid_tooldata.gh (Grasshopper 1.0.7)

# Tooldata for trident tool
number_slider = Slider(111.624, range=-200..200)

# ---- group: TCP 1
line = Line(Line((0, 0, 0), (4.388436597e-07, -293.047182, 246.3801507)))

# ---- group: TCP 2
line_2 = Line(Line((0, 0, 0), (0, 0, 348.995388)))

# ---- group: TCP 3
line_3 = Line(Line((0, 0, 0), (4.388436597e-07, 293.047182, 246.3801507)))

# ----
end = EndPoints(Curve=line)  # -> Start, End
end_2 = EndPoints(Curve=line_2)  # -> Start, End
end_3 = EndPoints(Curve=line_3)  # -> Start, End
pt = ConstructPoint(XCoordinate=number_slider, YCoordinate=Slider(-18.776, range=-18.776..0), ZCoordinate=Slider(189.561, range=0..1000))
number_slider_2 = Slider(5, range=0..10)
xy = XYPlane(Origin=pt)
pl = PlaneNormal(Origin=end.End, ZAxis=line)
pl_2 = PlaneNormal(Origin=end_2.End, ZAxis=line_2)
pl_3 = PlaneNormal(Origin=end_3.Start, ZAxis=line_3)
tolerance = Slider(-6, range=-8..0, expression="10^x")
bang = Button()
unload = PythonScript(bang=bang, module="compas_rcf")
# ---------- unload: Python ----------
import sys

def unload_modules(top_level_module_name):
    """Unloads all modules named starting with the specified string.

    This function eases the development workflow when editing a library that is
    used from Rhino/Grasshopper.

    Args:
        top_level_module_name (:obj:`str`): Name of the top-level module to unload.

    Returns:
        list: List of unloaded module names.
    """
    modules = filter(lambda m: m.startswith(top_level_module_name), sys.modules)

    for module in modules:
        sys.modules.pop(module)

    return modules

unload_modules(module)
# ---------- end unload ----------
python = GhPythonScript(plane=xy, prefix="t_A057_", name="ClayTool02_Prism", weight=Slider(1, range=0..10), tolerance=tolerance)  # -> out, tooldata; inputs plane: Plane, cog_pt: Point3d
# ---------- python: Python ----------
from compas_rcf.abb.helpers import RapidToolData

kwargs = {}
if cog_pt:
    kwargs.update({"cog_pt": cog_pt})
if name:
    if prefix:
        name = prefix + name
    kwargs.update({"name": name})
if weight:
    kwargs.update({"weight": weight})
if tolerance:
    kwargs.update({"tolerance": tolerance})

tool = RapidToolData.from_plane_point(plane, **kwargs)
tooldata = str(tool)
# ---------- end python ----------
python_2 = GhPythonScript(plane=pl, prefix="t_A057_", name="Trident01_A", weight=number_slider_2, tolerance=tolerance)  # -> out, tooldata; inputs plane: Plane, cog_pt: Point3d; same code as python
python_3 = GhPythonScript(plane=pl_2, prefix="t_A057_", name="Trident01_B", weight=number_slider_2, tolerance=tolerance)  # -> out, tooldata; inputs plane: Plane, cog_pt: Point3d; same code as python
python_4 = GhPythonScript(plane=pl_3, prefix="t_A057_", name="Trident01_C", weight=number_slider_2, tolerance=tolerance)  # -> out, tooldata; inputs plane: Plane, cog_pt: Point3d; same code as python
panel = Panel(python.tooldata)
panel_2 = Panel(python_2.tooldata)
panel_3 = Panel(python_3.tooldata)
panel_4 = Panel(python_4.tooldata)
