# Grasshopper definition create_rapid_tooldata.gh (Grasshopper 1.0.7)

crv = Curve([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])
line = Line(crv)
item = ListItem(List=line, Index=0, Wrap=True)  # -> Item, Item1, Item2

# ---- group: TCP 2
line_2 = Line(Line((0, 0, 348.995388), (0, 0, 0)))

# ---- group: TCP 1
line_3 = Line(Line((4.388436597e-07, -293.047182, 246.3801507), (0, 0, 0)))

# ---- group: TCP 3
line_4 = Line(Line((4.388436597e-07, 293.047182, 246.3801507), (0, 0, 0)))

# ----
end = EndPoints(Curve=line)  # -> Start, End
end_2 = EndPoints(Curve=line_4)  # -> Start, End
end_3 = EndPoints(Curve=line_2)  # -> Start, End
end_4 = EndPoints(Curve=line_3)  # -> Start, End
pl = PlaneNormal(Origin=end_3.Start, ZAxis=line_2)
pt = Point(end.Start)
pl_2 = PlaneNormal(Origin=end_2.Start, ZAxis=line_4)
pl_3 = PlaneNormal(Origin=end_4.Start, ZAxis=line_3)
pl_4 = ConstructPlane(Origin=Point(0, 0, 0), XAxis=Vector(1, 0, 0), YAxis=Vector(0, 1, 0))
pt_2 = Point(end_2.Start)
pt_3 = Point(end_3.Start)
pt_4 = Point(end_4.Start)
prot = RotatePlane(Plane=pl, Angle=degrees(Slider(90, range=0..100)))
pflip = FlipPlane(Plane=pl_2, ReverseX=False, ReverseY=False, SwapAxes=True)
pflip_2 = FlipPlane(Plane=pl_3, ReverseX=False, ReverseY=False, SwapAxes=True)
pflip_3 = FlipPlane(Plane=prot, ReverseX=False, ReverseY=False, SwapAxes=True)
number_slider = Slider(90, range=0..360)
prot_2 = RotatePlane(Plane=pflip, Angle=degrees(number_slider))
prot_3 = RotatePlane(Plane=pflip_2, Angle=degrees(number_slider))
prot_4 = RotatePlane(Plane=pflip_3, Angle=degrees(number_slider))
python = GhPythonScript(plane=prot_3)  # -> out, tooldata; inputs plane: Plane
# ---------- python: Python ----------
import Rhino.Geometry as rg
from compas_rcf.utils.rhino_to_compas import rgplane_to_cgframe


class Tool(object):
    RAPID_DECLARATION = "TASK PERS tooldata "
    RAPID_COG_ETC = "[5,[10,0,55],[1,0,0,0],0,0,0]];"
    RAPID_TCP_ETC = ":=[TRUE,[[{:.8f}, {:.8f}, {:.8f}],[{:.8f}, {:.8f}, {:.8f}, {:.8f}]],"
    
    def __init__(self, coord, quaternion, name="tool"):
        self.coord = coord
        self.quaternion = quaternion
        self.xyzwxyz = coord + quaternion
        self.name = name
    @property
    def tooldata(self):
        return self.RAPID_DECLARATION + self.name + self.RAPID_TCP_ETC.format(*self.xyzwxyz) + self.RAPID_COG_ETC
    
    @classmethod
    def from_frame(cls, frame):
        coord = frame.point.data
        quaternion = frame.quaternion.wxyz
        
        return cls(coord, quaternion)

frame = rgplane_to_cgframe(plane)

tool = Tool.from_frame(frame)
tooldata = tool.tooldata
# ---------- end python ----------
python_2 = GhPythonScript(plane=prot_4)  # -> out, tooldata; inputs plane: Plane; same code as python
python_3 = GhPythonScript(plane=prot_2)  # -> out, tooldata; inputs plane: Plane; same code as python
panel = Panel(python_3.tooldata)
panel_2 = Panel(python_2.tooldata)
panel_3 = Panel(python.tooldata)
