# Grasshopper definition path_planning.gh (Grasshopper 1.0.7)
# plug-ins: MeshEdit Components

pln = Plane(Tree({0;0}: [Plane(origin=(5602.09192, 3865.612564, 2379.308691), x=(0.9999521643, 0, -0.009781055978), y=(3.083542714e-05, 0.9999950307, 0.003152415463)), Plane(origin=(5672.36279, 3841.118346, 2369.118502), x=(0.9912429132, 0, -0.1320510775), y=(0.006448095298, 0.9988070888, 0.04840270059)), Plane(origin=(5748.321335, 3811.466333, 2357.084875), x=(0.9901529827, 0, -0.1399895387), y=(0.008103006462, 0.9983233769, 0.05731296849)), Plane(origin=(5823.017093, 3779.027585, 2344.187012), x=(0.9891127662, 0, -0.1471595589), y=(0.009903685032, 0.9977328551, 0.06656625891)), Plane(origin=(5896.377388, 3743.927892, 2330.455161), x=(0.9881360489, 0, -0.1535810825), y=(0.01182646354, 0.9970307306, 0.07609110946)), Plane(origin=(5968.338483, 3706.290334, 2315.918395), x=(0.9872333401, 0, -0.1592806709), y=(0.01384745352, 0.9962137731, 0.08582753769))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], {0;1}: [Plane(origin=(5601.49517, 3865.804906, 2318.300776), x=(0.9976260305, 0, -0.06886438315), y=(0.001563583193, 0.9997422025, 0.02265135072)), Plane(origin=(5671.922483, 3841.276222, 2308.345836), x=(0.9911181501, 0, -0.1329842565), y=(0.006575907437, 0.9987766615, 0.04900956991)), Plane(origin=(5747.863452, 3811.650235, 2296.618341), x=(0.9900209609, 0, -0.1409201796), y=(0.00825484852, 0.9982828237, 0.0579936322)), Plane(origin=(5822.548187, 3779.236352, 2284.04838), x=(0.9889757453, 0, -0.1480775987), y=(0.01007914313, 0.9976807775, 0.06731624615)), Plane(origin=(5895.903955, 3744.159565, 2270.665326), x=(0.9879961791, 0, -0.1544783159), y=(0.01202460948, 0.9969658554, 0.07690573369)), Plane(origin=(5967.866888, 3706.542186, 2256.497417), x=(0.9870925929, 0, -0.1601505946), y=(0.01406698511, 0.9961349506, 0.08670224945))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], {0;2}: [Plane(origin=(5600.898419, 3865.997248, 2257.292861), x=(0.9960065833, 0, -0.08927981828), y=(0.002644390164, 0.9995612574, 0.02950084424)), Plane(origin=(5671.483592, 3841.433681, 2247.574317), x=(0.9909910308, 0, -0.1339282528), y=(0.006707094584, 0.9987452217, 0.04962859168)), Plane(origin=(5747.407551, 3811.83343, 2236.152976), x=(0.9898866633, 0, -0.1418604729), y=(0.008410435316, 0.9982409982, 0.05868708587)), Plane(origin=(5822.08167, 3779.444147, 2223.91097), x=(0.9888365797, 0, -0.1490040897), y=(0.01025864017, 0.9976271582, 0.06807946467)), Plane(origin=(5895.433164, 3744.390043, 2210.87681), x=(0.9878543298, 0, -0.1553828275), y=(0.01222701493, 0.9968991646, 0.07773387726)), Plane(origin=(5967.398036, 3706.792678, 2197.077908), x=(0.986950051, 0, -0.1610266963), y=(0.01429093078, 0.9960540373, 0.08759066162))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], {0;3}: [Plane(origin=(5600.301669, 3866.189589, 2196.284946), x=(0.9949900351, 0, -0.09997414676), y=(0.003335482753, 0.999443285, 0.03319630333)), Plane(origin=(5671.046111, 3841.590725, 2186.803965), x=(0.9908615107, 0, -0.1348831589), y=(0.006841756794, 0.9987127307, 0.05026004377)), Plane(origin=(5746.953628, 3812.015924, 2175.688808), x=(0.9897500538, 0, -0.1428104722), y=(0.008569868329, 0.9981978551, 0.05939359705)), Plane(origin=(5821.617539, 3779.650975, 2163.774819), x=(0.988695241, 0, -0.1499390559), y=(0.01044227656, 0.9975719456, 0.06885617007)), Plane(origin=(5894.96501, 3744.61933, 2151.089655), x=(0.9877104795, 0, -0.1562946213), y=(0.01243377772, 0.9968306011, 0.07857578494)), Plane(origin=(5966.931921, 3707.041817, 2137.659915), x=(0.9868056981, 0, -0.1619089686), y=(0.01451938536, 0.9959709707, 0.08849301142))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], {0;4}: [Plane(origin=(5599.704919, 3866.381931, 2135.277031), x=(0.9952284687, 0, -0.09757199974), y=(0.003172742505, 0.9994711846, 0.03236178077)), Plane(origin=(5670.610034, 3841.747359, 2126.034799), x=(0.9913164003, 0, -0.1314982684), y=(0.006495211059, 0.9987793768, 0.04896497366)), Plane(origin=(5746.501676, 3812.197718, 2115.225864), x=(0.9902595691, 0, -0.139233566), y=(0.00813723573, 0.9982907436, 0.05787379997)), Plane(origin=(5821.155789, 3779.856839, 2103.639959), x=(0.9892564415, 0, -0.146190605), y=(0.009916870127, 0.9976965393, 0.06710641666)), Plane(origin=(5894.499487, 3744.847431, 2091.303902), x=(0.9883198332, 0, -0.1523939215), y=(0.01181019337, 0.9969925232, 0.07659261095)), Plane(origin=(5966.468534, 3707.289608, 2078.243482), x=(0.9874592603, 0, -0.1578740296), y=(0.01379344984, 0.9961759321, 0.08627428978))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], {0;5}: [Plane(origin=(5599.108168, 3866.574272, 2074.269116), x=(0.9954613436, 0, -0.09516676647), y=(0.003014084572, 0.9994983288, 0.03152786197)), Plane(origin=(5670.175355, 3841.903586, 2065.266837), x=(0.9917602293, 0, -0.1281079532), y=(0.006157518085, 0.9988442065, 0.04766902754)), Plane(origin=(5746.051692, 3812.378819, 2054.76417), x=(0.9907567652, 0, -0.1356504045), y=(0.007715522865, 0.9983811366, 0.05635225713)), Plane(origin=(5820.696413, 3780.061744, 2043.506427), x=(0.9898041502, 0, -0.1424350527), y=(0.009404560001, 0.9978178364, 0.06535380402)), Plane(origin=(5894.036589, 3745.074352, 2031.519591), x=(0.9889146156, 0, -0.1484852959), y=(0.01120195694, 0.9971502277, 0.07460522522)), Plane(origin=(5966.007867, 3707.536059, 2018.828656), x=(0.9880972671, 0, -0.1538303961), y=(0.01308515946, 0.9963756389, 0.08404977581))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]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))
pt = Point(flatten(pln))
split = SplitList(List=pt, Index=Slider(0, range=0..525))  # -> ListA, ListB

# ---- group: From MeshEdit
convexhull = _3DConvexHull(Points=split.ListB, PlanktonMesh=False)

# ----
python = GhPythonScript(points=pt)  # -> out, a; inputs points: list of Point3d; disabled
# ---------- python: Python ----------
import math
import random

from compas.geometry import distance_point_point
from compas.geometry import convex_hull
from compas.datastructures import Mesh
from compas_ghpython.artists import MeshArtist

from compas_rcf.utils.rhino_to_compas import rgpoint_to_cgpoint
pts = [rgpoint_to_cgpoint(pt) for pt in points]
faces =  convex_hull(pts)

mesh = Mesh.from_vertices_and_faces(points, faces)

artist = MeshArtist(mesh)

a = artist.draw_faces(join_faces=True)
# ---------- end python ----------
python_2 = GhPythonScript()  # -> out, a; inputs lines: list of Point3d; disabled
# ---------- python_2: Python ----------
import math
import random

from compas.geometry import distance_point_point
from compas.geometry import convex_hull
from compas.datastructures import Mesh
from compas_ghpython.artists import MeshArtist

from compas_rcf.

_lines = 
mesh = Mesh.from_lines(_lines)

artist = MeshArtist(mesh)

a = artist.draw_faces(join_faces=True)
# ---------- end python_2 ----------

# ---- group: Setup clay tool
tool_boundingbox_z_len = Slider(354, range=0..1000)
bullet_height = Slider(150, range=0..1000)
tool_boundingbox_x_len = Slider(276, range=0..1000)
tool_boundingbox_y_len = Slider(180, range=0..1000)
bullet_radius = Slider(45, range=0..100)
division = Division(A=tool_boundingbox_x_len, B=2)
division_2 = Division(A=tool_boundingbox_y_len, B=2)
pt_2 = ConstructPoint(XCoordinate=0, YCoordinate=0, ZCoordinate=tool_boundingbox_z_len)
neg = Negative(Value=bullet_radius)
neg_2 = Negative(Value=division_2)
neg_3 = Negative(Value=division)
dom = ConstructDomain(DomainStart=neg_3, DomainEnd=division)
dom_2 = ConstructDomain(DomainStart=neg_2, DomainEnd=division_2)
dom_3 = ConstructDomain(DomainStart=0, DomainEnd=tool_boundingbox_z_len)
xy = XYPlane(Origin=pt_2)
dom_4 = ConstructDomain(DomainStart=neg, DomainEnd=bullet_radius)
box = DomainBox(Base=PlaneXY(0, 0, 0), X=dom, Y=dom_2, Z=dom_3)
box_2 = DomainBox(Base=xy, X=dom_4, Y=dom_4, Z=bullet_height)
join = BrepJoin(Breps=[box, box_2])  # -> Breps, Closed

# ----
number_slider = Slider(3000, range=0..10000)
division_3 = Division(A=number_slider, B=-2)
pt_3 = ConstructPoint(XCoordinate=division_3, YCoordinate=division_3, ZCoordinate=0)
xy_2 = XYPlane(Origin=pt_3)
box_3 = DomainBox(Base=xy_2, X=number_slider, Y=number_slider, Z=Slider(-300, range=-500..0))
pt_4 = ConstructPoint(XCoordinate=0, YCoordinate=0, ZCoordinate=tool_boundingbox_z_len)
mesh = MeshBrep(
    Brep=box_3,
    Settings={GridMaxCount=0, GridMinCount=16, JaggedSeams=False, MaxEdgeLength=0, MinEdgeLength=0.0001, MinTolerance=0, Refine=True, RefineAngle=0, RelativeTolerance=0.65, SimplePlanes=True, Tolerance=0})
xy_3 = XYPlane(Origin=pt_4)
tri = Triangulate(Mesh=mesh)  # -> Mesh, Count

# ---- group: ROS client
disconnect = Button()
connect = Button()
restart = Button()
ros = PythonScript(restart=restart, ip="localhost")  # -> out, ros_client
# ---------- ros: Python ----------
import sys
import time
import logging
import scriptcontext as sc

from compas_fab.backends import RosClient

from System import TimeSpan
from System.Threading import ManualResetEventSlim

LOGGER = logging.getLogger('roslibpy')

key = 'rosclient_%s' % str(ghenv.Component.InstanceGuid)
previous_client = sc.sticky.get(key, None)
if previous_client:
    previous_client.terminate()

ros_client = RosClient(ip, 9091)
sc.sticky[key] = ros_client

waitLock = ManualResetEventSlim(False)

ros_client.on_ready(lambda: waitLock.Set())

if not waitLock.Wait(TimeSpan.FromSeconds(5)):
    raise Exception('Unable to connect to ROS')

LOGGER.info('ROS connection opened')
# ---------- end ros ----------
connect_2 = PythonScript(ros_client=ros.ros_client, connect=connect, disconnect=disconnect)  # -> out, ros_client
# ---------- connect_2: Python ----------
import logging
from System import TimeSpan
from System.Threading import ManualResetEventSlim

LOGGER = logging.getLogger('roslibpy')

if connect:
    if not ros_client.is_connected:
        LOGGER.debug('Connecting...')
        waitLock = ManualResetEventSlim(False)
        ros_client.on_ready(lambda: waitLock.Set())
        ros_client.connect()

        if not waitLock.Wait(TimeSpan.FromSeconds(5)):
            raise Exception('Unable to connect to ROS')
        LOGGER.debug('Reconnected')

if disconnect:
    if ros_client.is_connected:
        ros_client.terminate()
        LOGGER.debug('Terminated')
# ---------- end connect_2 ----------

# ----
panel = Panel("Load IF")
load = Button()

units = ValueList({"m": 1, "cm": 100, "mm": 1000}, selected="mm")
button = Button()
button_2 = Button()
python_3 = GhPythonScript()  # -> out, a; inputs clay_bullets: list
# ---------- python_3: Python ----------
import Rhino.Geometry as rg
from ghpythonlib.components import Meshedit2000 as me

from compas_fab.robots import CollisionMesh

from compas_rcf.utils.compas_to_rhino import cgpoint_to_rgpoint

bullet_centroids = []
for bullet in clay_bullets:
    pt = cgpoint_to_rgpoint(bullet.centroid_frame.origin)
    bullet_centroids.append(pt)

building_states = []
for i in len(clay_bullets):
    if i == 0:
        building_states.append(None)
        continue
        
    pts = bullet_centroids[:i]

    hull = me.x3DConvexHull(pts)
    
    building_states.append(hull)

for i, compas_mesh in enumerate(static_obstacles):
    identifier = "{}_{}".format(id, i)
    cm = CollisionMesh(compas_mesh, identifier)
    scene.add_collision_mesh(cm, scale)

for bullet, building_state zip(clay_bullets, building_states):
    if building_state
    identifier = "{}_{}".format(id, i)
    cm = CollisionMesh(compas_mesh, identifier)
    scene.add_collision_mesh(cm, scale)
# ---------- end python_3 ----------
pt_5 = Point(Point(1265.526314, 0, 1765))
yz = YZPlane(Origin=pt_5)
toggle = BooleanToggle(True)

# ----
# Attach an collision object
# Select link name to attach
mesh_2 = Mesh(join.Breps)
scale = BooleanToggle(False)
remove = Button()
add = Button()

mjoin = MeshJoin(Meshes=mesh_2)
tri_2 = Triangulate(Mesh=mjoin)  # -> Mesh, Count

panel_2 = Panel("Define an obstacle")
mesh_3 = Mesh(tri.Mesh)
preview = CustomPreview(Geometry=tri.Mesh, Shader=ColourSwatch(SwatchColor=RGB(255, 255, 255)))
mesh_4 = PythonScript(mesh=mesh_3)  # -> compas_mesh
# ---------- mesh_4: Python ----------
from compas.datastructures import Mesh
from compas_rhino.helpers import mesh_from_guid

compas_mesh = mesh_from_guid(Mesh, mesh)
# ---------- end mesh_4 ----------
remove_2 = Button()
scale_2 = BooleanToggle(True)
add_2 = Button()

mesh_5 = PythonScript(mesh=tri_2.Mesh)  # -> compas_mesh; same code as mesh_4

ros_2 = PythonScript(
    load=load,
    ip="localhost",
    scale_factor=units,
    add_tool=Toggle(True),
    tcp_plane=xy_3,
    visual_mesh=mesh_5,
    collision_mesh=mesh_5)  # -> out, robot; inputs add_tool: list, tcp_plane: Plane
# ---------- ros_2: Python ----------
import os
import sys
import time
import logging
import scriptcontext as sc

from scriptcontext import sticky as st

import compas
from compas_fab.backends import RosClient
from compas_fab.robots import Tool
from compas_fab.ghpython import RobotArtist

from System import TimeSpan
from System.Threading import ManualResetEventSlim

from compas_rcf.utils.rhino_to_compas import rgplane_to_cgframe

LOGGER = logging.getLogger('roslibpy')

ros_client = RosClient(ip, 9091)

waitLock = ManualResetEventSlim(False)

ros_client.on_ready(lambda: waitLock.Set())

if not waitLock.Wait(TimeSpan.FromSeconds(5)):
    raise Exception('Unable to connect to ROS')

LOGGER.info('ROS connection opened')

compas.PRECISION = '12f'

# store robot in component
guid = str(ghenv.Component.InstanceGuid)
robot_key = "robot_" + guid

if robot_key not in st:
    st[robot_key] = None


if not visual_mesh:
    visual_mesh = collision_mesh
elif isinstance(visual_mesh, compas.geometry.Primitive):
    raise ValueError("Convert mesh to compas mesh")
    
if not collision_mesh:
    collision_mesh = visual_mesh
elif isinstance(collision_mesh, compas.geometry.Primitive):
    raise ValueError("Convert mesh to compas mesh")
    

if add_tool:
    if not tool_name:
        tool_name = "tool"
    tool = Tool(visual_mesh, rgplane_to_cgframe(tcp_plane), collision_mesh, tool_name)

if load:
    with ros_client as ros:
        robot = ros.load_robot(load_geometry=True)
        robot.artist = RobotArtist(robot.model)
        
        robot.scale(scale_factor)
        if tool:
            robot.attach_tool(tool, touch_links=["link_6"])
        robot.scale(scale_factor)
        st[robot_key] = robot
        
        
#print(robot.model)

robot = st[robot_key]
# ---------- end ros_2 ----------

# ----
# Planning scene
# Pass collision objects to planning scene
# Select the links the object is allowed to touch
scene = PythonScript(robot=ros_2.robot)  # -> scene
# ---------- scene: Python ----------
from scriptcontext import sticky as st

from compas_fab.robots import PlanningScene

# store scene in component
guid = str(ghenv.Component.InstanceGuid)
scene_key = "scene_" + guid

if scene_key not in st:
    st[scene_key] = None

if robot:
    st[scene_key] = PlanningScene(robot)

scene = st[scene_key]
# ---------- end scene ----------
idxs = Data([6, 7])
py = PythonScript(robot=ros_2.robot, idxs=idxs)  # -> touch_links; inputs idxs: list of Int32
# ---------- py: Python ----------
if robot:
    link_names = robot.get_link_names()
    touch_links = [link_names[i] for i in idxs]
# ---------- end py ----------
panel_3 = Panel(py)

py_2 = PythonScript(robot=ros_2.robot, idx=Slider(7, range=0..7))  # -> link_name; inputs idx: Int32
# ---------- py_2: Python ----------
if robot:
    link_names = robot.get_link_names()
    link_name = link_names[idx]
# ---------- end py_2 ----------
panel_4 = Panel(py_2)
attached = PythonScript(scene=scene, compas_mesh=mesh_5, scale=scale, id="tip", link_name=py_2, touch_links=py, add=add, remove=remove)  # -> acm, out; inputs touch_links: list
# ---------- attached: Python ----------
from compas_fab.robots import CollisionMesh
from compas_fab.robots import AttachedCollisionMesh

cm = CollisionMesh(compas_mesh, id)
acm = AttachedCollisionMesh(cm, link_name, touch_links)

if scene:
    if add:
        scene.add_attached_collision_mesh(acm, scale)
    if remove:
        scene.remove_attached_collision_mesh(id)
        scene.remove_collision_mesh(id)
# ---------- end attached ----------

panel_5 = Panel(ros_2.out)

collision = PythonScript(scene=scene, compas_meshes=mesh_4, scale=scale_2, id="floor", add=add_2, remove=remove_2)  # -> out; inputs compas_meshes: list
# ---------- collision: Python ----------
from compas_fab.robots import CollisionMesh

if scene:
    for i, compas_mesh in enumerate(compas_meshes):
        identifier = "{}_{}".format(id, i)
        cm = CollisionMesh(compas_mesh, identifier)
        if add:
            scene.add_collision_mesh(cm, scale)
        if remove:
           scene.remove_collision_mesh(id)
# ---------- end collision ----------
panel_6 = Panel(collision)

# ----
# Robot
set = PythonScript(robot=ros_2.robot, client=connect_2.ros_client)
# ---------- set: Python ----------
if robot and client:
    robot.client = client
# ---------- end set ----------

# ----
# Info
info = PythonScript(robot=ros_2.robot)  # -> out, main_group_name
# ---------- info: Python ----------
if robot:
    robot.info()
    link = robot.get_end_effector_link()
    print(link.parent_joint.name)
    print("End effector link: " + robot.get_end_effector_link_name())

    main_group_name = robot.main_group_name
# ---------- end info ----------
panel_7 = Panel(info.out)

# ----
# Configuration
main_planning_group = Text(info.main_group_name)

# ---- group: forward kinematics
set_joint_positions = BooleanToggle(False)
jp = GhPythonScript()  # -> joint_positions
# ---------- jp: Python ----------
import math
joint_positions = [-3.136, -0.328, -1.218, 3.129, 0.852, 0.008]
joint_positions = [0] * 6
print joint_positions
# ---------- end jp ----------
a1 = Slider(15, range=-360..360)
a6 = Slider(0, range=-360..360)
a4 = Slider(0, range=-360..360)
a5 = Slider(0, range=-360..360)
a2 = Slider(0, range=-360..360)
a3 = Slider(0, range=-360..360)
forward_kinematics = PythonScript(
    robot=ros_2.robot,
    group=main_planning_group,
    set_joint_positions=set_joint_positions,
    joint_positions=jp,
    a1=a1,
    a2=a2,
    a3=a3,
    a4=a4,
    a5=a5,
    a6=a6)  # -> configuration; inputs joint_positions: list
# ---------- forward_kinematics: Python ----------
import math
import Grasshopper
from compas_fab.robots import Configuration

if set_joint_positions:

    j = 0
    for i in range(ghenv.Component.Params.Input.Count):
        nslider = ghenv.Component.Params.Input[i].Sources[0]
        if nslider.GetType() == Grasshopper.Kernel.Special.GH_NumberSlider:
            nslider.TrySetSliderValue(math.degrees(joint_positions[j]))
            j += 1

if robot:
    joint_positions = [a1, a2, a3, a4, a5, a6]
    joint_positions = [math.radians(a) for a in joint_positions]
    types = robot.get_configurable_joint_types(group)
    configuration = Configuration(joint_positions, types)
    print configuration
# ---------- end forward_kinematics ----------

# ---- group: plan motion
# Plan motion
# If you specify the tolerance vector with [360, 1, 1], it means that
#     the frame's y-axis and z-axis are allowed to rotate about the x-axis by an
#     angle of 360 degrees, whereas the x-axis can only change 1 degree.
# TODO Example:
# Add path constraints
number_slider_2 = Slider(360, range=1..360)
py_3 = PythonScript(robot=ros_2.robot)  # -> configuration
# ---------- py_3: Python ----------
from compas_fab.robots import Configuration

if robot:
    types = robot.get_configurable_joint_types()
    values = [0] * len(types)

    configuration = Configuration(values, types)
    print configuration
# ---------- end py_3 ----------
list = ValueList({"don't use attached collision mesh": 0, "use attached collision mesh": 1}, selected="don't use attached collision mesh")
list_2 = ValueList({"0", "1"}, selected="0")
list_3 = ValueList({"RRT", "RRT*": "RRTStar", "EST", "PRM": "RPM", "PRM*": "RPMStar", "SPARS"}, selected="RRT")
compute = Button()
filter = StreamFilter(Gate=list, Stream1=attached.acm)
filter_2 = StreamFilter(Gate=list_2, Stream0=forward_kinematics, Stream1=py_3)
panel_8 = Panel("positions")
panel_9 = Panel("velocities")
panel_10 = Panel("accelerations")

# ----
# Plan cartesian motion
py_4 = PythonScript(robot=ros_2.robot)  # -> configuration; disabled; same code as py_3
list_4 = ValueList({"don't use attached collision mesh": 0, "use attached collision mesh": 1}, selected="don't use attached collision mesh")  # disabled
list_5 = ValueList({"0", "1"}, selected="0")  # disabled
number_slider_3 = Slider(0.01, range=0..0.01)  # disabled
avoid_collisions = BooleanToggle(True)  # disabled
filter_3 = StreamFilter(Gate=list_4, Stream1=attached.acm)  # disabled
compute_2 = Button()  # disabled
number_slider_4 = Slider(0, range=0..1)  # disabled
panel_11 = Panel("positions")  # disabled
panel_12 = Panel("velocities")  # disabled
panel_13 = Panel("accelerations")  # disabled

# ---- group: inverse kinematics
py_5 = PythonScript(robot=ros_2.robot)  # -> configuration
# ---------- py_5: Python ----------
from compas_fab.robots import Configuration

if robot:
    types = robot.get_configurable_joint_types()
    values = [0] * len(types)
    values = [-0.042, 4.295, -4.110, -3.327, 4.755, 0.]

    configuration = Configuration(values, types)
    print configuration
# ---------- end py_5 ----------
pt_6 = Point(Point(1219.281573, 236.1840979, 895.4839919))

# ----
xy_4 = XYPlane(Origin=pt_6)
pflip = FlipPlane(Plane=xy_4, ReverseX=False, ReverseY=False, SwapAxes=True)
yz_2 = YZPlane(Origin=pt_6)

# ---- group: inverse kinematics (continued)
ik = PythonScript(robot=ros_2.robot, group=main_planning_group, start_configuration=py_5, plane=pflip, use_tool=Toggle(True))  # -> out, configuration
# ---------- ik: Python ----------
import scriptcontext as sc
import logging

from compas.geometry import Frame

from compas_fab.backends.ros import RosError
from compas_fab.robots import Configuration

from compas_rcf.utils.util_funcs import ensure_frame
from compas_rcf.utils.compas_to_rhino import cgpoint_to_rgpoint

LOGGER = logging.getLogger('roslibpy')

guid = str(ghenv.Component.InstanceGuid)
response_key = "response_" + guid

if response_key not in sc.sticky:
    sc.sticky[response_key] = None

frame = ensure_frame(plane)

if robot.attached_tool:
    tool0_frame = robot.from_attached_tool_to_tool0([frame])[0]
else:
    tool0_frame = frame

if robot:
    if robot.client:
        if robot.client.is_connected:
            response = robot.inverse_kinematics(tool0_frame, start_configuration, group)
            sc.sticky[response_key] = response
        else:
            print("Robot is not connected")

if sc.sticky[response_key]:
    response = sc.sticky[response_key]
    configuration = response
# ---------- end ik ----------
panel_14 = Panel(ik.out)

# ---- group: plan motion (continued)
python_4 = PythonScript(
    robot=ros_2.robot,
    group=main_planning_group,
    goal_plane=yz_2,
    tolerance_position=Slider(0.001, range=0..0.001),
    tolerance_xaxis_deg=number_slider_2,
    tolerance_yaxis_deg=Slider(360, range=1..360),
    tolerance_zaxis_deg=Slider(360, range=1..360))  # -> goal_constraints
# ---------- python_4: Python ----------
import math
from compas.geometry import Frame

from compas_rcf.utils.util_funcs import ensure_frame

frame = Frame(goal_plane.Origin, goal_plane.XAxis, goal_plane.YAxis)

tolerances_axes = [math.radians(tolerance_xaxis_deg), math.radians(tolerance_yaxis_deg), math.radians(tolerance_zaxis_deg)]

frame = ensure_frame(goal_plane)

if robot.attached_tool:
    tool0_frame = robot.from_attached_tool_to_tool0([frame])[0]
else:
    tool0_frame = frame

if robot:
    goal_constraints = robot.constraints_from_frame(tool0_frame, tolerance_position, tolerances_axes, group)
    
print goal_constraints
# ---------- end python_4 ----------
start_configuration = Data(ik.configuration)
plan_motion = PythonScript(
    robot=ros_2.robot,
    start_configuration=filter_2,
    goal_constraints=python_4,
    planner_id=list_3,
    compute=compute,
    acm=filter)  # -> out, response; inputs goal_constraints: list, path_constraints: list, acm: list
# ---------- plan_motion: Python ----------
import logging
from scriptcontext import sticky as st
import math
from compas.geometry import Frame

from compas_fab.robots import Configuration

from compas_ghpython.utilities import update_component

guid = str(ghenv.Component.InstanceGuid)
response_key = "response_" + guid
if response_key not in st:
    st[response_key] = None

LOGGER = logging.getLogger('roslibpy')
data = dict(requesting_solution=False)

path_constraints = list(path_constraints)
if not len(path_constraints):
    path_constraints = None

if robot and robot.client and robot.client.is_connected and start_configuration and compute:
    st[response_key] = robot.plan_motion(goal_constraints,
                                         start_configuration,
                                         group,
                                         planner_id=str(planner_id),
                                         path_constraints=path_constraints,
                                         attached_collision_meshes=list(acm))

response = st[response_key]
# ---------- end plan_motion ----------
py_6 = PythonScript(robot=ros_2.robot, response=plan_motion.response)  # -> start_configuration, configurations, error
# ---------- py_6: Python ----------
from compas_fab.backends.ros import MoveItErrorCodes
from compas_fab.robots import Configuration
joint_positions = []

if response:
    #if response.error_code == MoveItErrorCodes.SUCCESS:
    print response.start_configuration
    print response.planning_time

    configurations = response.points
    start_configuration = response.start_configuration
    #error = response.error_code.human_readable




print start_configuration
# ---------- end py_6 ----------
vis = PythonScript(response=plan_motion.response)  # -> P, V, A, time
# ---------- vis: Python ----------
from compas_ghpython import list_to_ghtree

if response:

    positions = []
    velocities = []
    accelerations = []
    time_from_start = []

    for p in response.points:
        positions.append(p.positions)
        velocities.append(p.velocities)
        accelerations.append(p.accelerations)
        time_from_start.append(p.time_from_start.seconds)

    P = list_to_ghtree(list(zip(*positions)))
    V = list_to_ghtree(list(zip(*velocities)))
    A = list_to_ghtree(list(zip(*accelerations)))

    time = time_from_start[-1]
    print time
# ---------- end vis ----------
error = Panel(py_6.error)
panel_15 = Panel(plan_motion.out)
time_s = Panel(vis.time)
prismatic = QuickGraph(vis.P, SortOrder=0)
animate = PythonScript(
    robot=ros_2.robot,
    start_configuration=py_6.start_configuration,
    configurations=py_6.configurations,
    value=Slider(0.22, range=0..1))  # -> configuration; inputs configurations: list
# ---------- animate: Python ----------
from compas_fab.utilities import map_range
from compas_fab.robots import Configuration

count = len(configurations)
if count and robot and configurations != [None]:
    idx = int(map_range(value, 0, 1, 0, count - 1))
    current_configuration = configurations[idx]
    #make full configuration
    configuration = robot.merge_group_with_full_configuration(current_configuration, start_configuration, group)
# ---------- end animate ----------
graph = QuickGraph(vis.V, SortOrder=0)
graph_2 = QuickGraph(vis.A, SortOrder=0)

# ----
start_configuration_2 = Data(ik.configuration)  # disabled
py_7 = PythonScript(start_plane=yz_2)  # -> planes; disabled
# ---------- py_7: Python ----------
planes = [start_plane, end_plane]
print planes
# ---------- end py_7 ----------
filter_4 = StreamFilter(Gate=list_5, Stream0=start_configuration_2, Stream1=py_4)  # disabled
plan_cartesian_motion = PythonScript(
    robot=ros_2.robot,
    start_configuration=filter_4,
    planes=py_7,
    max_step=number_slider_3,
    avoid_collisions=avoid_collisions,
    compute=compute_2,
    acm=filter_3)  # -> out, response; inputs planes: list, avoid_collisions: Boolean, acm: list; disabled
# ---------- plan_cartesian_motion: Python ----------
import logging
import scriptcontext as sc

from compas.geometry import Frame

from compas_ghpython.utilities import update_component

guid = str(ghenv.Component.InstanceGuid)
response_key = "response_" + guid
if response_key not in sc.sticky:
    sc.sticky[response_key] = None

LOGGER = logging.getLogger('roslibpy')
data = dict(requesting_solution=False)



if robot:
    if robot.client:
        if robot.client.is_connected:
            if start_configuration and compute:
                frames = [Frame(plane.Origin, plane.XAxis, plane.YAxis) for plane in planes]
                response = robot.plan_cartesian_motion(frames, start_configuration, float(max_step),
                                             bool(avoid_collisions), group,
                                             attached_collision_meshes=list(acm))
                sc.sticky[response_key] = response
                # update_component(ghenv, 100)  # Not needed now that it is sync?
        else:
            print("Robot is not connected")
            sc.sticky[response_key] = None

response = sc.sticky[response_key]
# ---------- end plan_cartesian_motion ----------
py_8 = PythonScript(response=plan_cartesian_motion.response)  # -> start_configuration, configurations, fraction, time; disabled
# ---------- py_8: Python ----------
from compas_fab.backends.ros import MoveItErrorCodes

joint_positions = []

if response:
    #if response.error_code == MoveItErrorCodes.SUCCESS:
    configurations = response.points
    start_configuration = response.start_configuration
    fraction = response.fraction
    time = response.time_from_start
# ---------- end py_8 ----------
panel_16 = Panel(plan_cartesian_motion.out)  # disabled
vis_2 = PythonScript(response=plan_cartesian_motion.response)  # -> P, V, A; disabled
# ---------- vis_2: Python ----------
from compas_ghpython import list_to_ghtree

if response:

    positions = []
    velocities = []
    accelerations = []

    for p in response.points:
        positions.append(p.positions)
        velocities.append(p.velocities)
        accelerations.append(p.accelerations)

    P = list_to_ghtree(list(zip(*positions)))
    V = list_to_ghtree(list(zip(*velocities)))
    A = list_to_ghtree(list(zip(*accelerations)))
# ---------- end vis_2 ----------
time_s_2 = Panel(py_8.time)  # disabled
fraction = Panel(py_8.fraction)  # disabled
prismatic_2 = QuickGraph(vis_2.P, SortOrder=0)  # disabled
animate_2 = PythonScript(
    robot=ros_2.robot,
    start_configuration=py_8.start_configuration,
    configurations=py_8.configurations,
    value=number_slider_4)  # -> configuration; inputs configurations: list; disabled; same code as animate
graph_3 = QuickGraph(vis_2.V, SortOrder=0)  # disabled
graph_4 = QuickGraph(vis_2.A, SortOrder=0)  # disabled

fk = PythonScript(robot=ros_2.robot, group=main_planning_group, configuration=ik.configuration)  # -> out, frame_WCF
# ---------- fk: Python ----------
import scriptcontext as sc
import logging
import Rhino

from compas_fab.robots import Configuration

LOGGER = logging.getLogger('roslibpy')

guid = str(ghenv.Component.InstanceGuid)
response_key = "response_" + guid

if response_key not in sc.sticky:
    sc.sticky[response_key] = None

if robot:
    if robot.client:
        if robot.client.is_connected:
            configuration = robot.get_group_configuration(group, configuration)
            sc.sticky[response_key] = robot.forward_kinematics(configuration, group, backend='model')
        else:
            print("Robot is not connected")

if sc.sticky[response_key]:
    frame_RCF = sc.sticky[response_key]
    frame_WCF = robot.to_world_coords(frame_RCF, group)

print frame_WCF
# ---------- end fk ----------

# ----
# Visualisation
# Select configuration input: from fk, ik, path, or from real robot
list_6 = ValueList({"0 from joints": 0, "1 inverse kinematics": 1, "2 kinetic path": 2}, selected="0 from joints")
filter_5 = StreamFilter(Gate=list_6, Stream0=forward_kinematics, Stream1=ik.configuration, Stream2=animate)
show_end_effector_frame = BooleanToggle(True)
show_base_frame = BooleanToggle(False)
show_collision = BooleanToggle(False)
show_frames = BooleanToggle(True)
show_visual = BooleanToggle(True)
visualize = PythonScript(
    robot=ros_2.robot,
    configuration=filter_5,
    show_visual=show_visual,
    show_collision=show_collision,
    show_frames=show_frames,
    show_base_frame=show_base_frame,
    show_end_effector_frame=show_end_effector_frame)  # -> out, visual, collision, frames, frames_color, ee_plane, ee_frame, ee_frame_geo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
# ---------- visualize: Python ----------
from System.Drawing import Color

from compas.geometry import Vector
from compas.geometry import Point
from compas_ghpython.utilities import draw_frame
from compas_ghpython.utilities import draw_pipes

from compas_fab.robots import Configuration

red = Color.FromArgb(255, 0, 0)
green = Color.FromArgb(0, 255, 0)
blue = Color.FromArgb(0, 0, 255)

frame_colors = [red, green, blue]

# TODO: move to frame artist?
def pipes_from_frame(frame, size, radius):
    pipes = []
    for axis in [frame.xaxis, frame.yaxis, frame.zaxis]:
        pipe = {}
        pipe['points'] = [list(frame.point), list(Point(*frame.point) + Vector(*axis) * size)]
        pipe['radius'] = radius
        pipes.append(pipe)
    return pipes

if robot and configuration:

    robot.artist.update(configuration, robot.get_configurable_joint_names(), visual=show_visual, collision=show_collision)

    print("Configuration:")
    print(configuration.values)

    if show_visual:
        visual = robot.draw_visual()

    if show_collision:
        collision = robot.draw_collision()

    pipe_size = 0.1 * robot.scale_factor
    pipe_radius = 0.001 * robot.scale_factor


    axes = robot.transformed_axes(configuration)

    frames = robot.transformed_frames(configuration)

    if show_frames:

        pipes = []
        frames_color = []
        for frame in frames:
            pipes += pipes_from_frame(frame, pipe_size, pipe_radius)
            frames_color += frame_colors
        frames = draw_pipes(pipes, cap=1)

    ee_frame_RCF = robot.forward_kinematics(configuration, backend='model')
    ee_frame = robot.to_world_coords(ee_frame_RCF)
    ee_plane = draw_frame(ee_frame)

    print("End-effector frame:")
    print(ee_frame)

    if show_end_effector_frame:
        ee_pipes = pipes_from_frame(ee_frame, pipe_size, pipe_radius)
        ee_frame_geo = draw_pipes(ee_pipes, cap=1)
        ee_frame_color = frame_colors

    base_frame = robot.get_base_frame()
    base_plane = draw_frame(base_frame)

    if show_base_frame:
        base_pipes = pipes_from_frame(base_frame, pipe_size, pipe_radius)
        base_frame_geo = draw_pipes(base_pipes, cap=1)
        base_frame_color = frame_colors
# ---------- end visualize ----------
preview_2 = CustomPreview(Geometry=visualize.ee_frame_geo, Shader=visualize.ee_frame_color)
preview_3 = CustomPreview(Geometry=visualize.base_frame_geo, Shader=visualize.base_frame_color)
preview_4 = CustomPreview(Geometry=visualize.frames, Shader=visualize.frames_color)
geo = Geometry(visualize.visual)
geo_2 = Geometry(visualize.collision)
panel_17 = Panel(visualize.out)

preview_5 = CustomPreview(Geometry=geo, Shader=ColourSwatch(SwatchColor=RGB(105, 105, 105)))
python_5 = GhPythonScript(ee_frame=visualize.ee_frame, acm=attached.acm)  # -> out, M
# ---------- python_5: Python ----------
from compas.geometry import Transformation
from compas.datastructures import mesh_transformed
from compas_ghpython.artists import MeshArtist

print(ee_frame)
print(acm)

print(acm.collision_mesh.frame)

T = Transformation.from_frame_to_frame(acm.collision_mesh.frame, ee_frame)

m = mesh_transformed(acm.collision_mesh.mesh, T)

artist = MeshArtist(m)
M = artist.draw()
# ---------- end python_5 ----------
