# Grasshopper definition abb_robot_control.ghx (Grasshopper 1.0.7)

# ---- group: ROS client
# ABB client
restart = Button()
connect = Button()
disconnect = Button()
ros = PythonScript(restart=restart)  # -> out, abb_client
# ---------- ros: Python ----------
import scriptcontext as sc

from compas_fab.backends import RosClient

from compas_rrc import AbbClient

key = 'rosclient_%s' % str(ghenv.Component.InstanceGuid)
previous_client = sc.sticky.get(key, None)

if previous_client:
    previous_client.terminate()

abb_client = AbbClient(RosClient('localhost', 9090))
sc.sticky[key] = abb_client
# ---------- end ros ----------
connect_2 = PythonScript(abb_client=ros.abb_client, connect=connect, disconnect=disconnect)  # -> out, abb_client
# ---------- connect_2: Python ----------
ros_client = abb_client.ros
if connect:
    if not ros_client.is_connected:
        ros_client.connect()

if disconnect:
    if ros_client.is_connected:
        ros_client.terminate()
# ---------- end connect_2 ----------

# ----
a6 = Slider(0, range=-360..360)
a1 = Slider(90, range=-360..360)
a4 = Slider(0, range=-360..360)
a5 = Slider(0, range=-360..360)
a2 = Slider(0, range=-360..360)
a3 = Slider(0, range=-360..360)
forward_kinematics = PythonScript(a1=a1, a2=a2, a3=a3, a4=a4, a5=a5, a6=a6)  # -> configuration
# ---------- forward_kinematics: Python ----------
import math

configuration = [a1, a2, a3, a4, a5, a6]
# ---------- end forward_kinematics ----------

pt = Point(Point(2090.158508, 222.4327358, 703.6954429))
pt_2 = Point(Point(2382.886967, 923.8764019, 703.6954429))
xy = XYPlane(Origin=pt)
xz = XZPlane(Origin=pt_2)
bang = Button()
pflip = FlipPlane(Plane=xy, ReverseX=False, ReverseY=False, SwapAxes=True)
unload = PythonScript(bang=bang, module="rapid_clay_formations_fab")
# ---------- unload: Python ----------
import sys

def unload_modules(top_level_module_name):
    """Unloads all modules named starting with the specified string.

    This function eases the development workflow when editing a library that is
    used from Rhino/Grasshopper.

    Args:
        top_level_module_name (:obj:`str`): Name of the top-level module to unload.

    Returns:
        list: List of unloaded module names.
    """
    modules = filter(lambda m: m.startswith(top_level_module_name), sys.modules)

    for module in modules:
        sys.modules.pop(module)

    return modules

unload_modules(module)
# ---------- end unload ----------
list = ValueList({"MoveJ": True, "MoveL": False}, selected="MoveL")

# ---- group: MoveJ to Frame
# Move to plane
python = GhPythonScript(client=connect_2.abb_client, planes=pflip, motion_type=list, run=Button())  # -> out; inputs planes: list of Plane, motion_type: Boolean, speed: Int32, run: Boolean
# ---------- python: Python ----------
from compas_rrc import MoveToFrame
from compas_rrc import SetAcceleration
from compas_rrc import SetMaxSpeed
from compas_rrc import SetTool
from compas_rrc import SetWorkObject
from compas_rrc import Zone
from compas_rrc import Motion

from rapid_clay_formations_fab.utils import ensure_frame

if tool_name is None:
    tool_name = "tool0"
if wobj_name is None:
    wobj_name = "wobj0"
if speed is None:
    speed = 100

if motion_type is None:
    motion = Motion.JOINT
elif motion_type:
    motion = Motion.JOINT
else:
    motion = Motion.LINEAR

if run:
    if not client.ros.is_connected:
        raise Exception("Not connected to ROS")
        
    client.send(SetTool(tool_name))
    client.send(SetWorkObject(wobj_name))
    client.send(SetAcceleration(100, 100))
    client.send(SetMaxSpeed(100, 150))
    
    for plane in planes:
        frame = ensure_frame(plane)
        client.send(MoveToFrame(frame,
                                 speed,
                                 Zone.FINE,
                                 motion))
# ---------- end python ----------

# Get joint configuration and frame
python_2 = GhPythonScript(client=connect_2.abb_client, run=Button())  # -> out, plane, joint_values; inputs run: Boolean
# ---------- python_2: Python ----------
from ghpythonlib.treehelpers import list_to_tree
from scriptcontext import sticky

from compas_rrc import GetFrame
from compas_rrc import GetJoints

from rapid_clay_formations_fab.rhino import cgframe_to_rgplane

TIMEOUT = 5 
TIMEOUT_LONG = 30 

if run:
    if not client.ros.is_connected:
        raise Exception("Not connected to ROS")
        
    sticky["frame"] = client.send_and_wait(GetFrame(), timeout=TIMEOUT)
    
    sticky["joint_values"], _ = client.send_and_wait(GetJoints(), timeout=TIMEOUT)

if "frame" in sticky.keys():
    plane = cgframe_to_rgplane(sticky["frame"])

if "joint_values" in sticky.keys():
    joint_values = list_to_tree(sticky["joint_values"])
# ---------- end python_2 ----------

# Move to joint configuration
python_3 = GhPythonScript(client=connect_2.abb_client, configuration=forward_kinematics, run=Button())  # -> out; inputs configuration: list, run: Boolean
# ---------- python_3: Python ----------
from compas_rrc import SetAcceleration
from compas_rrc import SetMaxSpeed
from compas_rrc import MoveToJoints
from compas_rrc import Zone

from rapid_clay_formations_fab.utils import ensure_frame

TIMEOUT = 5 
TIMEOUT_LONG = 30 

if speed is None:
    speed = 100

if run:
    if not client.ros.is_connected:
        raise Exception("Not connected to ROS")

    client.send(SetAcceleration(100, 100))
    client.send(SetMaxSpeed(100, 150))

    client.send_and_wait(
                          MoveToJoints(configuration,
                                        [],
                                        speed,
                                        Zone.FINE,
                                        ),
                          timeout=TIMEOUT_LONG)
# ---------- end python_3 ----------

# ----
panel = Panel(python_2.joint_values)
pln = Plane(python_2.plane)
