# Grasshopper definition create_edit_fab_data.gh (Grasshopper 1.0.7)

pln = Plane([Plane(origin=(-150, 0, 0), x=(0, 1, 0), y=(1, 0, 0)), Plane(origin=(-75, 0, 0), x=(0, 1, 0), y=(1, 0, 0)), Plane(origin=(0, 0, 0), x=(0, 1, 0), y=(1, 0, 0)), Plane(origin=(75, 0, 0), x=(0, 1, 0), y=(1, 0, 0)), Plane(origin=(150, 0, 0), x=(0, 1, 0), y=(1, 0, 0))])
bang = Button()

# ---- group: Set path to JSON
path = FilePath("G:\Shared drives\2020_MAS\T3\RCF-T3-Thesis\09-robot-control\07-run_data\20200810-14.07.04-fab_data_name.json")

# ----
unload = PythonScript(bang=bang, module="compas_rcf")
# ---------- unload: Python ----------
import sys

def unload_modules(top_level_module_name):
    """Unloads all modules named starting with the specified string.

    This function eases the development workflow when editing a library that is
    used from Rhino/Grasshopper.

    Args:
        top_level_module_name (:obj:`str`): Name of the top-level module to unload.

    Returns:
        list: List of unloaded module names.
    """
    modules = filter(lambda m: m.startswith(top_level_module_name), sys.modules)

    for module in modules:
        sys.modules.pop(module)

    return modules

unload_modules(module)
# ---------- end unload ----------
item = ListItem(List=pln, Index=0, Wrap=True)
Z = UnitZ(Factor="300")
move = Move(Geometry=item, Motion=Z)  # -> Geometry, Transform
pl = PlaneNormal(Origin=move.Geometry, ZAxis=Vector(0, 0, 1))

# ---- group: Read JSON
# Read ClayBullets from JSON
read_claybullets_from_json = GhPythonScript(path=path)  # -> out, cylinders, planes, meshes
# ---------- read_claybullets_from_json: Python ----------
import json

import ghpythonlib
from ghpythonlib.treehelpers import list_to_tree

from compas_rcf.fab_data import ClayBullet

if not path:
    raise Exception("No path given.")

with open(path, mode="r") as fp:
    run_data = json.load(fp)
print(run_data)
cylinders = [ClayBullet.from_data(data) for data in run_data["fab_data"]]

location_planes = [bullet.get_location_plane() for bullet in cylinders]

location_planes = list_to_tree(location_planes)

kwargs = {}
if face_count is not None:
    kwargs.update({'face_count': face_count})

def generate_mesh(bullet):
    return bullet.get_rg_mesh(**kwargs)
    
# normal    
#meshes = [bullet.get_rg_mesh(**kwargs) for bullet in clay_bullets]

# parallel (quicker)
meshes = ghpythonlib.parallel.run(generate_mesh, clay_bullets, flatten_results=True)
# ---------- end read_claybullets_from_json ----------

# ----
pflip = FlipPlane(Plane=pl, ReverseX=False, ReverseY=False, SwapAxes=True)
egress_distance = Slider(200, range=0..1000)

# ----
# ClayBullet creation
density = Slider(2, range=0..10)
pln_2 = Plane(pln)
pln_3 = Plane(pflip)
create_claybullet_objects = GhPythonScript(
    planes=pln_2,
    trajectory_to=pln_3,
    trajectory_from=pln_3,
    radius=Slider(45, range=0..100),
    height=Slider(100, range=0..200),
    compression_ratio=Slider(0.5, range=0..1),
    density=density,
    egress_frame_distance=egress_distance,
    face_count=Slider(30, range=0..100))  # -> out, clay_bullets, planes, meshes, egress_planes; inputs planes: list of Plane, trajectory_to: tree of Plane, trajectory_from: tree of Plane, radius: list, height: list, compression_ratio: list, bullet_ids: list, density: list, egress_frame_distance: list of Int32, face_count: Int32
# ---------- create_claybullet_objects: Python ----------
import Rhino.Geometry as rg
import ghpythonlib
from ghpythonlib.treehelpers import tree_to_list

import compas_rcf
from compas_rcf.utils import wrap_list
from compas_rcf.utils import ensure_frame
from compas_rcf.fab_data import ClayBullet
from compas_rcf.fab_data import ClayBulletEncoder
from compas_rcf.rhino import cgframe_to_rgplane

kwargs = {}

clay_bullets = []
for i, plane in enumerate(planes):
    
    kwargs = {}
    # Trajectories can be a list for each bullet

    if trajectory_to.DataCount > 0:
        _trajectory_to = tree_to_list(trajectory_to)
        kwargs.update({'trajectory_to': wrap_list(_trajectory_to,i)})
    if trajectory_from.DataCount > 0:
        _trajectory_from = tree_to_list(trajectory_from)
        kwargs.update({'trajectory_from': wrap_list(_trajectory_from, i)})
        
    # Following keyword arguments are assumed to be one per bullet
    if len(radius) > 0:
        kwargs.update({'radius': wrap_list(radius, i)})
    if len(height) > 0:
        kwargs.update({'height': wrap_list(height, i)})
    if len(compression_ratio) > 0:
        kwargs.update({'compression_ratio': wrap_list(compression_ratio, i)})
    if len(density) > 0:
        kwargs.update({'density': wrap_list(density, i)})
    if len(bullet_ids) > 0:
        kwargs.update({'bullet_id': wrap_list(bullet_ids, i)})
    if len(egress_frame_distance) > 0:
        kwargs.update({'egress_frame_distance': wrap_list(egress_frame_distance, i)})
    
    
    clay_bullets.append(ClayBullet(ensure_frame(plane), **kwargs))

location_frames = [bullet.location for bullet in clay_bullets]
location_planes = [cgframe_to_rgplane(frame) for frame in location_frames]

egress_frames = [cylinder.get_egress_frame() for cylinder in clay_bullets]
egress_planes = [cgframe_to_rgplane(frame) for frame in egress_frames]

kwargs = {}
if face_count is not None:
    kwargs.update({'face_count': face_count})
    
def generate_mesh(cls):
    return cls.get_rgmesh(**kwargs)
    
# normal    
#meshes = [bullet.get_rgmesh(**kwargs) for bullet in clay_bullets]

# parallel (quicker)
meshes = ghpythonlib.parallel.run(generate_mesh, clay_bullets, flatten_results=True)
# ---------- end create_claybullet_objects ----------

# ---- group: Read ClayBullet attributes
python = GhPythonScript(clay_bullets=read_claybullets_from_json.cylinders)  # -> out, location_planes, trajectories_to, trajectories_from, radii, heights, compression_ratios, bullet_ids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; inputs clay_bullets: list
# ---------- python: Python ----------
from ghpythonlib.treehelpers import list_to_tree
import System.DateTime

from compas_rcf.rhino import cgframe_to_rgplane

epoch = System.DateTime(1970, 1, 1, 0, 0, 0, 0)

_location_planes = []
_trajectories_to = []
_trajectories_from = []
radii = []
heights = []
compression_ratios = []
bullet_ids = []
placed_statuses = []
times_of_placement = []
cycle_times = []

for bullet in clay_bullets:
    _location_planes.append(bullet.get_location_plane())

    _trajectories_to.append([cgframe_to_rgplane(frame) for frame in bullet.trajectory_to])
    _trajectories_from.append([cgframe_to_rgplane(frame) for frame in bullet.trajectory_from])
    
    radii.append(bullet.radius)
    heights.append(bullet.height)
    compression_ratios.append(bullet.compression_ratio)
    bullet_ids.append(bullet.bullet_id)
    placed_statuses.append(isinstance(bullet.placed, (float, int)))
    
    if bullet.placed:
        times_of_placement.append(epoch.AddSeconds(bullet.placed))
    cycle_times.append(bullet.cycle_time)

location_planes = list_to_tree(_location_planes)
trajectories_to = list_to_tree(_trajectories_to)
trajectories_from = list_to_tree(_trajectories_from)
# ---------- end python ----------

# ----
# Configuration
path_2 = FilePath("G:\Shared drives\2020_MAS\T3\RCF-T3-Thesis\09-robot-control\02_fabrication_confs\20200731.yaml")
panel = Panel(path_2)
file = ReadFile(File=path_2, PerLineParse=False)
panel_2 = Panel(file)

# ----
# WCS to RCS xform
path_3 = FilePath()

# ----
# Picking setup
path_4 = FilePath("G:\Shared drives\2020_MAS\T3\RCF-T3-Thesis\09-robot-control\05_picking_confs\picking_conf_03.json")
panel_3 = Panel(path_4)

# ----
# Save directory
path_5 = FilePath("G:\Shared drives\2020_MAS\T3\RCF-T3-Thesis\09-robot-control\07-run_data\")

# ----
# Folder for log files
path_6 = FilePath("G:\Shared drives\2020_MAS\T3\RCF-T3-Thesis\09-robot-control\03_fabrication_logs\")

# ----
# File name
panel_4 = Panel("fab_data_name")

# ---- group: Edit clay_bullets
# Edit trajectories
create_claybullet_objects_2 = GhPythonScript(clay_bullets=read_claybullets_from_json.cylinders, enable=Toggle(True))  # -> out, edited_clay_bullets, edited_planes, edited_trajectory_to, edited_trajectory_from; inputs clay_bullets: list, new_trajectory_to: list of Plane, new_trajectory_from: list of Plane, enable: Boolean
# ---------- create_claybullet_objects_2: Python ----------
from ghpythonlib.treehelpers import list_to_tree
from compas_rcf.rhino import cgframe_to_rgplane

if enable:
    edited_clay_bullets = [cylinder.copy() for cylinder in clay_bullets]
    for edited_bullet in edited_clay_bullets:
    
        if len(new_trajectory_to):
            edited_bullet.trajectory_to = new_trajectory_to
    
        if len(new_trajectory_from):
            edited_bullet.trajectory_from = new_trajectory_from

    _edited_planes = [bullet.get_location_plane() for bullet in edited_clay_bullets]
    _edited_trajectory_to = [cgframe_to_rgplane(frame) for frame in bullet.trajectory_to for bullet in edited_clay_bullets]
    _edited_trajectory_from = [cgframe_to_rgplane(frame) for frame in bullet.trajectory_from for bullet in edited_clay_bullets]
    
    edited_planes = list_to_tree(_edited_planes)
    edited_trajectory_to = list_to_tree(_edited_trajectory_to)
    edited_trajectory_from = list_to_tree(_edited_trajectory_from)
else:
    raise Exception("Toggle enable to run")
# ---------- end create_claybullet_objects_2 ----------

# ----
pln_4 = Plane(create_claybullet_objects.egress_planes)

# ----
# Preview planes (Z should b down)
number_slider = Slider(10, range=0..100)
cluster = Cluster(plane=flatten([pln_2, pln_3]), amplitude=number_slider, R=Slider(1, range=0..10))  # -> geo, color
preview = CustomPreview(Geometry=cluster.geo, Material=cluster.color)

# ---- group: Clay bullet visualization
mesh = Mesh(create_claybullet_objects.meshes)

# ---- group: Write ClayBullets to JSON
# Write edited ClayBullets to JSON
write_claybullets_to_json = GhPythonScript(clay_bullets=simplify(create_claybullet_objects_2.edited_clay_bullets), file_path=path, save=Button())  # -> out; inputs clay_bullets: list, save: Boolean
# ---------- write_claybullets_to_json: Python ----------
import json
from time import localtime
from time import strftime

from compas_rcf.fab_data import ClayBulletEncoder

if save is None:
    save = False

date_stamp_format = '%Y%m%d-%H.%M'

if save:
    new_path = file_path.replace(".json", "")
    new_path += "-edited-" + strftime(date_stamp_format, localtime()) + ".json"

    with open(new_path, mode='w') as fp:
        json.dump(clay_bullets, fp, cls=ClayBulletEncoder)
# ---------- end write_claybullets_to_json ----------

# ----
path_7 = FilePath("C:\Users\a\Desktop\")
button = Button()

# ---- group: Write ClayBullets to JSON
write_claybullets_to_json_2 = GhPythonScript(clay_bullets=simplify(create_claybullet_objects.clay_bullets), folder=path_7, name="fab_data", save=Toggle(True))  # -> out; inputs clay_bullets: list, save: Boolean
# ---------- write_claybullets_to_json_2: Python ----------
import json
from os.path import join
from time import localtime
from time import strftime

from compas_rcf.fab_data import ClayBulletEncoder

if save is None:
    save = False

date_stamp_format = '%Y%m%d-%H.%M'
print(clay_bullets[0])
print(clay_bullets[0].__dict__)
data = [cylinder.to_data() for cylinder in clay_bullets]
print(data)
if save:
    
    file_name = strftime(date_stamp_format, localtime()) + "-" + name + ".json"
    full_path = join(folder, file_name)

    with open(full_path, mode='w') as fp:
        json.dump(data, fp, cls=ClayBulletEncoder)
# ---------- end write_claybullets_to_json_2 ----------

# ----
python_2 = GhPythonScript(
    fab_data=simplify(create_claybullet_objects.clay_bullets),
    xform_path=path_3,
    conf_path=path_2,
    pick_conf_path=path_4,
    log_dir=path_6,
    save_dir=path_5,
    name=panel_4,
    save=Button())  # -> out; inputs fab_data: list, save: Boolean
# ---------- python_2: Python ----------
import json
import os
from time import strftime
from time import localtime

import System

from compas_rcf.fab_data import ClayBulletEncoder

if fab_data is None:
    raise Exception("No fab_data specified.")

run_data = {}
print(fab_data)
run_data["fab_data"] = [cylinder.to_data() for cylinder in fab_data]
run_data["conf_path"] = conf_path
run_data["pick_conf_path"] = pick_conf_path
run_data["log_dir"] = log_dir

date_stamp_format = "%Y%m%d-%H.%M.%S"
timestamp = strftime(date_stamp_format, localtime())

run_data["created"] = timestamp

run_data["hostname"] = System.Net.Dns.GetHostName()

run_data["xform"] = xform_path

date_stamp_format = '%Y%m%d-%H.%M.%S'

if save:
    file_name = strftime(date_stamp_format, localtime()) + "-" + name + ".json"
    full_path = os.path.join(save_dir, file_name)
    with open(full_path, mode='w') as fp:
        json.dump(run_data, fp, cls=ClayBulletEncoder)
# ---------- end python_2 ----------

# ==== cluster Cluster
plane = ClusterInput()
amplitude = ClusterInput()
R = ClusterInput()
deconstruct_plane = DeconstructPlane(Plane=graft(plane))  # -> Origin, XAxis, YAxis, ZAxis
amplitude_2 = Amplitude(Vector=deconstruct_plane.XAxis, Amplitude=amplitude)
amplitude_3 = Amplitude(Vector=deconstruct_plane.YAxis, Amplitude=amplitude)
amplitude_4 = Amplitude(Vector=deconstruct_plane.ZAxis, Amplitude=amplitude)
move = Move(Geometry=deconstruct_plane.Origin, Motion=amplitude_3)  # -> Geometry, Transform
move_2 = Move(Geometry=deconstruct_plane.Origin, Motion=amplitude_4)  # -> Geometry, Transform
move_3 = Move(Geometry=deconstruct_plane.Origin, Motion=amplitude_2)  # -> Geometry, Transform
ln = Line(StartPoint=deconstruct_plane.Origin, EndPoint=move.Geometry)
ln_2 = Line(StartPoint=deconstruct_plane.Origin, EndPoint=move_3.Geometry)
ln_3 = Line(StartPoint=deconstruct_plane.Origin, EndPoint=move_2.Geometry)
pipe = Pipe(Curve=ln, Radius=R, Caps=0)  # -> simplify(Pipe)
pipe_2 = Pipe(Curve=ln_2, Radius=R, Caps=0)  # -> simplify(Pipe)
pipe_3 = Pipe(Curve=ln_3, Radius=R, Caps=0)  # -> simplify(Pipe)
path_mapper = PathMapper(pipe_2, source="{*}", target="{0}")
path_mapper_2 = PathMapper(ColourSwatch(SwatchColor=RGB(255, 0, 0)), source="{*}", target="{0}")
path_mapper_3 = PathMapper(pipe, source="{*}", target="{1}")
path_mapper_4 = PathMapper(ColourSwatch(SwatchColor=RGB(0, 255, 0)), source="{*}", target="{1}")
path_mapper_5 = PathMapper(ColourSwatch(SwatchColor=RGB(0, 0, 255)), source="{*}", target="{2}")
path_mapper_6 = PathMapper(pipe_3, source="{*}", target="{2}")
data = Data([path_mapper_6, path_mapper_3, path_mapper])
data_2 = Data([path_mapper_5, path_mapper_4, path_mapper_2])
geo = ClusterOutput(data)
color = ClusterOutput(data_2)
