# Grasshopper definition create_run_data.gh (Grasshopper 1.0.7)

path = FilePath("G:\Shared drives\2020_MAS\T3\RCF-T3-Thesis\09-robot-control\01_fabrication_data_jsons\20200626-11.08-clay-testing-model_16bullets+4test.json")
path_2 = FilePath("G:\Shared drives\2020_MAS\T3\RCF-T3-Thesis\09-robot-control\02_fabrication_confs\20200621.yaml")
path_3 = FilePath("G:\Shared drives\2020_MAS\T3\RCF-T3-Thesis\09-robot-control\05_picking_confs\picking_conf_03.json")
file = ReadFile(File=path_2, PerLineParse=False)
panel = Panel(path)
panel_2 = Panel(path_2)
panel_3 = Panel(path_3)
joint_1 = Slider(0, range=-360..360)
joint_2 = Slider(0, range=-360..360)
joint_3 = Slider(0, range=-360..360)
joint_4 = Slider(0, range=-360..360)
joint_5 = Slider(0, range=-360..360)
joint_6 = Slider(0, range=-360..360)
joint_1_2 = Slider(0, range=-360..360)
joint_2_2 = Slider(0, range=-360..360)
joint_3_2 = Slider(0, range=-360..360)
joint_4_2 = Slider(0, range=-360..360)
joint_5_2 = Slider(0, range=-360..360)
joint_6_2 = Slider(0, range=-360..360)
panel_4 = Panel(file)
merge = Merge(Data1=joint_1, Data2=joint_2, Data3=joint_3, Data4=joint_4, Data5=joint_5, Data6=joint_6)
merge_2 = Merge(Data1=joint_1_2, Data2=joint_2_2, Data3=joint_3_2, Data4=joint_4_2, Data5=joint_5_2, Data6=joint_6_2)
python = GhPythonScript(start=merge, end=merge_2)  # -> out, safe_joint_positions; inputs start: list, end: list
# ---------- python: Python ----------
from ghpythonlib.treehelpers import tree_to_list

safe_joint_positions = {}

safe_joint_positions["start"] = start
safe_joint_positions["end"] = end
# ---------- end python ----------
# File name is taken from fab_data
path_4 = FilePath("G:\Shared drives\2020_MAS\T3\RCF-T3-Thesis\09-robot-control\07-run_data\")
path_5 = FilePath("G:\Shared drives\2020_MAS\T3\RCF-T3-Thesis\09-robot-control\03_fabrication_logs\")
python_2 = GhPythonScript(fab_data_path=path, conf_path=path_2, pick_conf_path=path_3, log_dir=path_5, save_dir=path_4, save=Button())  # -> out; inputs save: Boolean
# ---------- python_2: Python ----------
import json
import os
from time import strftime
from time import localtime

import System

print 

if fab_data_path is None:
    raise Exception("No path to fab_data specified.")

run_data = {}

run_data["fab_data_path"] = fab_data_path
run_data["conf_path"] = conf_path
run_data["pick_conf_path"] = pick_conf_path
run_data["log_dir"] = log_dir

date_stamp_format = "%Y%m%d-%H.%M.%S"
timestamp = strftime(date_stamp_format, localtime())

run_data["created"] = timestamp

run_data["hostname"] = System.Net.Dns.GetHostName()

file_name = os.path.basename(fab_data_path)
print fab_data_path
full_path = os.path.join(save_dir, file_name)
print full_path
if save:
    with open(full_path, mode='w') as fp:
        json.dump(run_data, fp)
# ---------- end python_2 ----------
