# Grasshopper definition create_run_data.ghx (Grasshopper 1.0.7)

# ---- group: Reach test DJ 0.3.3
pln = Plane([Plane(origin=(1135.068427, 48.82454177, 296), x=(-0.04745075336, 0.9988735786, 0), y=(0.9988735786, 0.04745075336, 0)), Plane(origin=(1131.068473, -57.99419601, 296), x=(0.1213675477, 0.9926076357, 0), y=(0.9926076357, -0.1213675477, 0)), Plane(origin=(1109.607806, -162.7279986, 296), x=(0.2753646235, 0.9591124829, -0.06540312923), y=(0.9611704225, -0.2759554653, 0)), Plane(origin=(1072.962485, -263.191479, 296), x=(0.4005134301, 0.9069464733, -0.1305261922), y=(0.9147724787, -0.4039694447, 0)), Plane(origin=(1024.181371, -358.3865609, 296), x=(0.4933265351, 0.8476843139, -0.195090322), y=(0.8642914314, -0.5029913733, 0)), Plane(origin=(966.2148583, -448.3093771, 296), x=(0.5567845778, 0.7893057936, -0.2588190451), y=(0.8171494872, -0.576425811, 0))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])
pln_2 = Plane([Plane(origin=(355.3204815, -1930.555305, 296), x=(-0.2210518502, 0.8373386887, 0.5), y=(0.9668754346, 0.2552486904, 0)), Plane(origin=(329.3965518, -1830.432858, 296), x=(-0.2133517155, 0.8519120714, 0.4782539786), y=(0.970042296, 0.2429360903, 0)), Plane(origin=(305.7892654, -1729.741783, 296), x=(-0.1865548929, 0.8700971831, 0.4562106574), y=(0.9777781187, 0.2096424351, 0)), Plane(origin=(286.9555403, -1628.061806, 296), x=(-0.1346672904, 0.8908476984, 0.4338837391), y=(0.9887663494, 0.1494694159, 0)), Plane(origin=(276.0482156, -1525.251516, 296), x=(-0.05033551651, 0.9101149678, 0.4112871031), y=(0.9984740805, 0.05522237337, 0)), Plane(origin=(276.8403669, -1421.903705, 296), x=(0.07050233341, 0.9187751793, 0.3884347963), y=(0.9970687983, -0.0765102045, 0))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])

# ---- group: Reach test DJ 0.2.4
pln_3 = Plane([Plane(origin=(1199.269388, 47.10025743, -925), x=(-0.05029408163, 0.9987344519, 0), y=(0.9987344519, 0.05029408163, 0)), Plane(origin=(1193.608377, -64.01164847, -925), x=(0.1503936007, 0.9886262008, 0), y=(0.9886262008, -0.1503936007, 0)), Plane(origin=(1166.616701, -171.976404, -925), x=(0.3275686494, 0.9425609851, -0.06540312923), y=(0.9445834107, -0.3282715039, 0)), Plane(origin=(1121.889569, -273.9335325, -925), x=(0.463707872, 0.8763206734, -0.1305261922), y=(0.8838824099, -0.467709189, 0)), Plane(origin=(1063.768206, -368.9434764, -925), x=(0.5587270779, 0.8060792881, -0.195090322), y=(0.821871315, -0.5696731885, 0)), Plane(origin=(996.0185665, -457.3808864, -925), x=(0.6200451016, 0.7406461867, -0.2588190451), y=(0.7667733552, -0.6419179244, 0))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])
pln_4 = Plane([Plane(origin=(343.0166292, -1934.309786, -925), x=(-0.2926364163, 0.8150852274, 0.5), y=(0.9411793509, 0.3379074274, 0)), Plane(origin=(307.8029443, -1835.122775, -925), x=(-0.2883346661, 0.8295397834, 0.4782539786), y=(0.9445677589, 0.3283165374, 0)), Plane(origin=(274.599348, -1735.248988, -925), x=(-0.2658907159, 0.8492196202, 0.4562106574), y=(0.9543168036, 0.2987966505, 0)), Plane(origin=(245.8591597, -1634.012563, -925), x=(-0.2179739212, 0.8742037924, 0.4338837391), y=(0.9702930074, 0.2419328003, 0)), Plane(origin=(225.0341296, -1530.883337, -925), x=(-0.1332361134, 0.9017156186, 0.4112871031), y=(0.989259275, 0.1461714295, 0)), Plane(origin=(216.8985302, -1426.041122, -925), x=(0.0006005369247, 0.9214760162, 0.3884347963), y=(0.9999997876, -0.0006517118043, 0))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])

# ----
# Design data
pln_5 = Plane(Tree({0;0}: [Plane(origin=(14273.09628, 11947.63169, 3269.788994), x=(-0.7785695584, -0.6275540347, 0.002318682157), y=(-0.6061422903, 0.7510380046, -0.2617889219)), Plane(origin=(14196.57569, 12021.78274, 3269.49387), x=(-0.7855547861, -0.6187878968, 0.002284051341), y=(-0.6187920995, 0.7855486698, -0.003102427394)), Plane(origin=(14074.15182, 12196.59788, 3268.805378), x=(-0.7807283141, -0.6248663636, 0.002308062308), y=(-0.6036111485, 0.7551163432, 0.2558376237)), Plane(origin=(14131.43403, 12114.35988, 3269.129225), x=(-0.7807283141, -0.6248663636, 0.002308062308), y=(-0.6248706137, 0.7807222306, -0.003084606076))], {0;1}: [Plane(origin=(14309.16574, 11906.79774, 3325.451164), x=(-0.7675783806, -0.640950704, 0.002371645666), y=(-0.6190825801, 0.7404214144, -0.2617496668)), Plane(origin=(14234.39582, 11983.35772, 3325.146985), x=(-0.7775789332, -0.6287810461, 0.002323531109), y=(-0.6287853266, 0.7775728711, -0.003072970785)), Plane(origin=(14109.14877, 12159.23927, 3324.454032), x=(-0.7772891897, -0.6291391819, 0.002324946481), y=(-0.6077384062, 0.7517944267, 0.2558498968)), Plane(origin=(14166.88119, 12077.3167, 3324.776721), x=(-0.7772891897, -0.6291391819, 0.002324946481), y=(-0.6291434653, 0.7772831296, -0.003071900084))], {0;2}: [Plane(origin=(14339.49567, 11861.07238, 3381.131449), x=(-0.7549930082, -0.6557283371, 0.002430126678), y=(-0.5678185317, 0.6519127687, -0.502585174)), Plane(origin=(14265.55731, 11938.621, 3380.823567), x=(-0.7677284803, -0.6407709101, 0.002370934499), y=(-0.5548649187, 0.6629419356, -0.5026260161)), Plane(origin=(14203.45155, 12034.16642, 3380.447874), x=(-0.771440735, -0.636296829, 0.002353241109), y=(-0.5718486812, 0.6916729896, -0.4411094663)), Plane(origin=(14142.26167, 12129.37934, 3380.073576), x=(-0.7716719264, -0.6360164349, 0.002352132436), y=(-0.5854111664, 0.7088177082, -0.3935368126)), Plane(origin=(14081.18271, 12222.43565, 3379.707595), x=(-0.7621233438, -0.6474274183, 0.002397268979), y=(-0.6083439993, 0.7148391433, -0.3448515299)), Plane(origin=(13732.36421, 12594.91717, 3378.229571), x=(-0.48685089, -0.8734788527, 0.003302231864), y=(-0.8734850858, 0.4868468626, -0.001984240656))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], {0;3}: [Plane(origin=(14378.03371, 11822.02042, 3436.787068), x=(-0.7408646056, -0.6716497749, 0.002493205587), y=(-0.5816070093, 0.639677297, -0.5025397918)), Plane(origin=(14305.46387, 11900.7973, 3436.474628), x=(-0.7562318225, -0.6542992837, 0.002424468615), y=(-0.5665809255, 0.652985606, -0.5025891496)), Plane(origin=(14239.30998, 11995.78444, 3436.100576), x=(-0.7634619435, -0.6458483907, 0.002391020906), y=(-0.580433635, 0.6845017483, -0.4410829309)), Plane(origin=(14174.60669, 12090.90739, 3435.726184), x=(-0.767595667, -0.6409300022, 0.002371563693), y=(-0.5899341641, 0.7050655173, -0.3935229325)), Plane(origin=(14110.67208, 12184.54537, 3435.357605), x=(-0.7631904227, -0.646169216, 0.002392290333), y=(-0.6071616666, 0.7158418626, -0.3448552425)), Plane(origin=(13689.10179, 12619.73903, 3433.628976), x=(-0.4949143523, -0.8689355563, 0.003283725803), y=(-0.8393657643, 0.4790431864, 0.2568710557))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], {0;4}: [Plane(origin=(14417.2608, 11784.67288, 3492.43621), x=(-0.7253737668, -0.6883504541, 0.002559455976), y=(-0.5960703353, 0.6262619295, -0.5024899512)), Plane(origin=(14346.37391, 11864.20532, 3492.121073), x=(-0.7432166823, -0.6690461856, 0.002482885234), y=(-0.5793522172, 0.6417142412, -0.5025473521)), Plane(origin=(14278.88453, 11955.50774, 3491.761041), x=(-0.753586432, -0.6573443183, 0.002436525567), y=(-0.5856451082, 0.669697091, -0.4566460484)), Plane(origin=(14213.22918, 12047.354, 3491.399146), x=(-0.7611660747, -0.6485525718, 0.002401721545), y=(-0.5924352575, 0.6937882433, -0.4094854565)), Plane(origin=(14148.926, 12138.40146, 3491.040496), x=(-0.761296837, -0.6483990751, 0.002401114085), y=(-0.6052918451, 0.7093463816, -0.3611779244)), Plane(origin=(14084.61606, 12227.75009, 3490.688387), x=(-0.7530700832, -0.6579357884, 0.00243886784), y=(-0.6256996215, 0.7150167401, -0.3118509982))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], {0;5}: [Plane(origin=(14457.78401, 11748.46621, 3548.081122), x=(-0.7084119215, -0.705794332, 0.002628752683), y=(-0.6111772958, 0.611572642, -0.5024352861)), Plane(origin=(14388.48325, 11828.73919, 3547.763332), x=(-0.7287505456, -0.6847745351, 0.002545263037), y=(-0.5929734743, 0.6291862855, -0.5025008227)), Plane(origin=(14317.33686, 11919.04709, 3547.406671), x=(-0.7420060482, -0.6703885688, 0.002488206041), y=(-0.5972677116, 0.6593789643, -0.4566077772)), Plane(origin=(14248.382, 12010.32419, 3547.046553), x=(-0.7526863891, -0.6583746981, 0.002440606018), y=(-0.6014082865, 0.6860417181, -0.4094567547)), Plane(origin=(14181.18596, 12101.34468, 3546.687644), x=(-0.7566904831, -0.6537688008, 0.00242236841), y=(-0.6103049551, 0.7050460092, -0.361161995)), Plane(origin=(14114.58532, 12191.29939, 3546.332914), x=(-0.753448779, -0.6575020896, 0.002437150345), y=(-0.6252871461, 0.7153768987, -0.3118523332))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]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))
id = Text(["4G-00-000", "4G-00-001", "4G-00-002", "4G-00-003", "4G-01-000", "4G-01-001"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])
compression = Text(Tree({0;0}: ["0.5", "0.5", "0.63", "0.63"], {0;1}: ["0.5", "0.5", "0.63", "0.63"], {0;2}: ["0.5", "0.5", "0.5", "0.5", "0.5", "0.5", "0.5", "0.5", "0.63", "0.63"], {0;3}: ["0.5", "0.5", "0.5", "0.5", "0.5", "0.5", "0.5", "0.5", "0.5", "0.63", "0.63"], {0;4}: ["0.5", "0.5", "0.5", "0.5", "0.5", "0.5", "0.5", "0.5", "0.5", "0.5", "0.63", "0.63"], {0;5}: ["0.5", "0.5", "0.5", "0.5", "0.5", "0.5", "0.5", "0.5", "0.5", "0.5", "0.5", "0.63", "0.63"]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))

# ----
# WCS to RCS
transform = Transform({TransformCount=1, Name="Generic", m00=0.03448021176, m01=-0.9994049043, m02=0.0009758268972, m03=12503.08033, m10=0.999379584, m11=0.03448632076, m12=0.007151281127, m13=-15562.17694, m20=-0.007180678109, m21=0.000728643791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})

# ----
# Configuration
path = FilePath("G:\Shared drives\2020_MAS\T2_P1_BuildingWorkshop\02_robot_control\01_confs\20201012-new.yaml")
panel = Panel(path)

path_2 = FilePath("G:\Shared drives\2020_MAS\T2_P1_BuildingWorkshop\02_robot_control\03_rundata\")
path_3 = FilePath("G:\Shared drives\2020_MAS\T3\RCF-T3-Thesis\09-robot-control\03_fabrication_logs\")

# ----
# Save file
save_json_file = Button()

move = Move(Motion=Vector(0, 0, 10))  # -> Geometry, Transform

# ---- group: Travel joint configurations
a1 = Slider(90, range=-360..360)
a5 = Slider(0, range=-360..360)
a6 = Slider(0, range=-360..360)
a2 = Slider(0, range=-360..360)
a4 = Slider(0, range=-360..360)
a3 = Slider(0, range=-360..360)
forward_kinematics = PythonScript(a1=a1, a2=a2, a3=a3, a4=a4, a5=a5, a6=a6)  # -> configuration
# ---------- forward_kinematics: Python ----------
import math

configuration = [a1, a2, a3, a4, a5, a6]
# ---------- end forward_kinematics ----------

a1_2 = Slider(90, range=-360..360)
a6_2 = Slider(0, range=-360..360)
a4_2 = Slider(0, range=-360..360)
a5_2 = Slider(0, range=-360..360)
a2_2 = Slider(0, range=-360..360)
a3_2 = Slider(0, range=-360..360)
forward_kinematics_2 = PythonScript(a1=a1_2, a2=a2_2, a3=a3_2, a4=a4_2, a5=a5_2, a6=a6_2)  # -> configuration; same code as forward_kinematics

# ----
path_4 = FilePath("G:\Shared drives\2020_MAS\T2_P1_BuildingWorkshop\02_robot_control\02_pick_confs\200911-pick-conf.json")

bang = Button()

# ----
# Picking setup
panel_2 = Panel(path_4)

# ----
# Save directory
panel_3 = Panel(path_2)

# ----
# Folder for log files
panel_4 = Panel(path_3)

lng = ListLength(List=pln_2)
unload = PythonScript(bang=bang, module="rapid_clay_formations_fab")
# ---------- unload: Python ----------
import sys

def unload_modules(top_level_module_name):
    """Unloads all modules named starting with the specified string.

    This function eases the development workflow when editing a library that is
    used from Rhino/Grasshopper.

    Args:
        top_level_module_name (:obj:`str`): Name of the top-level module to unload.

    Returns:
        list: List of unloaded module names.
    """
    modules = filter(lambda m: m.startswith(top_level_module_name), sys.modules)

    for module in modules:
        sys.modules.pop(module)

    return modules

unload_modules(module)
# ---------- end unload ----------
matrix = TransformMatrix(move.Transform, Digits=3)
python = GhPythonScript(list_len=lng)  # -> out, ids
# ---------- python: Python ----------
ids = []
for p in range(list_len):
    ids.append("1LONGBOTTOM-00-{:03}".format(p))
# ---------- end python ----------
transform_2 = Transform(move.Transform)
paths = GhPythonScript(planes=flatten(pln_2), ids=python.ids)  # -> out, split_planes, split_compression_list, split_ids, file_name; inputs start: Int32, end: Int32, planes: list of Plane, compression: list, ids: list
# ---------- paths: Python ----------
import math

if not start:
    start = 0
if not end:
    end = len(planes)

if not len(compression):
    standard_value = 1 - .63
    split_compression_list = [standard_value] * (end - start)
else:
    split_compression_list = [1 - c for c in compression[start:end]]
split_planes = planes[start:end]
split_ids = ids[start:end]

level_segment = ids[0].split("-")[0]
file_name = "{}-{:03d}-{:03d}".format(level_segment, start, end)

print("{} cylinders".format(len(split_planes)))

density = 2087
r = 0.045
h = 0.15

volume_sqm = math.pi * (r ** 2) * h
weight_kg = volume_sqm * density

print("Total volume: {:.3f} sqm".format(volume_sqm * len(split_planes)))
print("Total weight: {:.3f} kg".format(weight_kg * len(split_planes)))

avg_cycle_time = 40

expected_run_duration_s = avg_cycle_time * len(split_planes)
expected_run_duration_min = expected_run_duration_s / 60
expected_run_duration_hrs = expected_run_duration_min // 60
expected_run_duration_remaining_min = expected_run_duration_min % 60

print("Expected run duration: {:.0f} hours and {:.0f} minutes.".format(
                                                               expected_run_duration_hrs,
                                                               expected_run_duration_remaining_min))
# ---------- end paths ----------

# ---- group: Travel joint configurations
python_2 = GhPythonScript(first_trajectory_pt=forward_kinematics, second_trajectory_pt=forward_kinematics_2)  # -> out, minimal_travel_trajectories; inputs first_trajectory_pt: list, second_trajectory_pt: list, third_trajectory_pt: list, fourth_trajectory_pt: list
# ---------- python_2: Python ----------
from compas.robots import Joint
from compas_fab.robots import JointTrajectory
from compas_fab.robots import JointTrajectoryPoint

from rapid_clay_formations_fab.robots import MinimalTrajectory

inputs = [first_trajectory_pt,
          second_trajectory_pt,
          third_trajectory_pt,
          fourth_trajectory_pt
      ]

data = [pt for pt in inputs if len(pt) > 0]
joint_trajectory_pts = [
    JointTrajectoryPoint(values=pt, types=[Joint.REVOLUTE] * 6) for pt in data
]
travel_trajectories = [JointTrajectory(joint_trajectory_pts)]


minimal_travel_trajectories = [
    MinimalTrajectory.from_joint_trajectory(traj) for traj in travel_trajectories
]
print(minimal_travel_trajectories)
# ---------- end python_2 ----------

# ----
add_manual_trajectory = BooleanToggle(False)
panel_5 = Panel(paths.file_name)
panel_6 = Panel(paths.out)
filter = StreamFilter(Gate=add_manual_trajectory, Stream1=python_2.minimal_travel_trajectories)
file = ReadFile(File=path, PerLineParse=False)
panel_7 = Panel(file)

# ----
# Planes
pln_6 = Plane(paths.split_planes)

# ----
# Compression
# (old format
# (0-1, larger number = less compression))
num = Number(paths.split_compression_list)

# ----
# IDs
txt = Text(paths.split_ids)

# ---- group: Transformation WCS to RCS
transform_3 = Transform(transform_2)

# ----
transform_4 = Transform(Geometry=pln_6, Transform=transform_3)  # -> flatten(Geometry)
prot = RotatePlane(Plane=transform_4, Angle=degrees(Slider(0, range=0..100)))
egress_distance = Slider(150, range=0..1000)

# ----
# FabricationElement creation
number_slider = Slider(45, range=0..100)
pln_7 = Plane(prot)
create_fabricationelement_objects = GhPythonScript(
    planes=pln_7,
    radius=number_slider,
    travel_trajectories=filter,
    height=Slider(150, range=0..200),
    compression=num,
    id=txt,
    egress_frame_distance=egress_distance,
    create_meshes=Toggle(False),
    u_res=Slider(5, range=0..100))  # -> out, elements, planes, meshes, egress_planes; inputs planes: list of Plane, travel_trajectories: list, compression: list, id: list, egress_frame_distance: list of Int32, create_meshes: Boolean, u_res: Int32
# ---------- create_fabricationelement_objects: Python ----------
import Rhino.Geometry as rg
import ghpythonlib

import rapid_clay_formations_fab
from rapid_clay_formations_fab.utils import wrap_list
from rapid_clay_formations_fab.utils import ensure_frame
from rapid_clay_formations_fab.fab_data import FabricationElement
from rapid_clay_formations_fab.rhino import cgframe_to_rgplane

def generate_mesh(cls):
    return cls.get_rgmesh(u_res=u_res)

if len(planes) != len(id) and len(id) != 0:
    raise Exception("Different amount of planes and ids")

elements = []
for i, plane in enumerate(planes):

    kwargs = {}

    # Following keyword arguments are assumed to be one per element

    kwargs['radius'] = radius

    kwargs['height'] = height
    kwargs['compression_ratio'] = compression[i]

    if len(travel_trajectories) > 0:
        kwargs["travel_trajectories"] = travel_trajectories

    if len(egress_frame_distance) > 0:
        kwargs['egress_frame_distance'] = wrap_list(egress_frame_distance, i)

    elements.append(FabricationElement(ensure_frame(plane), id[i], **kwargs))

location_frames = [elem.location for elem in elements]
location_planes = [elem.get_location_rgplane() for elem in elements]

egress_frames = [elem.get_egress_frame() for elem in elements]
egress_planes = [cgframe_to_rgplane(frame) for frame in egress_frames]

if create_meshes:
    # normal
    meshes = [elem.get_rgmesh(u_res=u_res) for elem in elements]


    # parallel (quicker)
    #meshes = ghpythonlib.parallel.run(generate_mesh, elements, flatten_results=True)
# ---------- end create_fabricationelement_objects ----------

reduce = RandomReduce(List=create_fabricationelement_objects.elements, Reduction=Slider(300, range=0..1000), Seed=1)
pln_8 = Plane(create_fabricationelement_objects.planes)
pln_9 = Plane(create_fabricationelement_objects.egress_planes)
python_3 = GhPythonScript(x=reduce)  # -> out, a
# ---------- python_3: Python ----------
print(x.__dict__)
print(x.to_data()["travel_trajectories"])
# ---------- end python_3 ----------

# ---- group: Clay bullet visualization
# Fabrication element meshes
mesh = Mesh(create_fabricationelement_objects.meshes)

# ----
python_4 = GhPythonScript(
    fab_data=simplify(create_fabricationelement_objects.elements),
    xform=transform_3,
    conf_path=path,
    pick_conf_path=path_4,
    log_dir=path_3,
    save_dir=path_2,
    name=panel_5,
    save=save_json_file)  # -> out; inputs fab_data: list, xform: Transform, save: Boolean
# ---------- python_4: Python ----------
import json
import os
import datetime
import time

import System
import Rhino.Geometry as rg

from rapid_clay_formations_fab.utils import CompasObjEncoder
from rapid_clay_formations_fab.rhino import rgtransform_to_matrix
from rapid_clay_formations_fab.rhino import rgplane_to_cgframe

if fab_data is None:
    raise Exception("No fab_data specified.")

run_data = {}

run_data["fab_data"] = fab_data
run_data["conf_path"] = conf_path
run_data["pick_conf_path"] = pick_conf_path
run_data["log_dir"] = log_dir

datetime_now = datetime.datetime.now()
iso_timestamp = datetime_now.isoformat()

run_data["created"] = iso_timestamp

run_data["hostname"] = System.Net.Dns.GetHostName()

run_data["xform"] = rgtransform_to_matrix(xform)

plane = rg.Plane.WorldXY.Clone()
plane.Transform(xform)

run_data["rcf"] = rgplane_to_cgframe(plane)

if save:
    # file name can not contain comma and microseconds are overkill
    file_timestamp = datetime_now.strftime('%Y%m%dT%H.%M.%S')

    file_name = file_timestamp + "-" + name + ".json"
    full_path = os.path.join(save_dir, file_name)
    with open(full_path, mode='w') as fp:
        json.dump(run_data, fp, cls=CompasObjEncoder)
# ---------- end python_4 ----------

# ----
# Preview planes (Z should b down)
number_slider_2 = Slider(51, range=0..100)
cluster = Cluster(plane=flatten(pln_7), amplitude=number_slider_2, R=Slider(1, range=0..10))  # -> geo, color
preview = CustomPreview(Geometry=cluster.geo, Material=cluster.color)

# ==== cluster Cluster
plane = ClusterInput()
amplitude = ClusterInput()
R = ClusterInput()
deconstruct_plane = DeconstructPlane(Plane=graft(plane))  # -> Origin, XAxis, YAxis, ZAxis
amplitude_2 = Amplitude(Vector=deconstruct_plane.XAxis, Amplitude=amplitude)
amplitude_3 = Amplitude(Vector=deconstruct_plane.YAxis, Amplitude=amplitude)
amplitude_4 = Amplitude(Vector=deconstruct_plane.ZAxis, Amplitude=amplitude)
move = Move(Geometry=deconstruct_plane.Origin, Motion=amplitude_3)  # -> Geometry, Transform
move_2 = Move(Geometry=deconstruct_plane.Origin, Motion=amplitude_4)  # -> Geometry, Transform
move_3 = Move(Geometry=deconstruct_plane.Origin, Motion=amplitude_2)  # -> Geometry, Transform
ln = Line(StartPoint=deconstruct_plane.Origin, EndPoint=move.Geometry)
ln_2 = Line(StartPoint=deconstruct_plane.Origin, EndPoint=move_3.Geometry)
ln_3 = Line(StartPoint=deconstruct_plane.Origin, EndPoint=move_2.Geometry)
pipe = Pipe(Curve=ln, Radius=R, Caps=0)  # -> simplify(Pipe)
pipe_2 = Pipe(Curve=ln_2, Radius=R, Caps=0)  # -> simplify(Pipe)
pipe_3 = Pipe(Curve=ln_3, Radius=R, Caps=0)  # -> simplify(Pipe)
path_mapper = PathMapper(pipe_2, source="{*}", target="{0}")
path_mapper_2 = PathMapper(ColourSwatch(SwatchColor=RGB(255, 0, 0)), source="{*}", target="{0}")
path_mapper_3 = PathMapper(pipe, source="{*}", target="{1}")
path_mapper_4 = PathMapper(ColourSwatch(SwatchColor=RGB(0, 255, 0)), source="{*}", target="{1}")
path_mapper_5 = PathMapper(ColourSwatch(SwatchColor=RGB(0, 0, 255)), source="{*}", target="{2}")
path_mapper_6 = PathMapper(pipe_3, source="{*}", target="{2}")
data = Data([path_mapper_6, path_mapper_3, path_mapper])
data_2 = Data([path_mapper_5, path_mapper_4, path_mapper_2])
geo = ClusterOutput(data)
color = ClusterOutput(data_2)
