# Grasshopper definition localization.ghx (Grasshopper 1.0.7)

# ----
# set path
# set path
# set path
# set path
# force
# force
# force
# force
# angleA
# angleA
# angleA
# angleA
# angleA
# angleB
# angleB
# angleB
# angleB
# angleB
# speed
# speed
# speed
# speed
# speed
# speed
# force
# force
# force
# force
# force
# force
# angleA
# angleA
# angleA
# angleA
# angleA
# angleA
# angleA
# angleA
# angleA
# angleA
# angleA
# angleA
# angleA
# angleB
# angleB
# angleB
# angleB
# angleB
# angleB
# speed
# speed
# speed
# speed
# speed
# speed
# speed
# speed
# speed
# speed
# speed
# speed
# speed
# data for further calculation
# data for further calculation
# data for further calculation
# data for further calculation
# data for further calculation
# data for further calculation
# CSV reading
panel = Panel("http://GKR-POC200:8000/Hilti%20Jobs/MAS_TEST2.csv")
# material resistance
# force
# angleA
# angleB
# speed
# force
# angleA
# angleB
# speed
# material resistance
# force
# angleA
# angleB
# speed
# force
# angleA
# angleB
# speed
read_data = Button()
file_path = FilePath("G:\Shared drives\2020_MAS\T3\RCF-T3-Thesis\09-robot-control\08_if_localization\localization_data_cache.csv")
panel_2 = Panel("RP")
# angleB
# speed
# data for further calculation
# set path
# set path
# set path
# force
# force
# angleA
# angleB
datasource = ValueList({"Total Station": 1, "File": 2}, selected="File")
panel_3 = Panel(file_path)
import_ts_cartesian_coordinates = PythonScript(data_source=datasource, total_station_file=panel, read_data=read_data, filepath_to_read=file_path, prefixes="RP")  # -> out, ids, pts; inputs data_source: Int32, read_data: Boolean, prefixes: list
# ---------- import_ts_cartesian_coordinates: Python ----------
import urllib2
import csv
import os

from collections import OrderedDict

import rhinoscriptsyntax as rs
import Rhino.Geometry as rg

from compas.geometry import Point

if len(prefixes) < 1:
    select_all = True
else:
    select_all = False
    prefixes = [prefix.upper() for prefix in prefixes]

class MeasurementPt(object):
    def __init__(self, pt_name, xyz, attrs={}):
        self.pt_name = pt_name
        self.xyz = xyz
        self.x, self.y, self.z = xyz
        self.attrs = attrs

        self.split_pt_name()

    def __repr__(self):
        return "Point ID: {}, Location: {}, {}, {}".format(self.pt_name, *self.xyz)

    def as_cgpoint(self):
        return Point(*self.xyz)

    def as_rgpoint(self):
        return rg.Point3d(*self.xyz)

    def split_pt_name(self):
        prefix = ""
        idx = ""

        for elem in self.pt_name:
            if elem.isdigit():
                idx += elem
            else:
                prefix += elem

        self.prefix = prefix

        try:
            self.idx = int(idx)
        except ValueError:
            print("No index number in pt_name")
            raise

if cache_dir is None:
    cache_dir = os.path.dirname(rs.DocumentPath())

cache_file = os.path.join(cache_dir, 'localization_data_cache.csv')

if data_source == 1:
    file_to_process = cache_file
else:
    file_to_process = filepath_to_read

if read_data and data_source == 1:

    # Fetch file
    data_raw = urllib2.urlopen(total_station_file)

    with open(cache_file, 'w') as f:
        f.write(data_raw.read())

# Read the data from the cached file.
measured_pts = []
if os.path.exists(file_to_process):
    with open(file_to_process, 'r') as fp:
        reader = csv.DictReader(fp, dialect="excel", delimiter=";")

        for pt_data in reader:
            xyz = [pt_data.pop("X"), pt_data.pop("Y"), pt_data.pop("Z")]

            # check if our three values are convertable to float
            try:
                xyz = [float(c) for c in xyz]
            except ValueError:
                continue

            xyz = [c * 1000 for c in xyz]

            pt_name = pt_data.pop("NAME")

            measured_pts.append(MeasurementPt(pt_name, xyz, attrs=pt_data))

# raise if no points found
if len(measured_pts) == 0:
    raise Exception("No pts found")

measured_pts.sort(key=lambda pt: (pt.prefix, pt.idx))

if not select_all:
    measured_pts = [pt for pt in measured_pts if pt.prefix in prefixes]

pts = [pt.as_rgpoint() for pt in measured_pts]
ids = [pt.pt_name for pt in measured_pts]
# ---------- end import_ts_cartesian_coordinates ----------

panel_4 = Panel(import_ts_cartesian_coordinates.ids)

# ---- group: Docker
# Container status
list = ValueList({"Virtual": "virtual", "Real": "real"}, selected="Virtual")
python = GhPythonScript(run=Button())  # -> out, status; inputs run: Boolean
# ---------- python: Python ----------
from scriptcontext import sticky

from subprocess import Popen
from subprocess import PIPE, STDOUT

cmd = ["docker", "ps", "--format", "\"{{.Names}}: {{.Status}}\""]

sticky["docker_ps_run"] = False

if run:
    sticky["docker_ps_run"] = True

if sticky["docker_ps_run"]:
    proc = Popen(cmd, stdout=PIPE, stderr=STDOUT, universal_newlines= True)
    sticky["docker_status"], _ = proc.communicate()
    sticky["docker_ps_run"] = False

if "docker_status" in sticky.keys():
    status  = sticky["docker_status"]
# ---------- end python ----------
python_2 = GhPythonScript(target=list, start=Button(), restart_driver=Button(), stop=Button())  # -> out
# ---------- python_2: Python ----------
from rapid_clay_formations_fab.docker import compose_up
from rapid_clay_formations_fab.docker import compose_down
from rapid_clay_formations_fab.docker import restart_container

from rapid_clay_formations_fab.abb import ROBOT_IPS
from rapid_clay_formations_fab.abb import DOCKER_COMPOSE_PATHS
from rapid_clay_formations_fab.abb import DRIVER_CONTAINER_NAME

if target is None:
    target = "virtual"

ip = {"ROBOT_IP": ROBOT_IPS[target]}

compose_path = DOCKER_COMPOSE_PATHS["driver"]

if start:
    compose_up(compose_path, env_vars=ip)

if restart_driver:
    compose_up(compose_path, env_vars=ip)
    restart_container(DRIVER_CONTAINER_NAME)

if stop:
    compose_down(compose_path)
# ---------- end python_2 ----------
# MPT10-12
panel_5 = Panel(python.status)

# ----
bang = Button()
unload = PythonScript(bang=bang, module="rapid_clay_formations_fab")
# ---------- unload: Python ----------
import sys

def unload_modules(top_level_module_name):
    """Unloads all modules named starting with the specified string.

    This function eases the development workflow when editing a library that is
    used from Rhino/Grasshopper.

    Args:
        top_level_module_name (:obj:`str`): Name of the top-level module to unload.

    Returns:
        list: List of unloaded module names.
    """
    modules = filter(lambda m: m.startswith(top_level_module_name), sys.modules)

    for module in modules:
        sys.modules.pop(module)

    return modules

unload_modules(module)
# ---------- end unload ----------
item = ListItem(List=import_ts_cartesian_coordinates.pts, Index=0, Wrap=True)  # -> Item3, Item2, Item1, Item
merge = Merge(Data1=item.Item3, Data2=item.Item2, Data3=item.Item1)
pt = Point(merge)

# ----
# Arbitrary Points
toggle = BooleanToggle(False)
calculate_transformation = PythonScript(create_plot_files=toggle, maxiter=Slider(200, range=0..500), run=Button())  # -> out, transformation, rhino_transform; inputs rcs_coords: list of Point3d, wcs_coords: list of Point3d, create_plot_files: Boolean, maxiter: Int32, run: Boolean
# ---------- calculate_transformation: Python ----------
from scriptcontext import sticky

from compas.geometry import Frame
from compas.rpc import Proxy

from rapid_clay_formations_fab.rhino import rgpoint_to_cgpoint
from rapid_clay_formations_fab.localization import worldxy_to_robot_base_xform
from rapid_clay_formations_fab.rhino import matrix_to_rgtransform

kwargs = {}

if create_plot_files is not None:
    kwargs["plot_results"] = create_plot_files
if maxiter is not None:
    kwargs["maxiter"] = maxiter

if not sticky.get("apl_result"):
    sticky["apl_result"] = None

if len(rcs_coords) == 0 or len(wcs_coords) == 0:
    raise Exception("No points supplied.")

rcs_coords = [rgpoint_to_cgpoint(pt) for pt in rcs_coords]
wcs_coords = [rgpoint_to_cgpoint(pt) for pt in wcs_coords]

if run:
    with Proxy("rapid_clay_formations_fab.localization", port=12457) as localization:
        try:
            result = localization.arbitrary_pts_localization(
                rcs_coords, wcs_coords, **kwargs
            )
            print(result)
            sticky["apl_result"] = Frame(*result)
        except:
            sticky["apl_result"] = None
            raise

print(sticky["apl_result"])

if sticky["apl_result"] is not None:
    transformation = worldxy_to_robot_base_xform(sticky["apl_result"])
    rg_transform = matrix_to_rgtransform(transformation)
# ---------- end calculate_transformation ----------
panel_6 = Panel(calculate_transformation.out)

axis_radius = Slider(1, range=0..10)
axis_length = Slider(10, range=0..100)
python_3 = GhPythonScript()  # -> out, frame
# ---------- python_3: Python ----------
from compas.geometry import Frame, Point, Vector

frame = Frame(Point(750, 750, 500), Vector(1, 0, 0), Vector(0, 1, 0))
# ---------- end python_3 ----------

# ----
# 3-Point Localization
panel_7 = Panel("t_A057_ClayTool02_Prism")
set_localization_position = Button()
move_to_first_position_origin = Button()
move_to_second_position_x_axis = Button()
move_to_third_position_y_axis = Button()
set_localization_position_2 = PythonScript(read_position=set_localization_position, tool=panel_7)  # -> out, localization_origin_plane, localization_origin_frame; inputs read_position: Boolean
# ---------- set_localization_position_2: Python ----------
from __future__ import absolute_import
from __future__ import division
from __future__ import print_function

from scriptcontext import sticky

from compas.geometry import Frame
from compas_fab.backends.ros import RosClient
from compas_rrc import AbbClient
from compas_rrc import GetFrame
from compas_rrc import SetAcceleration
from compas_rrc import SetMaxSpeed
from compas_rrc import SetTool
from compas_rrc import SetWorkObject

from rapid_clay_formations_fab.rhino import cgframe_to_rgplane

TIMEOUT = 5 # controller communicaton timeout

if not tool:
    tool = "tool0"
if not wobj:
    wobj = "wobj0"

if not sticky.get("localization_origin"):
    sticky["localization_origin"] = None

if read_position:
    # Create Ros Client
    with RosClient() as ros:
        # Create ABB Client
        abb = AbbClient(ros)
        abb.run(timeout=TIMEOUT)

        # Set prism TCP
        abb.send(SetTool(tool))

        # Unset any active WorkObject
        abb.send(SetWorkObject(wobj))

        # Get location of TCP
        tcp_frame = abb.send_and_wait(GetFrame(), timeout=TIMEOUT)

        sticky["localization_origin"] = tcp_frame

localization_origin_frame = sticky["localization_origin"]
if localization_origin_frame:
    localization_origin_plane = cgframe_to_rgplane(localization_origin_frame)
# ---------- end set_localization_position_2 ----------
distance = Slider(1000, range=100..1000)
localization_positions = PythonScript(
    localization_origin_frame=python_3.frame,
    move_to_origin=move_to_first_position_origin,
    move_to_x_pt=move_to_second_position_x_axis,
    move_to_y_pt=move_to_third_position_y_axis,
    distance=distance,
    tool=panel_7)  # -> out, o_pt, x_pt, y_pt
# ---------- localization_positions: Python ----------
from __future__ import absolute_import
from __future__ import division
from __future__ import print_function

from compas.geometry import Frame
from compas.geometry import Translation

from rapid_clay_formations_fab.abb import standalone_move_to_frame
from rapid_clay_formations_fab.rhino import cgframe_to_rgplane

if localization_origin_frame is None:
    raise Exception("No origin supplied.")

kwargs = {}

if tool:
    kwargs["tool"] = tool

# classmethod .from_vector needs to be used in compas >= 0.16
Tx = Translation([distance, 0, 0])
Ty = Translation([0, distance, 0])

o_frame = localization_origin_frame
x_frame = o_frame.transformed(Tx)
y_frame = o_frame.transformed(Ty)

o_pt = cgframe_to_rgplane(o_frame).Origin
x_pt = cgframe_to_rgplane(x_frame).Origin
y_pt = cgframe_to_rgplane(y_frame).Origin

# pick which point to send
if move_to_origin:
    frame = o_frame
    frame_name = "Origin"
elif move_to_x_pt:
    frame = x_frame
    frame_name = "X axis point"
elif move_to_y_pt:
    frame = y_frame
    frame_name = "Y axis point"
else:
    frame = None
    frame_name = None

if frame:
    standalone_move_to_frame(frame, **kwargs)
else:
    print("No motion command sent")
# ---------- end localization_positions ----------
merge_2 = Merge(Data1=localization_positions.o_pt, Data2=localization_positions.x_pt, Data3=localization_positions.y_pt)
panel_8 = Panel(localization_positions.out)
calculate_transformation_2 = PythonScript(rcs_coords=merge_2, wcs_coords=pt)  # -> out, transformation; inputs rcs_coords: list of Point3d, wcs_coords: list of Point3d
# ---------- calculate_transformation_2: Python ----------
from rapid_clay_formations_fab.localization import three_pts_localization
from rapid_clay_formations_fab.localization import worldxy_to_robot_base_xform
from rapid_clay_formations_fab.rhino import matrix_to_rgtransform
from rapid_clay_formations_fab.rhino import rgpoint_to_cgpoint
from compas.geometry import Transformation, Frame
from compas import PRECISION

PRECISION = "3f"
print(PRECISION)

if len(rcs_coords) == 0 or len(wcs_coords) == 0:
    raise Exception("No points supplied.")

rcs_coords = [rgpoint_to_cgpoint(pt) for pt in rcs_coords]
wcs_coords = [rgpoint_to_cgpoint(pt) for pt in wcs_coords]

print("Points in RCF")
print("Origin: {}".format(rcs_coords[0]))
print("X: {}".format(rcs_coords[1]))
print("Y: {}".format(rcs_coords[2]))
print("")

print("Points in WCF")
print("Origin: {}".format(wcs_coords[0]))
print("X: {}".format(wcs_coords[1]))
print("Y: {}".format(wcs_coords[2]))
print("")

wcs_robot_base = three_pts_localization(rcs_coords, wcs_coords)

print("RCS X vector in WCS: {}".format(wcs_robot_base.xaxis))
print("RCS Y vector in WCS: {}".format(wcs_robot_base.yaxis))
print("RCS Z vector in WCS: {}".format(wcs_robot_base.zaxis))
print("")

print("Robot base origin in WCS: {}".format(wcs_robot_base.point))

_transformation = worldxy_to_robot_base_xform(wcs_robot_base)

transformation = matrix_to_rgtransform(_transformation)

print(PRECISION)
# ---------- end calculate_transformation_2 ----------
matrix = TransformMatrix(calculate_transformation_2.transformation, Digits=3)

pln = Plane(set_localization_position_2.localization_origin_plane)
panel_9 = Panel(pln)
cluster = Cluster(planes=pln, axis_length=axis_length, axis_radius=axis_radius)  # -> geo, color
preview = CustomPreview(Geometry=cluster.geo, Material=cluster.color)
panel_10 = Panel(calculate_transformation_2.out)

# ---- group: ROS client
# ABB client
restart = Button()
connect = Button()
disconnect = Button()
ros = PythonScript(restart=restart)  # -> out, abb_client
# ---------- ros: Python ----------
import sys
import time
import logging
import scriptcontext as sc

from compas_fab.backends import RosClient

from compas_rrc import AbbClient

from System import TimeSpan
from System.Threading import ManualResetEventSlim

LOGGER = logging.getLogger('roslibpy')

key = 'rosclient_%s' % str(ghenv.Component.InstanceGuid)
previous_client = sc.sticky.get(key, None)
if previous_client:
    previous_client.terminate()


abb_client = AbbClient(RosClient('localhost', 9090))
sc.sticky[key] = abb_client

waitLock = ManualResetEventSlim(False)

abb_client.ros.on_ready(lambda: waitLock.Set())

if not waitLock.Wait(TimeSpan.FromSeconds(5)):
    raise Exception('Unable to connect to ROS')

LOGGER.info('ROS connection opened')
# ---------- end ros ----------
connect_2 = PythonScript(abb_client=ros.abb_client, connect=connect, disconnect=disconnect)  # -> out, abb_client
# ---------- connect_2: Python ----------
import logging
from System import TimeSpan
from System.Threading import ManualResetEventSlim

LOGGER = logging.getLogger('roslibpy')
ros_client = abb_client.ros
if connect:
    if not ros_client.is_connected:
        LOGGER.debug('Connecting...')
        waitLock = ManualResetEventSlim(False)
        ros_client.on_ready(lambda: waitLock.Set())
        ros_client.connect()

        if not waitLock.Wait(TimeSpan.FromSeconds(5)):
            raise Exception('Unable to connect to ROS')
        LOGGER.debug('Reconnected')

if disconnect:
    if ros_client.is_connected:
        ros_client.terminate()
        LOGGER.debug('Terminated')
# ---------- end connect_2 ----------

# ----
a1 = Slider(0, range=-360..360)
a4 = Slider(0, range=-360..360)
a5 = Slider(0, range=-360..360)
a6 = Slider(0, range=-360..360)
a2 = Slider(0, range=-360..360)
a3 = Slider(0, range=-360..360)
merge_3 = Merge(Data1=a1, Data2=a2, Data3=a3, Data4=a4, Data5=a5, Data6=a6)

# ----
# Robot control
panel_11 = Panel("t_A057_ClayTool02_Prism")
pflip = FlipPlane(Plane=PlaneXY(0, 0, 0), ReverseX=False, ReverseY=False, SwapAxes=True)
list_2 = ValueList({"MoveJ": True, "MoveL": False}, selected="MoveL")
# MPTA1
# RCS
# WCS
# MPTA2
# RCS
# WCS
# MPTA3
# RCS
# Robot location 1
# WCS
panel_12 = Panel(pflip)

# ----
# Move to plane
python_4 = GhPythonScript(client=connect_2.abb_client, planes=pflip, motion_type=list_2, tool_name=panel_11, run=Button())  # -> out; inputs planes: list of Plane, motion_type: Boolean, speed: Int32, run: Boolean
# ---------- python_4: Python ----------
from compas_rrc import MoveToFrame
from compas_rrc import SetAcceleration
from compas_rrc import SetMaxSpeed
from compas_rrc import SetTool
from compas_rrc import SetWorkObject
from compas_rrc import Zone
from compas_rrc import Motion

from rapid_clay_formations_fab.utils import ensure_frame

if tool_name is None:
    tool_name = "tool0"
if wobj_name is None:
    wobj_name = "wobj0"
if speed is None:
    speed = 100

if motion_type is None:
    motion = Motion.JOINT
elif motion_type:
    motion = Motion.JOINT
else:
    motion = Motion.LINEAR

if run:
    if not client.ros.is_connected:
        raise Exception("Not connected to ROS")

    client.send(SetTool(tool_name))
    client.send(SetWorkObject(wobj_name))
    client.send(SetAcceleration(100, 100))
    client.send(SetMaxSpeed(100, 150))

    for plane in planes:
        frame = ensure_frame(plane)
        client.send(MoveToFrame(frame,
                                 speed,
                                 Zone.FINE,
                                 motion))
# ---------- end python_4 ----------

# ----
# Get joint configuration and frame
python_5 = GhPythonScript(client=connect_2.abb_client, run=Button())  # -> out, plane, joint_values; inputs run: Boolean
# ---------- python_5: Python ----------
from ghpythonlib.treehelpers import list_to_tree
from scriptcontext import sticky

from compas_rrc import GetFrame
from compas_rrc import GetJoints
from compas_rrc import SetTool
from compas_rrc import SetWorkObject

from rapid_clay_formations_fab.rhino import cgframe_to_rgplane

TIMEOUT = 5
TIMEOUT_LONG = 30

if run:
    if not client.ros.is_connected:
        raise Exception("Not connected to ROS")

    client.send(SetWorkObject("wobj0"))
    client.send(SetTool("t_A057_ClayTool02_Prism"))
    sticky["frame"] = client.send_and_wait(GetFrame(), timeout=TIMEOUT)

    sticky["joint_values"], _ = client.send_and_wait(GetJoints(), timeout=TIMEOUT)

if "frame" in sticky.keys():
    plane = cgframe_to_rgplane(sticky["frame"])

if "joint_values" in sticky.keys():
    joint_values = list_to_tree(sticky["joint_values"])
# ---------- end python_5 ----------

# ----
# Move to joint configuration
python_6 = GhPythonScript(client=connect_2.abb_client, configuration=merge_3, run=Button())  # -> out; inputs configuration: list, run: Boolean
# ---------- python_6: Python ----------
from compas_rrc import SetAcceleration
from compas_rrc import SetMaxSpeed
from compas_rrc import MoveToJoints
from compas_rrc import Zone

from rapid_clay_formations_fab.utils import ensure_frame

TIMEOUT = 5
TIMEOUT_LONG = 30

if speed is None:
    speed = 100

if run:
    if not client.ros.is_connected:
        raise Exception("Not connected to ROS")

    client.send(SetAcceleration(100, 100))
    client.send(SetMaxSpeed(100, 150))

    client.send_and_wait(
                          MoveToJoints(configuration,
                                        [],
                                        speed,
                                        Zone.FINE,
                                        ),
                          timeout=TIMEOUT_LONG)
# ---------- end python_6 ----------

panel_13 = Panel(python_5.joint_values)
# inclination_length for 2, 4, 10, 15
# inclination_length for 30
pln_2 = Plane(python_5.plane)

# ==== cluster Cluster
planes = ClusterInput()
axis_length = ClusterInput()
axis_radius = ClusterInput()
deconstruct_plane = DeconstructPlane(Plane=graft(planes))  # -> Origin, XAxis, YAxis, ZAxis
amplitude = Amplitude(Vector=deconstruct_plane.XAxis, Amplitude=axis_length)
amplitude_2 = Amplitude(Vector=deconstruct_plane.YAxis, Amplitude=axis_length)
amplitude_3 = Amplitude(Vector=deconstruct_plane.ZAxis, Amplitude=axis_length)
move = Move(Geometry=deconstruct_plane.Origin, Motion=amplitude_2)  # -> Geometry, Transform
move_2 = Move(Geometry=deconstruct_plane.Origin, Motion=amplitude_3)  # -> Geometry, Transform
move_3 = Move(Geometry=deconstruct_plane.Origin, Motion=amplitude)  # -> Geometry, Transform
ln = Line(StartPoint=deconstruct_plane.Origin, EndPoint=move.Geometry)
ln_2 = Line(StartPoint=deconstruct_plane.Origin, EndPoint=move_3.Geometry)
ln_3 = Line(StartPoint=deconstruct_plane.Origin, EndPoint=move_2.Geometry)
pipe = Pipe(Curve=ln, Radius=axis_radius, Caps=0)
pipe_2 = Pipe(Curve=ln_2, Radius=axis_radius, Caps=0)
pipe_3 = Pipe(Curve=ln_3, Radius=axis_radius, Caps=0)
entwine = Entwine(
    Branch00=ColourSwatch(SwatchColor=RGB(255, 0, 0)),
    Branch01=ColourSwatch(SwatchColor=RGB(0, 255, 0)),
    Branch02=ColourSwatch(SwatchColor=RGB(0, 0, 255)),
    FlattenInputs=True)
entwine_2 = Entwine(Branch00=pipe_2, Branch01=pipe, Branch02=pipe_3, FlattenInputs=True)
geo = ClusterOutput(entwine_2)
color = ClusterOutput(entwine)
