# Grasshopper definition path_planning.gh (Grasshopper 1.0.7)

axis_radius = Slider(3, range=0..10)
axis_length = Slider(100, range=0..100)
# Hi! Welcome to this demo Grasshopper doc for COMPAS FAB!
# 
# 1. "Robot": Load the robot
# 2. "ROS Client": connect to ROS
# 3. "Current tool": select the tool (and set mesh accordingly) or select 'No tool'
# 4. "Scene": add any number of static collision meshes in the scene right here.
# 5. "Visualization": select what you are currently previewing
#       (the direct configuration selection, the IK solution, the cartesian path plan or the kinematic path plan)
# 6. "Cartesian path": select a curve or any list of planes as input, and click "Compute"
# 7. "Kinematic path": move the two spheres to define start and end, and click "Compute"
pt = Point(Point(0, 0, 354))
pl = ConstructPlane(Origin=pt, XAxis=Vector(1, 0, 0), YAxis=Vector(0, 1, 0))
deplane = DeconstructPlane(Plane=pl)  # -> Origin, XAxis, YAxis, ZAxis
amp = Amplitude(Vector=deplane.ZAxis, Amplitude=Slider(671, range=0..1000))
mesh = Mesh(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)
vdis = VectorDisplay(Anchor=deplane.Origin, Vector=amp)
pln = Plane(PlaneXY(0, 0, 354))

mesh_2 = Mesh(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)
create_tool = GhPythonScript(mesh=mesh_2, id="tip")  # -> tool
# ---------- create_tool: Python ----------
from compas.geometry import Frame
from compas_rhino.geometry import RhinoMesh
from compas_fab.robots import Tool

compas_mesh = RhinoMesh.from_geometry(mesh).to_compas()
tool = Tool(compas_mesh, Frame((0, 0, 0), (1, 0, 0), (0, 1, 0)), name=id)
# ---------- end create_tool ----------

cluster = Cluster(planes=pln, axis_length=axis_length, axis_radius=axis_radius)  # -> geo, color
brep = Brep(<brep referenced from the Rhino model>)
toggle = BooleanToggle(True)

# ---- group: Docker
# Container status
button = Button()
python = GhPythonScript(run=Button())  # -> out, status; inputs run: Boolean
# ---------- python: Python ----------
from scriptcontext import sticky

from subprocess import Popen
from subprocess import PIPE, STDOUT

cmd = ["docker", "ps", "--format", "\"{{.Names}}: {{.Status}}\""]

sticky["docker_ps_run"] = False

if run:
    sticky["docker_ps_run"] = True

if sticky["docker_ps_run"]:
    proc = Popen(cmd, stdout=PIPE, stderr=STDOUT, universal_newlines= True)
    sticky["docker_status"], _ = proc.communicate()
    sticky["docker_ps_run"] = False

if "docker_status" in sticky.keys():
    status  = sticky["docker_status"]
# ---------- end python ----------
python_2 = GhPythonScript(webgui=toggle, start=toggle, restart_driver=Button(), stop=Button())  # -> out; inputs webgui: Boolean
# ---------- python_2: Python ----------
from compas_rcf.docker import compose_up
from compas_rcf.docker import compose_down
from compas_rcf.docker import restart_container

from compas_rcf.abb import DOCKER_COMPOSE_PATHS

import compas_rcf
print(compas_rcf.__version__)
compose_path = DOCKER_COMPOSE_PATHS["planner"]

print(compose_path)

if start:
    compose_up(compose_path)

if restart_driver:
    pass

if stop:
    compose_down(compose_path)
# ---------- end python_2 ----------
panel = Panel(python.status)

# ----
bang = Button()
mesh_3 = Mesh(brep)
create_tool_2 = GhPythonScript(mesh=mesh, id="t_A057_ClayTool02", tcp=pln)  # -> tool; inputs tcp: Plane
# ---------- create_tool_2: Python ----------
from compas.geometry import Frame
from compas_rhino.geometry import RhinoMesh
from compas_fab.robots import Tool

from compas_rcf.utils import ensure_frame

compas_mesh = RhinoMesh.from_geometry(mesh).to_compas()
tool = Tool(compas_mesh, ensure_frame(tcp), name=id)
# ---------- end create_tool_2 ----------

# ----
# Current tool
list = ValueList({"No tool": 0, "Tool 1": 1, "t_A057_ClayTool02": 2, "Tool 3": 3}, selected="t_A057_ClayTool02")
filter = StreamFilter(Gate=list, Stream1=create_tool, Stream2=create_tool_2)

# ---- group: ROS client
connect = Button()
disconnect = Button()
ros = PythonScript(connect=connect, disconnect=disconnect, port="9091")  # -> out, ros_client; inputs port: Int32
# ---------- ros: Python ----------
import sys
import scriptcontext as sc
from compas_fab.backends import RosClient

key = 'rosclient_%s' % str(ghenv.Component.InstanceGuid)
previous_client = sc.sticky.get(key, None)

if not port:
    port = 9090

if previous_client and (connect or disconnect):
    previous_client.close()

if connect:
    ros_client = RosClient('localhost', port)
    sc.sticky[key] = ros_client
    ros_client.run(5)

ros_client = sc.sticky[key]
print('ROS connected: {}'.format(ros_client.is_connected if ros_client else 'False'))
# ---------- end ros ----------

# ----
unload = PythonScript(bang=bang, module="compas_rcf")
# ---------- unload: Python ----------
import sys

def unload_modules(top_level_module_name):
    """Unloads all modules named starting with the specified string.

    This function eases the development workflow when editing a library that is
    used from Rhino/Grasshopper.

    Args:
        top_level_module_name (:obj:`str`): Name of the top-level module to unload.

    Returns:
        list: List of unloaded module names.
    """
    modules = filter(lambda m: m.startswith(top_level_module_name), sys.modules)

    for module in modules:
        sys.modules.pop(module)

    return modules

unload_modules(module)
# ---------- end unload ----------
preview = CustomPreview(Geometry=cluster.geo, Material=cluster.color)
panel_2 = Panel(python_2)
panel_3 = Panel(ros.out)

# ----
# Cartesian path
number_slider = Slider(20, range=0..210)
curve_path = Curve(<curve referenced from the Rhino model>)
divide = DivideCurve(Curve=curve_path, Count=number_slider, Kinks=False)  # -> Points, Tangents, Parameters
X = UnitX(Factor=1)
Y = UnitY(Factor=Slider(-1, range=-2..-1))
pl_2 = ConstructPlane(Origin=divide.Points, XAxis=X, YAxis=Y)

pt_2 = Point()

# ----
# IK Target
goal_sphere = Surface(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)

srf = Surface(<surface referenced from the Rhino model>)

# ----
# Scene
mesh_4 = Mesh(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)
list_2 = ValueList({"No meshes": 0, "Use meshes": 1}, selected="Use meshes")

mjoin = MeshJoin(Meshes=[mesh_4, mesh_3])

create_tool_3 = GhPythonScript(mesh=mjoin, id="table")  # -> cmesh
# ---------- create_tool_3: Python ----------
from compas_rhino.geometry import RhinoMesh
from compas_fab.robots import CollisionMesh

compas_mesh = RhinoMesh.from_geometry(mesh).to_compas()
cmesh = CollisionMesh(compas_mesh, id)
# ---------- end create_tool_3 ----------
collision_meshes = Data(create_tool_3)
filter_2 = StreamFilter(Gate=list_2, Stream1=collision_meshes)

load = Button()
units = ValueList({"m": 1, "cm": 100, "mm": 1000}, selected="mm")
create = PythonScript(scale_factor=units, load=load, tool=filter, collision_meshes=filter_2)  # -> robot; inputs collision_meshes: list
# ---------- create: Python ----------
import os
import copy
from scriptcontext import sticky as st


import compas
from compas.geometry import Scale
from compas_fab.backends import RosClient
from compas_fab.ghpython import RobotArtist
from compas_fab.robots import PlanningScene
from compas_fab.robots import Tool

compas.PRECISION = '12f'

# store robot in component
guid = str(ghenv.Component.InstanceGuid)
robot_key = "robot_" + guid

if robot_key not in st:
    st[robot_key] = None

if load:
    with RosClient() as ros:
        robot = ros.load_robot(load_geometry=True)
        robot.artist = RobotArtist(robot.model)

        robot.scale(scale_factor)
        st[robot_key] = robot

robot = st[robot_key]

if robot:
    if tool:
        # Scale to meters to match ROS
        if scale_factor != 1:
            S = Scale([1. / scale_factor] * 3)
            tool = Tool.from_data(tool.data)
            tool.visual.transform(S)
            tool.collision.transform(S)

        touch_links = [l.name for l in robot.model.iter_link_chain()][-2:]
        robot.attach_tool(tool, touch_links=touch_links)
        
        # If a client is connected, we need to update the planning scene accordingly
        if robot.client:
            scene = PlanningScene(robot)
            scene.add_attached_tool()
    else:
        if robot.attached_tool:
            id = robot.attached_tool.name

            # If a client is connected, we need to update the planning scene accordingly
            if robot.client:
                scene.remove_attached_tool()
                scene.remove_collision_mesh(id)

            robot.detach_tool()

if robot.client:
    scene = PlanningScene(robot)

    cm_key = "cm_" + guid
    cm_ids = st.get(cm_key)

    if cm_ids:
        removed_cm_ids = set(cm_ids) - set([cm.id for cm in collision_meshes])
        if removed_cm_ids:
            for id in cm_ids:
                scene.remove_collision_mesh(id)
            
            print('Removing old CMs')
            print('Remove: ' + str(cm_ids))
            st[cm_key] = [id for id in cm_ids if id not in removed_cm_ids]

    if collision_meshes:
        print('Adding new CMs')
        st[cm_key] = []
        for cm in collision_meshes:
            cm = copy.deepcopy(cm)
            scene.add_collision_mesh(cm, scale=scale_factor != 1)
            st[cm_key].append(cm.id)
# ---------- end create ----------
robot = Data(create)

# ----
# Robot
set = PythonScript(robot=robot, client=ros.ros_client)
# ---------- set: Python ----------
if robot and client:
    robot.client = client
# ---------- end set ----------

# ----
# Info
info = PythonScript(robot=robot)  # -> out, main_group_name
# ---------- info: Python ----------
if robot:
    robot.info()
    main_group_name = robot.main_group_name
# ---------- end info ----------
panel_4 = Panel(info.out)

# ----
# Kinematic path
tolerance = Slider(1, range=1..360)
start_sphere = Surface(<surface referenced from the Rhino model>)
goal_sphere_2 = Surface(<surface referenced from the Rhino model>)

volume = Volume(Geometry=[start_sphere, goal_sphere_2])  # -> Volume, Centroid
pline = PolyLine(Vertices=volume.Centroid, Closed=False)

# ---- group: plan motion
# Plan motion
list_3 = ValueList({"don't use attached collision mesh": 0, "use attached collision mesh": 1}, selected="use attached collision mesh")
list_4 = ValueList({"RRT", "RRT*": "RRTStar", "EST", "PRM": "RPM", "PRM*": "RPMStar", "SPARS"}, selected="RRT")
filter_3 = StreamFilter(Gate=list_3)
panel_5 = Panel("positions")
panel_6 = Panel("velocities")
panel_7 = Panel("accelerations")

# ----
# Configuration
compute = Button()
main_planning_group = Text(info.main_group_name)

python_3 = PythonScript(robot=robot, group=main_planning_group, start=start_sphere, goal=goal_sphere_2, tolerance_joints_deg=tolerance)  # -> start_configuration, goal_constraints, goal_configuration
# ---------- python_3: Python ----------
import math

import rhinoscriptsyntax as rs
import Rhino.Geometry as rg

from compas.geometry import Frame

if start and not rs.IsSphere(start):
    raise Exception('Start marker should be a sphere')

if goal and not rs.IsSphere(goal):
    raise Exception('Goal marker should be a sphere')

start_plane, _r = rs.SurfaceSphere(start)
goal_plane, _r = rs.SurfaceSphere(goal)

start_frame = Frame(start_plane.Origin, start_plane.XAxis, start_plane.YAxis)
goal_frame = Frame(goal_plane.Origin, goal_plane.XAxis, goal_plane.YAxis)

if robot.attached_tool:
    start_frame, goal_frame = robot.from_attached_tool_to_tool0([start_frame, goal_frame])

if robot:
    start_configuration = robot.inverse_kinematics(start_frame, group=group)
    print('Found start configuration for start marker')
    goal_configuration = robot.inverse_kinematics(goal_frame, group=group) # TODO: Add tolerances here
    print('Found goal configuration for goal marker')

    tolerances_above = [math.radians(tolerance_joints_deg)] * 6
    tolerances_below = [math.radians(tolerance_joints_deg)] * 6
    goal_constraints = robot.constraints_from_configuration(goal_configuration, tolerances_above, tolerances_below, group=group)
# ---------- end python_3 ----------

# ---- group: inverse kinematics
# IK
py = PythonScript(robot=robot)  # -> configuration
# ---------- py: Python ----------
from compas_fab.robots import Configuration

if robot:
    configuration = robot.zero_configuration()
    print configuration
# ---------- end py ----------
inverse_kinematics = PythonScript(robot=robot, group=main_planning_group, start_configuration=py, goal=srf)  # -> out, configuration
# ---------- inverse_kinematics: Python ----------
import rhinoscriptsyntax as rs 
import scriptcontext as sc
import logging

from compas.geometry import Frame

from compas_fab.backends.ros import RosError
from compas_fab.robots import Configuration

LOGGER = logging.getLogger('roslibpy')

guid = str(ghenv.Component.InstanceGuid)
response_key = "response_" + guid

if response_key not in sc.sticky:
    sc.sticky[response_key] = None

if goal and not rs.IsSphere(goal):
    raise Exception('Goal marker should be a sphere')

if robot:
    if robot.client:
        if robot.client.is_connected:
            goal_plane, _r = rs.SurfaceSphere(goal)
            goal_frame = Frame(goal_plane.Origin, goal_plane.XAxis, goal_plane.YAxis)

            response = robot.inverse_kinematics(goal_frame, start_configuration, group)
            sc.sticky[response_key] = response
        else:
            print("Robot is not connected")

if sc.sticky[response_key]:
    response = sc.sticky[response_key]
    configuration = response
# ---------- end inverse_kinematics ----------

# ---- group: cartesian motion
# Plan cartesian motion
number_slider_2 = Slider(10, range=0..100)
avoid_collisions = BooleanToggle(True)
list_5 = ValueList({"don't use attached collision mesh": 0, "use attached collision mesh": 1}, selected="use attached collision mesh")
compute_2 = Button()
filter_4 = StreamFilter(Gate=list_5)
plan_cartesian_motion = PythonScript(
    robot=robot,
    group=main_planning_group,
    planes=pl_2,
    max_step=number_slider_2,
    avoid_collisions=avoid_collisions,
    compute=compute_2,
    acm=filter_4)  # -> out, response; inputs planes: list, avoid_collisions: Boolean, acm: list
# ---------- plan_cartesian_motion: Python ----------
import logging
import scriptcontext as sc

from compas.geometry import Frame

guid = str(ghenv.Component.InstanceGuid)
response_key = "response_" + guid
if response_key not in sc.sticky:
    sc.sticky[response_key] = None

print('Planning with group={}, joints={}'.format(group, ', '.join(robot.get_configurable_joint_names(group))))

if robot:
    if robot.client:
        if robot.client.is_connected:
            frames = [Frame(plane.Origin, plane.XAxis, plane.YAxis) for plane in planes]
            start_configuration = robot.inverse_kinematics(frames[0], group=group)

            if start_configuration and compute:
                response = robot.plan_cartesian_motion(frames, start_configuration=start_configuration,
                                             max_step=float(max_step),
                                             avoid_collisions=bool(avoid_collisions),
                                             group=group,
                                             attached_collision_meshes=list(acm))
                print(response.fraction)
                sc.sticky[response_key] = response
        else:
            print("Robot is not connected")
            sc.sticky[response_key] = None

response = sc.sticky[response_key]
# ---------- end plan_cartesian_motion ----------
py_2 = PythonScript(response=plan_cartesian_motion.response)  # -> start_configuration, configurations, fraction, time
# ---------- py_2: Python ----------
from compas_fab.backends.ros import MoveItErrorCodes

joint_positions = []

if response:
    #if response.error_code == MoveItErrorCodes.SUCCESS:
    configurations = response.points
    start_configuration = response.start_configuration
    fraction = response.fraction
    time = response.time_from_start
# ---------- end py_2 ----------
vis = PythonScript(response=plan_cartesian_motion.response)  # -> P, V, A
# ---------- vis: Python ----------
from compas_ghpython import list_to_ghtree

if response:

    positions = []
    velocities = []
    accelerations = []

    for p in response.points:
        positions.append(p.positions)
        velocities.append(p.velocities)
        accelerations.append(p.accelerations)

    P = list_to_ghtree(list(zip(*positions)))
    V = list_to_ghtree(list(zip(*velocities)))
    A = list_to_ghtree(list(zip(*accelerations)))
# ---------- end vis ----------
time_s = Panel(py_2.time)
fraction = Panel(py_2.fraction)
prismatic = QuickGraph(vis.P, SortOrder=0)
graph = QuickGraph(vis.V, SortOrder=0)
graph_2 = QuickGraph(vis.A, SortOrder=0)
animate = PythonScript(
    robot=robot,
    group=main_planning_group,
    start_configuration=py_2.start_configuration,
    configurations=py_2.configurations,
    value=Slider(1, range=0..1))  # -> configuration; inputs configurations: list
# ---------- animate: Python ----------
from compas_fab.utilities import map_range
from compas_fab.robots import Configuration

count = len(configurations)
if count and robot and configurations != [None]:
    idx = int(map_range(value, 0, 1, 0, count - 1))
    current_configuration = configurations[idx]
    #make full configuration
    configuration = current_configuration
    #configuration = robot.merge_group_with_full_configuration(current_configuration, start_configuration, group)
# ---------- end animate ----------

# ---- group: forward kinematics
a1 = Slider(0, range=-360..360)
a4 = Slider(0, range=-360..360)
a5 = Slider(0, range=-360..360)
a6 = Slider(0, range=-360..360)
a2 = Slider(0, range=-360..360)
a3 = Slider(0, range=-360..360)
forward_kinematics = PythonScript(robot=robot, group=main_planning_group, a1=a1, a2=a2, a3=a3, a4=a4, a5=a5, a6=a6)  # -> configuration
# ---------- forward_kinematics: Python ----------
import math
import Grasshopper
from compas_fab.robots import Configuration

if robot:
    joint_positions = [a1, a2, a3, a4, a5, a6]
    joint_positions = [math.radians(a) for a in joint_positions]
    types = robot.get_configurable_joint_types(group)
    configuration = Configuration(joint_positions, types)
    print configuration
# ---------- end forward_kinematics ----------

# ----
plan_motion = PythonScript(
    robot=robot,
    group=main_planning_group,
    start_configuration=python_3.start_configuration,
    goal_constraints=python_3.goal_constraints,
    planner_id=list_4,
    compute=compute,
    acm=filter_3)  # -> out, trajectory; inputs goal_constraints: list, path_constraints: list, acm: list
# ---------- plan_motion: Python ----------
import logging
from scriptcontext import sticky as st
import math
from compas.geometry import Frame
from compas_fab.robots import Configuration

from compas_ghpython.utilities import update_component

guid = str(ghenv.Component.InstanceGuid)
trajectory_key = "trajectory_" + guid
if trajectory_key not in st:
    st[trajectory_key] = None

data = dict(requesting_solution=False)

path_constraints = list(path_constraints)
if not len(path_constraints):
    path_constraints = None

if robot and robot.client and robot.client.is_connected and start_configuration and compute:
    st[trajectory_key] = robot.plan_motion(goal_constraints,
                                           start_configuration,
                                           group,
                                           planner_id=str(planner_id),
                                           path_constraints=path_constraints,
                                           attached_collision_meshes=list(acm))
#
trajectory = st[trajectory_key]
# ---------- end plan_motion ----------
animate_2 = PythonScript(
    robot=robot,
    start_configuration=python_3.start_configuration,
    trajectory=plan_motion.trajectory,
    goal_configuration=python_3.goal_configuration,
    value=Slider(1, range=0..1))  # -> configuration
# ---------- animate_2: Python ----------
from compas_fab.utilities import map_range
from compas_fab.robots import Configuration

full_result = []

if start_configuration:
    full_result.append(start_configuration)

if trajectory:
    full_result.extend([p for p in trajectory.points if p])

if goal_configuration:
    full_result.append(goal_configuration)

if len(full_result) and robot:
    idx = int(map_range(value, 0, 1, 0, len(full_result) - 1))
    configuration = full_result[idx]
# ---------- end animate_2 ----------

# ---- group: forward kinematics
fk = PythonScript(robot=robot, group=main_planning_group, configuration=inverse_kinematics.configuration)  # -> out, frame_WCF
# ---------- fk: Python ----------
import scriptcontext as sc
import logging
if robot:
    frame_WCF = robot.forward_kinematics(configuration, group, backend='model')

print frame_WCF
# ---------- end fk ----------
panel_11 = Panel(fk.out)

# ---- group: plan motion (continued)
vis_2 = PythonScript(trajectory=plan_motion.trajectory)  # -> P, V, A, time
# ---------- vis_2: Python ----------
from compas_ghpython import list_to_ghtree

if trajectory:

    positions = []
    velocities = []
    accelerations = []
    time_from_start = []

    for p in trajectory.points:
        positions.append(p.positions)
        velocities.append(p.velocities)
        accelerations.append(p.accelerations)
        time_from_start.append(p.time_from_start.seconds)

    P = list_to_ghtree(list(zip(*positions)))
    V = list_to_ghtree(list(zip(*velocities)))
    A = list_to_ghtree(list(zip(*accelerations)))

    time = time_from_start[-1]
    print time
# ---------- end vis_2 ----------
prismatic_2 = QuickGraph(vis_2.P, SortOrder=0)
time_s_2 = Panel(vis_2.time)
graph_3 = QuickGraph(vis_2.V, SortOrder=0)
graph_4 = QuickGraph(vis_2.A, SortOrder=0)

# ----
# Visualization
# Select configuration input: from fk, ik, path
list_6 = ValueList({"0 forward_kinematics": 0, "1 inverse_kinematics": 1, "2 cartesian path": 2, "3 kinetic path": 3}, selected="3 kinetic path")
filter_5 = StreamFilter(Gate=list_6, Stream0=forward_kinematics, Stream1=inverse_kinematics.configuration, Stream2=animate, Stream3=animate_2)
show_end_effector_frame = BooleanToggle(False)
show_base_frame = BooleanToggle(False)
show_collision = BooleanToggle(False)
show_frames = BooleanToggle(True)
show_visual = BooleanToggle(True)
visualize = PythonScript(
    robot=robot,
    group=main_planning_group,
    configuration=filter_5,
    show_visual=show_visual,
    show_collision=show_collision,
    show_frames=show_frames,
    show_base_frame=show_base_frame,
    show_end_effector_frame=show_end_effector_frame)  # -> out, visual, collision, frames, ee_frame, base_frame
# ---------- visualize: Python ----------
"""Calculates a cartesian motion path (linear in tool space).
    Inputs:
        robot: The robot
        group: str
            The planning group used for visualisation
        full_configuration: :class:`compas_fab.robots.Configuration`
            The robot's full configuration to display.
        show_visual: bool
           Whether or not to show the robot's visual meshes.
        show_collision: bool
           Whether or not to show the robot's collision meshes.
        show_frames: bool
           Whether or not to show the robot's joint frames.
        show_base_frame: bool
           Whether or not to show the robot's base frame.
        show_end_effector_frame: bool
            Whether or not to show the robot's end-effector frame.
    Output:
        visual: The robot's visual meshes.
        collision: The robot's collision meshes.
        frames: The robot's joint frames.
        base_frame_WCF: The robot's base frame.
        ee_frame_WCF: The robot's end-effector frame.
"""
from __future__ import print_function

import copy

import Rhino.Geometry as rg
from compas.geometry import Scale
from compas_ghpython import draw_frame

if robot and configuration:
    robot.update(configuration, visual=show_visual, collision=show_collision)

    if show_visual:
        visual = list(robot.draw_visual())
        has_tool_attached = visual and robot.attached_tool
        needs_ee_scaling = robot.scale_factor != 1 and has_tool_attached
        if needs_ee_scaling and visual[-1] == robot.attached_tool.native_geometry[0]:
            ee_frame = robot.get_end_effector_frame(group, configuration)
            pln = rg.Plane(rg.Point3d(*list(ee_frame.point)), rg.Vector3d(*list(ee_frame.normal)))
            visual.append(pln)
            T = rg.Transform.Scale(pln, robot.scale_factor, robot.scale_factor, robot.scale_factor)
            ee_mesh = copy.copy(robot.attached_tool.native_geometry[0])
            ee_mesh.Transform(T)
            visual[-1] = ee_mesh

    if show_collision:
        collision = robot.draw_collision()

    if show_frames:
        axes = robot.transformed_axes(configuration)
        frames = robot.transformed_frames(configuration)
        frames = [draw_frame(frame) for frame in frames]

    if show_base_frame:
        base_frame = draw_frame(robot.get_base_frame(group, configuration))

    if show_end_effector_frame:
        ee_frame = draw_frame(robot.get_end_effector_frame(group, configuration))
        print("End-effector", ee_frame)
# ---------- end visualize ----------
geo = Geometry(visualize.visual)
geo_2 = Geometry(visualize.collision)
preview_2 = CustomPreview(Geometry=geo, Shader=ColourSwatch(SwatchColor=RGB(194, 194, 194)))

geo_3 = Geometry(visualize.frames)
geo_4 = Geometry(visualize.ee_frame)
geo_5 = Geometry(visualize.base_frame)

# ==== cluster Cluster
planes = ClusterInput()
axis_length = ClusterInput()
axis_radius = ClusterInput()
deconstruct_plane = DeconstructPlane(Plane=graft(planes))  # -> Origin, XAxis, YAxis, ZAxis
amplitude = Amplitude(Vector=deconstruct_plane.XAxis, Amplitude=axis_length)
amplitude_2 = Amplitude(Vector=deconstruct_plane.YAxis, Amplitude=axis_length)
amplitude_3 = Amplitude(Vector=deconstruct_plane.ZAxis, Amplitude=axis_length)
move = Move(Geometry=deconstruct_plane.Origin, Motion=amplitude_2)  # -> Geometry, Transform
move_2 = Move(Geometry=deconstruct_plane.Origin, Motion=amplitude_3)  # -> Geometry, Transform
move_3 = Move(Geometry=deconstruct_plane.Origin, Motion=amplitude)  # -> Geometry, Transform
ln = Line(StartPoint=deconstruct_plane.Origin, EndPoint=move.Geometry)
ln_2 = Line(StartPoint=deconstruct_plane.Origin, EndPoint=move_3.Geometry)
ln_3 = Line(StartPoint=deconstruct_plane.Origin, EndPoint=move_2.Geometry)
pipe = Pipe(Curve=ln, Radius=axis_radius, Caps=0)
pipe_2 = Pipe(Curve=ln_2, Radius=axis_radius, Caps=0)
pipe_3 = Pipe(Curve=ln_3, Radius=axis_radius, Caps=0)
entwine = Entwine(
    Branch00=ColourSwatch(SwatchColor=RGB(255, 0, 0)),
    Branch01=ColourSwatch(SwatchColor=RGB(0, 255, 0)),
    Branch02=ColourSwatch(SwatchColor=RGB(0, 0, 255)),
    FlattenInputs=True)
entwine_2 = Entwine(Branch00=pipe_2, Branch01=pipe, Branch02=pipe_3, FlattenInputs=True)
geo = ClusterOutput(entwine_2)
color = ClusterOutput(entwine)
