# Grasshopper definition path_planning.ghx (Grasshopper 1.0.7)
# plug-ins: Telepathy

# ---- group: IF legs
crv = Curve(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)
crv_2 = Curve(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)
neg = Negative(Value=Slider(135, range=0..200))
cluster = Cluster_3(G=crv_2, F=Slider(1000, range=0..1000), A=Slider(135, range=0..180))
cluster_2 = Cluster_3(G=crv, F=Slider(1000, range=0..1000), A=neg)
smesh = SimpleMesh(Brep=cluster_2)
smesh_2 = SimpleMesh(Brep=cluster)
mjoin = MeshJoin(Meshes=[smesh_2, smesh])

# ----
pt = Point(Point(0, 0, 0))

# ----
# Modify position robot relative clay cylinders
number_slider = Slider(0, range=-180..180)
pt_2 = Point(pt)
pt_3 = Point(Point(-900.7110671, -1125.099205, -793.7033848))
rotate = Rotate(Angle=degrees(number_slider), Plane=pt_2)  # -> Geometry, Transform
move = Move(Motion=pt_2)  # -> Geometry, Transform

# ---- group: Cylinder for tool
pln = Plane(PlaneXY(-0.7294158936, 0.5374908447, 354.0322266))
cylinder_radius = Slider(60, range=0..100)
polygon_sides = Slider(10, range=0..10)
height_cylinder = Slider(200, range=0..1000)
polygon = Polygon(Plane=pln, Radius=cylinder_radius, Segments=polygon_sides, FilletRadius=0)  # -> Polygon, Length
Z = UnitZ(Factor=height_cylinder)
extr = Extrude(Base=polygon.Polygon, Direction=Z)
cap = CapHoles(Brep=extr)
smesh_3 = SimpleMesh(Brep=cap)

# ----
comp = Compound(Transforms=flatten([move.Transform, rotate.Transform]))
dam = DataDam(DataA=mjoin, BufferDelay=10000000, BufferMode=0)
number_slider_2 = Slider(0.001, range=0..0.001)
scale = Scale(Geometry=smesh_3, Center=Point(0, 0, 0), Factor=number_slider_2)  # -> Geometry, Transform

# ---- group: t_A057_ClayTool02_coll_mesh
mesh = Mesh(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)

# ----
relay = Relay()
scale_2 = Scale(Geometry=mesh, Center=Point(0, 0, 0), Factor=number_slider_2)  # -> Geometry, Transform
python = GhPythonScript(mesh=scale_2.Geometry)  # -> out, cmesh
# ---------- python: Python ----------
from compas_rhino.geometry import RhinoMesh

cmesh = RhinoMesh.from_geometry(mesh).to_compas()
# ---------- end python ----------
mjoin_2 = MeshJoin()
srf = Surface(<surface referenced from the Rhino model>)
mesh_2 = Mesh(srf)
mesh_3 = Mesh(mesh_2)
create_tool = GhPythonScript(mesh=mesh_3, id="floor")  # -> cmesh
# ---------- create_tool: Python ----------
from compas_rhino.geometry import RhinoMesh
from compas_fab.robots import CollisionMesh

compas_mesh = RhinoMesh.from_geometry(mesh).to_compas()
cmesh = CollisionMesh(compas_mesh, id)
# ---------- end create_tool ----------

# ---- group: Docker
# Container status
button = Button()
python_2 = GhPythonScript(run=Button())  # -> out, status; inputs run: Boolean
# ---------- python_2: Python ----------
from scriptcontext import sticky

from subprocess import Popen
from subprocess import PIPE, STDOUT

cmd = ["docker", "ps", "--format", "\"{{.Names}}: {{.Status}}\""]

sticky["docker_ps_run"] = False

if run:
    sticky["docker_ps_run"] = True

if sticky["docker_ps_run"]:
    proc = Popen(cmd, stdout=PIPE, stderr=STDOUT, universal_newlines= True)
    sticky["docker_status"], _ = proc.communicate()
    sticky["docker_ps_run"] = False

if "docker_status" in sticky.keys():
    status  = sticky["docker_status"]
# ---------- end python_2 ----------
python_3 = GhPythonScript(webgui=Toggle(True), start=button, restart_driver=Button(), stop=Button())  # -> out; inputs webgui: Boolean
# ---------- python_3: Python ----------
from rapid_clay_formations_fab.docker import compose_up
from rapid_clay_formations_fab.docker import compose_down
from rapid_clay_formations_fab.docker import restart_container

from rapid_clay_formations_fab.abb import DOCKER_COMPOSE_PATHS

import rapid_clay_formations_fab
print(rapid_clay_formations_fab.__version__)
compose_path = DOCKER_COMPOSE_PATHS["planner"]

print(compose_path)

if start:
    compose_up(compose_path)

if restart_driver:
    pass

if stop:
    compose_down(compose_path)
# ---------- end python_3 ----------
panel = Panel(python_2.status)

# ----
bang = Button()

# ----
# Path planning pipeline
clear_all_planned_paths = Button()
python_4 = GhPythonScript(clear_planned_paths=clear_all_planned_paths)  # -> out; inputs clear_planned_paths: Boolean
# ---------- python_4: Python ----------
from scriptcontext import sticky

doc = ghenv.Component.OnPingDocument()

if clear_planned_paths:
    for key in sticky.keys():
        print(key)
        if key.startswith("ppl_pipeline"):
            print(sticky[key])
            sticky[key] = None
    for guid in sticky["ppl_components"]:
        comp = doc.FindComponent(guid)
        comp.ExpireSolution(True)
# ---------- end python_4 ----------

scale_factor_just_placed_cylinders = Slider(1.1, range=0..10)
constraint_tolerance_joints = Slider(1, range=0..10)
constraint_tolerance_joint6 = Slider(45, range=0..100)
scale_factor_for_collision_meshes_repres = Slider(1.1, range=0..10)  # "Scale factor for collision meshes representing previously placed cylinders"
scale_factor_just_placed_cylinders_2 = RemoteSender(scale_factor_just_placed_cylinders)
constraint_tolerance_joints1_5 = RemoteSender(constraint_tolerance_joints)
constraint_tolerance_joint6_2 = RemoteSender(constraint_tolerance_joint6)
prev_cylinders_scale_factor = RemoteSender(scale_factor_for_collision_meshes_repres)

unload = PythonScript(bang=bang, module="rapid_clay_formations_fab")
# ---------- unload: Python ----------
import sys

def unload_modules(top_level_module_name):
    """Unloads all modules named starting with the specified string.

    This function eases the development workflow when editing a library that is
    used from Rhino/Grasshopper.

    Args:
        top_level_module_name (:obj:`str`): Name of the top-level module to unload.

    Returns:
        list: List of unloaded module names.
    """
    modules = filter(lambda m: m.startswith(top_level_module_name), sys.modules)

    for module in modules:
        sys.modules.pop(module)

    return modules

unload_modules(module)
# ---------- end unload ----------
panel_2 = Panel(python_3)
scale_factor_just_placed_cylinders_3 = RemoteReceiver(scale_factor_just_placed_cylinders_2)
toggle = BooleanToggle(True)
number_slider_3 = Slider(15, range=0..100)

# ---- group: Read JSON
# Edit fab_data
number_slider_4 = Slider(150, range=0..400)

# ----
# Reorient all planes
number_slider_5 = Slider(0, range=-180..180)

# ----
# Cable holder
number_slider_6 = Slider(0.001, range=0..0.001)
pln_2 = Plane(PlaneXY(175, 0, 1590))
mesh_4 = Mesh(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)
scale_3 = Scale(Geometry=pln_2, Center=Point(0, 0, 0), Factor=number_slider_6)  # -> Geometry, Transform
orient = Orient(Geometry=mesh_4, Source=pln_2, Target=PlaneXY(0, 0, 0))  # -> Geometry, Transform
scale_4 = Scale(Geometry=orient.Geometry, Center=Point(0, 0, 0), Factor=number_slider_6)  # -> Geometry, Transform

# ---- group: Previously placed cylinders as collision meshes
prev_cylinders_scale_factor_2 = RemoteReceiver(prev_cylinders_scale_factor)
merge = Merge()  # -> flatten(Result)

# ---- group: Edit planes individually
# Reorient plane by idx
number_slider_7 = Slider(0, range=-180..180)

# ----
# Tool setup
pln_3 = Plane(PlaneXY(0, 0, 354))
mjoin_3 = MeshJoin(Meshes=flatten([scale_2.Geometry, scale.Geometry]))
axis_radius = Slider(3, range=0..10)
axis_length = Slider(100, range=0..100)
panel_3 = Panel("t_A057_ClayTool02_wo_cylinder")
cluster_3 = Cluster(planes=pln_3, axis_length=axis_length, axis_radius=axis_radius)  # -> geo, color
create_tool_2 = GhPythonScript(viz_mesh=python.cmesh, coll_mesh=python.cmesh, id="t_A057_ClayTool02", tcp=pln_3)  # -> tool; inputs tcp: Plane
# ---------- create_tool_2: Python ----------
from compas_fab.robots import Tool

from rapid_clay_formations_fab.utils import ensure_frame

tool = Tool(viz_mesh, ensure_frame(tcp), name=id, collision=coll_mesh)
# ---------- end create_tool_2 ----------
tool_wo_cylinder = RemoteSender(create_tool_2)
preview = CustomPreview(Geometry=cluster_3.geo, Material=cluster_3.color)

python_5 = GhPythonScript(mesh=mjoin_3)  # -> out, cmesh; same code as python

# ----
# Adapted from script by Gonzalo Casas at Gramazio Kohler Research.
create_tool_3 = GhPythonScript(viz_mesh=python_5.cmesh, coll_mesh=python_5.cmesh, id="t_A057_ClayTool02", tcp=pln_3)  # -> tool; inputs tcp: Plane; same code as create_tool_2
tool_w_cylinder = RemoteSender(create_tool_3)

# ----
# Preview planes (Z should b down)
number_slider_8 = Slider(15, range=0..100)

# ----
# Scene
mesh_5 = Mesh(dam)
mesh_6 = Mesh(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)
mesh_7 = Mesh(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)
create_tool_4 = GhPythonScript(mesh=mesh_5, id="IF-legs")  # -> cmesh; same code as create_tool
create_tool_5 = GhPythonScript(mesh=mesh_6, id="IFbase-pick-station")  # -> cmesh; same code as create_tool
create_tool_6 = GhPythonScript(mesh=mesh_7, id="pick_cylinders")  # -> cmesh; same code as create_tool

# ----
# Segment_egress_to_place_egress
list = ValueList({"RRT", "RRTConnect", "RRT*": "RRTstar", "EST", "PRM": "RPM", "PRM*": "RPMStar", "SPARS"}, selected="RRT*")
plan_segment_egress_to_place_egress = Button()
allowed_planning_time_per_trajectory = Slider(1, range=0..2)
planning_attempts_per_trajectory = Slider(4, range=0..10)
planner_segment_egress_to_place_egress = RemoteSender(list)
allowed_planning_time_per_traj = RemoteSender(allowed_planning_time_per_trajectory)
planning_attempts_per_traj = RemoteSender(planning_attempts_per_trajectory)

planning_attempts_per_traj_2 = RemoteReceiver(planning_attempts_per_traj)
allowed_planning_time_per_traj_2 = RemoteReceiver(allowed_planning_time_per_traj)

# ----
# Calculate IK for place egress planes
compute_ik = Button()
ik_attempts = Slider(400, range=0..3000)
joint_position_tolerance_for_ik_in_degre = Slider(1, range=1..30)  # "Joint position tolerance for IK in degrees"
ik_attempts_2 = RemoteSender(ik_attempts)
travel_joint_tolerance = RemoteSender(joint_position_tolerance_for_ik_in_degre)

load_3d_scan = BooleanToggle(False)
set_up_planning_scene = Button()
load_3d_scan_2 = RemoteSender(load_3d_scan)

load_3d_scan_3 = RemoteReceiver(load_3d_scan_2)

# ----
# Pick egress to segment egress
# Segment egress
number_slider_9 = Slider(0, range=-180..180)
list_2 = ValueList({"RRT", "RRTConnect", "RRT*": "RRTstar", "EST", "PRM": "RPM", "PRM*": "RPMStar", "SPARS"}, selected="RRT*")
plan_egress = Button()
list_3 = ValueList({"Plan from pick egress": 0, "Plan from segment egress": 1}, selected="Plan from pick egress")
pt_4 = Point(Point(530.1676745, -937.9120622, 1160.65844))
planner_pick_egress_to_place_egress = RemoteSender(list_2)
pflip = FlipPlane(Plane=pt_4, ReverseX=False, ReverseY=False, SwapAxes=True)
cluster_4 = Cluster_4(
    plane=pflip,
    rot_around_x=number_slider_9,
    rot_around_y=Slider(30, range=-180..180),
    rot_around_z=Slider(90, range=-180..180))
segment_egress_plane = RemoteSender(cluster_4)

connect_to_ros = Button()
load_robot_model = Button()

# ---- group: ROS client
disconnect = Button()
ros = PythonScript(connect=connect_to_ros, disconnect=disconnect, port="9090")  # -> out, ros_client; inputs port: Int32
# ---------- ros: Python ----------
import sys
import scriptcontext as sc
from compas_fab.backends import RosClient

key = 'rosclient_%s' % str(ghenv.Component.InstanceGuid)
previous_client = sc.sticky.get(key, None)

if not port:
    port = 9090

if previous_client and (connect or disconnect):
    previous_client.close()

if connect:
    ros_client = RosClient('127.0.0.1', port)
    sc.sticky[key] = ros_client
    ros_client.run(5)
import compas_bootstrapper

ros_client = sc.sticky.get(key)
print('ROS connected: {}'.format(ros_client.is_connected if ros_client else 'False'))
# ---------- end ros ----------

# ----
out_connect = RemoteSender(ros.out)

list_4 = ValueList({"Plan for all": 0, "Plan for non-placed": 1, "Manual index selection": 2}, selected="Plan for all")
end_index = Slider(150, range=0..1000)
path = FilePath("C:\rcf_robotcontrol\03_run_data\20201031T18.44.25-1AB-000-005.json")
start_index = Slider(0, range=0..1000)
input_json_path = RemoteSender(path)
plan_selection_meth = RemoteSender(list_4)
panel_4 = Panel(path)

input_json_path_2 = RemoteReceiver(input_json_path)
read_placeelements_from_json = GhPythonScript(path=input_json_path_2)  # -> out, run_data, encoded_run_data, fab_data, all_elems, pick_conf_path, pick_station, conf_path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
# ---------- read_placeelements_from_json: Python ----------
import json

from compas.geometry import Frame

from rapid_clay_formations_fab.fab_data import PickStation
from rapid_clay_formations_fab.fab_data import PlaceElement
from rapid_clay_formations_fab.rhino import cgframe_to_rgplane
from rapid_clay_formations_fab.rhino import matrix_to_rgtransform
from rapid_clay_formations_fab.robots import MinimalTrajectories
class DummyClass(object):
    def __init__(self, data):
        self.data = data

if not path:
    raise Exception("No path given.")

with open(path, mode="r") as fp:
    run_data = json.load(fp)

fab_data = run_data.get("fab_data")
if fab_data:
    all_elems = [PlaceElement.from_data(data) for data in fab_data]
pick_station_data = run_data.get("pick_station")

pick_station = PickStation.from_data(pick_station_data)

conf_path = run_data.get("conf_path")
rcf = run_data.get("rcf")
if rcf:
    rcf = Frame.from_data(rcf)
    rcf_plane = cgframe_to_rgplane(rcf)
xform = run_data.get("xform")
if xform:
    rg_xform = matrix_to_rgtransform(xform)
run_data = DummyClass(run_data) # Change object to class because dicts are weird in GH
# ---------- end read_placeelements_from_json ----------
python_6 = GhPythonScript(x=read_placeelements_from_json.all_elems)  # -> out, a; inputs x: list
# ---------- python_6: Python ----------
traj = x[0].travel_trajectories[0]
traj.lol = "a"
print(traj.__dict__)
# ---------- end python_6 ----------

# ---- group: Read JSON (continued)
read_claybullets_from_json = GhPythonScript(elements=read_placeelements_from_json.all_elems, egress_frame_distance=number_slider_4)  # -> out, modified_elements; inputs placed: Boolean
# ---------- read_claybullets_from_json: Python ----------
print("Original values")
print("egress_frame_distance: {}".format(elements.egress_frame_distance))
print("placed: " + str(elements.placed))
print("")

modified_elements = elements.copy()
if egress_frame_distance:
    modified_elements.egress_frame_distance = egress_frame_distance
if placed:
    modified_elements.placed = bool(placed)

print("Modified values")
print("egress_frame_distance: {}".format(modified_elements.egress_frame_distance))
print("placed: " + str(modified_elements.placed))
# ---------- end read_claybullets_from_json ----------

# ----
matrix = TransformMatrix(read_placeelements_from_json.rg_xform, Digits=3)
panel_5 = Panel(read_claybullets_from_json.out)

read_placeelements_from_json_2 = GhPythonScript(pick_station=read_placeelements_from_json.pick_station)  # -> out, egress_pick_station, egress_pick_station_plane, pick_frames
# ---------- read_placeelements_from_json_2: Python ----------
from rapid_clay_formations_fab.rhino import cgframe_to_rgplane

egress_pick_station_plane = cgframe_to_rgplane(pick_station.station_egress_frame)
pick_frames = [cgframe_to_rgplane(frame) for frame in pick_station.pick_frames]
# ---------- end read_placeelements_from_json_2 ----------
pln_4 = Plane(read_placeelements_from_json_2.egress_pick_station_plane)
pln_5 = Plane(read_placeelements_from_json_2.pick_frames)

# ---- group: Read JSON
# Read fab_data
read_claybullets_from_json_2 = GhPythonScript(
    clay_cylinders=read_claybullets_from_json.modified_elements,
    show_place_egress_planes=Toggle(False),
    show_top_planes=Toggle(False),
    show_compressed_top_planes=Toggle(False),
    show_location_planes=Toggle(False),
    show_cylinders=Toggle(False),
    show_circles=Toggle(False),
    show_meshes=Toggle(False),
    face_count=Slider(8, range=0..10))  # -> out, place_egress_planes, top_planes, compressed_top_planes, location_planes, cylinders, circles, meshes, placed
# ---------- read_claybullets_from_json_2: Python ----------
from rapid_clay_formations_fab.rhino import cgframe_to_rgplane

if show_place_egress_planes:
    place_egress_planes = cgframe_to_rgplane(clay_cylinders.get_egress_frame())

if show_top_planes:
    top_planes = cgframe_to_rgplane(clay_cylinders.get_uncompressed_top_frame())
if show_compressed_top_planes:
    compressed_top_planes = cgframe_to_rgplane(clay_cylinders.get_compressed_top_frame())
if show_location_planes:
    location_planes = clay_cylinders.get_location_plane()
if show_cylinders:
    cylinders = clay_cylinders.get_rgcylinder()
if show_circles:
    circles = clay_cylinders.get_rgcircle()
if show_meshes:
    meshes = clay_cylinders.get_rgmesh()

compression = 1 - clay_cylinders.compression_ratio

ids = clay_cylinders.id_

placed = clay_cylinders.placed
# ---------- end read_claybullets_from_json_2 ----------

# ----
panel_6 = Panel(read_claybullets_from_json_2.placed)
comp_2 = Compound(Transforms=flatten([read_placeelements_from_json.rg_xform, comp]))
dam_2 = DataDam(DataA=start_index, DataB=end_index, BufferDelay=10000000, BufferMode=0)  # -> DataA, DataB

end_idx = RemoteSender(dam_2.DataB)
start_idx = RemoteSender(dam_2.DataA)

python_7 = GhPythonScript(fab_data=read_claybullets_from_json.modified_elements)  # -> out, not_placed_idx; inputs fab_data: list
# ---------- python_7: Python ----------
not_placed_idx = []
for i, elem in enumerate(fab_data):
    if not elem.placed:
        not_placed_idx.append(i)
# ---------- end python_7 ----------
lng = ListLength(List=read_claybullets_from_json.modified_elements)
end_idx_2 = RemoteReceiver(end_idx)
start_idx_2 = RemoteReceiver(start_idx)
series = Series(Start=0, Step=1, Count=lng)
plan_selection_meth_2 = RemoteReceiver(plan_selection_meth)
dom = ConstructDomain(DomainStart=start_idx_2, DomainEnd=end_idx_2)
subset = SubList(List=series, Domain=dom, Wrap=False)  # -> List, Index
filter = StreamFilter(Gate=plan_selection_meth_2, Stream0=series, Stream1=python_7.not_placed_idx, Stream2=subset.List)
int = Integer(filter)
int_2 = Integer(series)
difference = SetDifference(SetA=int_2, SetB=int)
cull_i = CullIndex(List=read_claybullets_from_json.modified_elements, Indices=difference, Wrap=False)
cull_i_2 = CullIndex(List=read_claybullets_from_json.modified_elements, Indices=filter, Wrap=False)
skipped_elems = RemoteSender(cull_i_2)
python_8 = GhPythonScript(to_path_plan=cull_i)  # -> out, elems_wo_ppl
# ---------- python_8: Python ----------
from copy import copy

elems_wo_ppl = copy(to_path_plan)

for key in elems_wo_ppl.__dict__.iterkeys():
    if isinstance(key, str) and "trajectory" in key:
        elems_wo_ppl.__dict__[key] = None
# ---------- end python_8 ----------

item = ListItem(List=filter, Index=0, Wrap=True)
larger = LargerThan(FirstNumber=item, SecondNumber=difference)  # -> LargerThan, OrEqualTo

cull = CullPattern(List=cull_i_2, CullPattern=larger.LargerThan)
python_9 = GhPythonScript(elems=python_8.elems_wo_ppl, egress_frame_distance=Slider(150, range=0..1000))  # -> out, elems_w_new_egress_dist
# ---------- python_9: Python ----------
elems_w_new_egress_dist = elems
if egress_frame_distance:
    elems_w_new_egress_dist.egress_frame_distance = egress_frame_distance
# ---------- end python_9 ----------
ghpython_script = GhPythonScript(elements=python_9.elems_w_new_egress_dist)  # -> out, location_planes, compression, ids; inputs elements: list
# ---------- ghpython_script: Python ----------
location_planes = [elem.get_location_rgplane() for elem in elements]

compression = [1 - elem.compression_ratio for elem in elements]

ids = [elem.id_ for elem in elements]
# ---------- end ghpython_script ----------
read_claybullets_from_json_3 = GhPythonScript(fab_elements=cull, u_res=Slider(6, range=0..100))  # -> out, meshes
# ---------- read_claybullets_from_json_3: Python ----------
meshes = fab_elements.get_rgmesh(u_res=u_res)
# ---------- end read_claybullets_from_json_3 ----------
transform = Transform(Geometry=read_claybullets_from_json_3.meshes, Transform=comp)

cluster_5 = Cluster_4(
    plane=ghpython_script.location_planes,
    rot_around_x=Slider(0, range=-180..180),
    rot_around_y=number_slider_5,
    rot_around_z=Slider(0, range=-180..180))

panel_7 = Panel(ghpython_script.ids)
cset = CreateSet(List=ghpython_script.compression)  # -> Set, Map
panel_8 = Panel(cset.Set)

# ---- group: Previously placed cylinders as collision meshes (continued)
transform_2 = Transform(Geometry=merge, Transform=comp_2)
merge_2 = Merge(Data1=transform_2, Data2=transform)  # -> flatten(Result)
volume = Volume(Geometry=merge_2)  # -> Volume, Centroid
scale_5 = Scale(Geometry=merge_2, Center=volume.Centroid, Factor=prev_cylinders_scale_factor_2)  # -> Geometry, Transform

# ---- group: Edit planes individually (continued)
item_2 = ListItem(List=cluster_5, Index=relay, Wrap=True)
cluster_6 = Cluster_4(
    plane=item_2,
    rot_around_x=Slider(40, range=-180..180),
    rot_around_y=number_slider_7,
    rot_around_z=Slider(0, range=-180..180))
replace = ReplaceItems(List=cluster_5, Item=cluster_6, Indices=relay, Wrap=False)

# ----
mjoin_4 = MeshJoin(Meshes=scale_5.Geometry)

cluster_7 = Cluster_2(plane=flatten(replace), amplitude=number_slider_8, R=Slider(2, range=0..10))  # -> geo, color
preview_2 = CustomPreview(Geometry=cluster_7.geo, Material=cluster_7.color)

edit_xy_dir = GhPythonScript(clay_cylinders=python_9.elems_w_new_egress_dist, rotated_location_planes=replace)  # -> out, rotated_clay_cylinders
# ---------- edit_xy_dir: Python ----------
from copy import deepcopy
from rapid_clay_formations_fab.rhino import rgplane_to_cgframe

rotated_clay_cylinders = deepcopy(clay_cylinders)
rotated_clay_cylinders.location = rgplane_to_cgframe(rotated_location_planes)
# ---------- end edit_xy_dir ----------

# ---- group: Transform clay cylinders
python_10 = GhPythonScript(
    elems=edit_xy_dir.rotated_clay_cylinders,
    rg_xform=comp,
    scale_factor_collision_meshes=scale_factor_just_placed_cylinders_3)  # -> out, transformed_elems, location_planes, collision_meshes, rg_collision_meshes
# ---------- python_10: Python ----------
import Rhino.Geometry as rg
from ghpythonlib.treehelpers import list_to_tree

import compas.geometry as cg
from compas_fab.robots import CollisionMesh

from rapid_clay_formations_fab.rhino import rgtransform_to_matrix
from rapid_clay_formations_fab.rhino import matrix_to_rgtransform

transformed_elems = elems

if rg_xform and rg_xform != rg.Transform.Identity:
    M = rgtransform_to_matrix(rg_xform)

    T = cg.Transformation(matrix=M)

    transformed_elems = elems.transformed(T)

location_planes = transformed_elems.get_location_rgplane()

cg_meshes = transformed_elems.get_cgmesh(u_res=4)
rg_meshes = transformed_elems.get_rgmesh(u_res=4)

if scale_factor_collision_meshes:
    S = cg.Scale([1,1,1])

    Tw = cg.matrix_from_frame(transformed_elems.location)
    Tl = cg.matrix_inverse(Tw)
    Sc = cg.matrix_from_scale_factors([scale_factor_collision_meshes] * 3)
    S.matrix = cg.multiply_matrices(cg.multiply_matrices(Tw, Sc), Tl)

    cg_meshes.transform(S)
    rgS = matrix_to_rgtransform(S)
    rg_meshes.Transform(rgS)

collision_meshes = CollisionMesh(cg_meshes, "cylinders")
rg_collision_meshes = rg_meshes
# ---------- end python_10 ----------

# ----
# Preview planes (Z should b down)
number_slider_10 = Slider(44, range=0..100)
cluster_8 = Cluster_2(plane=flatten(python_10.location_planes), amplitude=number_slider_10, R=Slider(6, range=0..10))  # -> geo, color
points = PointList(Points=python_10.location_planes, Size=Slider(50, range=0..100))
preview_3 = CustomPreview(Geometry=cluster_8.geo, Material=cluster_8.color)

mesh_8 = Mesh(python_10.rg_collision_meshes)
cylinder_coll_meshes = RemoteSender(python_10.collision_meshes)
mjoin_5 = MeshJoin(Meshes=mesh_8)
order = PointOrder(Points=python_10.location_planes)
points_2 = PointList(Points=python_10.location_planes, Size=Slider(40, range=0..100))
translated_elements = RemoteSender(python_10.transformed_elems)
cylinder_coll_meshes_2 = RemoteReceiver(cylinder_coll_meshes)
translated_elements_2 = RemoteReceiver(translated_elements)
translated_elements_3 = RemoteReceiver(translated_elements)
skipped_elems_2 = RemoteReceiver(skipped_elems)
input_json_path_3 = RemoteReceiver(input_json_path)

transform_3 = Transform(Geometry=mjoin_2, Transform=comp_2)
create_tool_7 = GhPythonScript(mesh=mjoin_4, id="previously_placed")  # -> cmesh; same code as create_tool

filter_2 = StreamFilter(Gate=load_3d_scan_3, Stream1=transform_3)

create_tool_8 = GhPythonScript(mesh=filter_2, id="3dscan")  # -> cmesh; inputs mesh: Mesh; same code as create_tool
collision_meshes = Data(flatten([create_tool_4, create_tool_5, create_tool_6, create_tool_7, create_tool_8, create_tool]))

# ----
# Settings cartesian moves
path_plan_place_egress_to_uncompressed_t = Button()  # "Path plan place egress to uncompressed top"
path_plan_uncompressed_top_to_compressed = Button()  # "Path plan uncompressed top to compressed top"
first_cartesian_movement_max_step = Slider(5, range=0..200)
second_cartesian_movement_max_step = Slider(5, range=0..200)
second_cartesian_max_step = RemoteSender(second_cartesian_movement_max_step)
first_cartesian_max_step = RemoteSender(first_cartesian_movement_max_step)

first_cartesian_max_step_2 = RemoteReceiver(first_cartesian_max_step)
second_cartesian_max_step_2 = RemoteReceiver(second_cartesian_max_step)

save_json_with_trajectories = Button()

load_planning_scene = RemoteSender(set_up_planning_scene)
compute_plan_to = RemoteSender(plan_segment_egress_to_place_egress)
compute_ik_2 = RemoteSender(compute_ik)
compute_top_to_compressed = RemoteSender(path_plan_uncompressed_top_to_compressed)
save_ppl_json = RemoteSender(save_json_with_trajectories)
compute_egress_to_top = RemoteSender(path_plan_place_egress_to_uncompressed_t)
compute_egress = RemoteSender(plan_egress)

save_ppl_json_2 = RemoteReceiver(save_ppl_json)

# ----
# Robot model
# Planning scene
tool_w_cylinder_2 = RemoteReceiver(tool_w_cylinder)
units = ValueList({"m": 1, "cm": 100, "mm": 1000}, selected="mm")
load_planning_scene_2 = RemoteReceiver(load_planning_scene)

out_connect_2 = RemoteReceiver(out_connect)
panel_9 = Panel(out_connect_2)

# ----
# Plan pick egress to segment egress
segment_egress_plane_2 = RemoteReceiver(segment_egress_plane)
planner_pick_egress_to_place_egress_2 = RemoteReceiver(planner_pick_egress_to_place_egress)
constraint_tolerance_joints1_5_2 = RemoteReceiver(constraint_tolerance_joints1_5)
constraint_tolerance_joint6_3 = RemoteReceiver(constraint_tolerance_joint6_2)
compute_egress_2 = RemoteReceiver(compute_egress)
prot = RotatePlane(Plane=pln_4, Angle=degrees(Slider(0, range=0..100)))
python_11 = GhPythonScript(plane_like=prot)  # -> frame
# ---------- python_11: Python ----------
from rapid_clay_formations_fab.utils import ensure_frame

frame = ensure_frame(plane_like)
# ---------- end python_11 ----------
python_12 = GhPythonScript(plane_like=segment_egress_plane_2)  # -> frame; same code as python_11

gate = StreamGate(Stream=compute_egress_2, Gate=list_3)  # -> Target0, Target1

# ----
# Configuration
a1 = Slider(0, range=-360..360)
a2 = Slider(0, range=-360..360)
a3 = Slider(0, range=-360..360)
a4 = Slider(0, range=-360..360)
a5 = Slider(0, range=-360..360)
a6 = Slider(0, range=-360..360)

# ----
# Get inverse kinematics clay cylinder planes
attempts_per_call = Slider(8, range=1..20)
travel_joint_tolerance_2 = RemoteReceiver(travel_joint_tolerance)
compute_ik_3 = RemoteReceiver(compute_ik_2)
ik_attempts_3 = RemoteReceiver(ik_attempts_2)
division = Division(A=ik_attempts_3, B=attempts_per_call)
round = Round(Number=division)  # -> Nearest, Floor, Ceiling

# ----
# No IK found
# Index of failed cylinders
distance_egress_to_location_plane = Slider(250, range=0..1000)

# ---- group: plan motion
# Plan segment egress to place egress
planner_segment_egress_to_place_egress_2 = RemoteReceiver(planner_segment_egress_to_place_egress)
cylinder_coll_meshes_3 = RemoteReceiver(cylinder_coll_meshes)
compute_plan_to_2 = RemoteReceiver(compute_plan_to)
panel_10 = Panel("positions")
panel_11 = Panel("velocities")
panel_12 = Panel("accelerations")

# ---- group: cartesian motion
# Path plan place egress to uncompressed top
compute_egress_to_top_2 = RemoteReceiver(compute_egress_to_top)
translated_elements_4 = RemoteReceiver(translated_elements)

# Plan top_to_compressed_top
tool_w_cylinder_3 = RemoteReceiver(tool_w_cylinder)
compute_top_to_compressed_2 = RemoteReceiver(compute_top_to_compressed)
tool_wo_cylinder_2 = RemoteReceiver(tool_wo_cylinder)
translated_elements_5 = RemoteReceiver(translated_elements)

# ----
# Visualization
list_5 = ValueList({"0 forward_kinematics": 0, "1 inverse_kinematics": 1, "2 IK_list": 2, "3 travel_to": 3, "4 egress_to_top": 4, "5 top_to_uncompressed_top": 5, "6 whole_paths": 6}, selected="0 forward_kinematics")
show_end_effector_frame = BooleanToggle(False)
show_base_frame = BooleanToggle(False)
show_collision = BooleanToggle(False)
show_frames = BooleanToggle(True)
show_visual = BooleanToggle(True)

robot = RemoteReceiver(robot_2)
python_13 = GhPythonScript(
    robot=robot,
    collision_mesh=scale_4.Geometry,
    id="cable_holder",
    link_name="link_3",
    link_plane=scale_3.Geometry,
    touch_links="link_3")  # -> out, acm; inputs touch_links: list
# ---------- python_13: Python ----------
from compas_rhino.geometry import RhinoMesh
from compas_fab.robots import AttachedCollisionMesh
from compas_fab.robots import CollisionMesh

from rapid_clay_formations_fab.rhino import rgplane_to_cgframe

compas_mesh = RhinoMesh.from_geometry(collision_mesh).to_compas()
l_frame = rgplane_to_cgframe(link_plane)
col_mesh = CollisionMesh(compas_mesh, id or "acm")

if len(touch_links) == 0:
    touch_links = [link_name]

acm = AttachedCollisionMesh(col_mesh, link_name, touch_links=touch_links)
# ---------- end python_13 ----------
acm = RemoteSender(python_13.acm)

acm_2 = RemoteReceiver(acm)
acm_3 = RemoteReceiver(acm)
acm_4 = RemoteReceiver(acm)
acm_5 = RemoteReceiver(acm)

create = PythonScript(scale_factor=units, load=load_robot_model, tool=tool_w_cylinder_2, acm=acm_2, port="9090")  # -> robot; inputs acm: list, port: Int32
# ---------- create: Python ----------
from scriptcontext import sticky as st


import compas
from compas_fab.backends import RosClient
from compas_fab.robots import PlanningScene
from compas_fab.ghpython import RobotArtist

compas.PRECISION = '12f'

# store robot in component
guid = str(ghenv.Component.InstanceGuid)
robot_key = "robot_" + guid
acm_key = "acm_" + guid

if robot_key not in st:
    st[robot_key] = None

if load:
    with RosClient('127.0.0.1', port) as ros:
        robot = ros.load_robot(load_geometry=True)
        robot.artist = RobotArtist(robot.model)

        robot.scale(scale_factor)
        st[robot_key] = robot

robot = st[robot_key]
scene = None
if robot:

    if tool:
        # Scaled in tool setup nodes
        touch_links = [l.name for l in robot.model.iter_link_chain()][-2:]
        robot.attach_tool(tool, touch_links=touch_links)

        # If a client is connected, we need to update the planning scene accordingly
        if robot.client:
            scene = PlanningScene(robot)
            scene.add_attached_tool()
    else:
        if robot.attached_tool:
            id = robot.attached_tool.name

            # If a client is connected, we need to update the planning scene accordingly
            if robot.client:
                scene.remove_attached_tool()
                scene.remove_collision_mesh(id)
            robot.detach_tool()

if robot and robot.client and load:
    scene = PlanningScene(robot)
    acm_ids = st.get(acm_key)
    if acm_ids:
        # tool is left of this operation since it is never added to st[acm_key]
        removed_acm_ids = set(acm_ids) - set([acm_mesh.collision_mesh.id for acm_mesh in acm])
        if removed_acm_ids:
            for id in acm_ids:
                scene.remove_attached_collision_mesh(id)

            print('Removing old CMs')
            print('Remove: ' + str(acm_ids))
            st[acm_key] = [id for id in acm_ids if id not in removed_acm_ids]

    if len(acm) > 0:
        for mesh in acm:
            scene.add_attached_collision_mesh(mesh)
            st[acm_key].append(mesh.collision_mesh.id)
# ---------- end create ----------

robot_2 = RemoteSender(create)

# ----
# Path constraints
robot_3 = RemoteReceiver(robot_2)
python_14 = GhPythonScript(robot=robot_3)  # -> out, joint_constraints
# ---------- python_14: Python ----------
from math import radians
from compas_fab.robots import JointConstraint
joint_constraints = []
#joint_constraints.append(JointConstraint("joint_1", radians(-90),
#                      tolerance_below=radians(90),
#                      tolerance_above=radians(100)))

#joint_constraints.append(JointConstraint("joint_3", radians(0),
#                      tolerance_below=radians(90),
#                      tolerance_above=radians(90)))

joint_constraints.append(JointConstraint("joint_4", radians(0),
                      tolerance_below=radians(180),
                      tolerance_above=radians(180)))
joint_constraints.append(JointConstraint("joint_6",
                                         radians(-90),
                                         tolerance_below=radians(200),
                                         tolerance_above=radians(200)))
# ---------- end python_14 ----------
path_constraints = RemoteSender(flatten(python_14.joint_constraints))

robot_4 = RemoteReceiver(robot_2)
create_2 = PythonScript(robot=robot_4, scale_factor=units, load=load_planning_scene_2, collision_meshes=collision_meshes)  # inputs collision_meshes: list
# ---------- create_2: Python ----------
import os
import copy
from scriptcontext import sticky as st


import compas
from compas.geometry import Scale
from compas_fab.backends import RosClient
from compas_fab.ghpython import RobotArtist
from compas_fab.robots import PlanningScene
from compas_fab.robots import Tool

compas.PRECISION = '12f'

guid = str(ghenv.Component.InstanceGuid)
cm_key = "cm_" + guid



if robot and robot.client and load:
    scene = PlanningScene(robot)

    cm_ids = st.get(cm_key)

    if cm_ids:
        removed_cm_ids = set(cm_ids) - set([cm.id for cm in collision_meshes])
        if removed_cm_ids:
            for id in cm_ids:
                scene.remove_collision_mesh(id)

            print('Removing old CMs')
            print('Remove: ' + str(cm_ids))
            st[cm_key] = [id for id in cm_ids if id not in removed_cm_ids]

    if collision_meshes:
        print('Adding new CMs')
        st[cm_key] = []
        for cm in collision_meshes:
            cm = copy.deepcopy(cm)
            scene.add_collision_mesh(cm, scale=scale_factor != 1)
            st[cm_key].append(cm.id)

print(st.get(cm_key))
# ---------- end create_2 ----------

robot_5 = RemoteReceiver(robot_2)  # disabled
python_15 = GhPythonScript(robot=robot_5)  # -> out; disabled
# ---------- python_15: Python ----------
print("{} collision objects in scene.".format(len(robot.client.get_planning_scene().world.collision_objects)))
# ---------- end python_15 ----------
panel_19 = Panel(python_15)

set = PythonScript(robot=create, client=ros.ros_client)  # -> out
# ---------- set: Python ----------
if robot and client:
    robot.client = client
    print("Ok!")
else:
    print("Load robot model.")
# ---------- end set ----------
out_client = RemoteSender(set)

out_client_2 = RemoteReceiver(out_client)
panel_20 = Panel(out_client_2)

# ----
# Info
info = PythonScript(robot=create)  # -> out, main_group_name
# ---------- info: Python ----------
if robot:
    robot.info()
    main_group_name = robot.main_group_name
# ---------- end info ----------
panel_21 = Panel(info.out)

main_planning_group = RemoteSender(info.main_group_name)
robot_6 = RemoteReceiver(robot_2)
main_planning_group_2 = RemoteReceiver(main_planning_group)

forward_kinematics = PythonScript(robot=robot_6, group=main_planning_group_2, a1=a1, a2=a2, a3=a3, a4=a4, a5=a5, a6=a6)  # -> configuration
# ---------- forward_kinematics: Python ----------
import math
from compas_fab.robots import Configuration

if robot:
    joint_positions = [a1, a2, a3, a4, a5, a6]
    joint_positions = [math.radians(a) for a in joint_positions]
    types = robot.get_configurable_joint_types(group)
    configuration = Configuration(joint_positions, types)
    print configuration
# ---------- end forward_kinematics ----------

# ---- group: Forward kinematics
fk = PythonScript(robot=robot_6, group=main_planning_group_2, configuration=forward_kinematics)  # -> out, frame_WCF
# ---------- fk: Python ----------
import scriptcontext as sc
import logging
if robot:
    frame_WCF = robot.forward_kinematics(configuration, group, backend='model')

print frame_WCF
# ---------- end fk ----------
panel_22 = Panel(fk.out)

# ----
# Inverse kinematics
py = PythonScript(robot=robot_6)  # -> configuration
# ---------- py: Python ----------
from compas_fab.robots import Configuration

if robot:
    configuration = robot.zero_configuration()
    print configuration
# ---------- end py ----------
inverse_kinematics = PythonScript(robot=robot_6, group=main_planning_group_2, start_configuration=py)  # -> out, configuration
# ---------- inverse_kinematics: Python ----------
import rhinoscriptsyntax as rs
import scriptcontext as sc
import logging

from compas.geometry import Frame

from compas_fab.backends.ros import RosError
from compas_fab.robots import Configuration

from rapid_clay_formations_fab.rhino import rgplane_to_cgframe

LOGGER = logging.getLogger('roslibpy')

guid = str(ghenv.Component.InstanceGuid)
response_key = "response_" + guid

if response_key not in sc.sticky:
    sc.sticky[response_key] = None

if robot:
    if robot.client:
        if robot.client.is_connected:
            goal_frame = rgplane_to_cgframe(plane)
            goal_frame = robot.from_attached_tool_to_tool0([goal_frame])
            response = robot.inverse_kinematics(goal_frame[0], start_configuration, group)
            sc.sticky[response_key] = response
        else:
            print("Robot is not connected")

if sc.sticky[response_key]:
    response = sc.sticky[response_key]
    configuration = response
# ---------- end inverse_kinematics ----------

robot_7 = RemoteReceiver(robot_2)
robot_8 = RemoteReceiver(robot_2)
main_planning_group_3 = RemoteReceiver(main_planning_group)
robot_9 = RemoteReceiver(robot_2)

main_planning_group_4 = RemoteReceiver(main_planning_group)
path_constraints_2 = RemoteReceiver(path_constraints)
robot_10 = RemoteReceiver(robot_2)
acm_6 = RemoteReceiver(acm)
plan_motion = PythonScript(
    robot=robot_10,
    group=main_planning_group_4,
    pick_egress_frame=python_11,
    goal_frame=python_12,
    planner_id=planner_pick_egress_to_place_egress_2,
    path_constraints=path_constraints_2,
    tolerance_joints=constraint_tolerance_joints1_5_2,
    tolerance_joint6=constraint_tolerance_joint6_3,
    new_cylinder_collision_meshes=mjoin_5,
    compute=gate.Target1,
    acm=acm_6)  # -> out, trajectory, last_conf; inputs path_constraints: list, new_cylinder_collision_meshes: list, acm: list
# ---------- plan_motion: Python ----------
import math

from scriptcontext import sticky as st

from compas_rhino.geometry import RhinoMesh
from compas_fab.robots import Configuration
from compas_fab.robots import CollisionMesh
from compas_fab.backends.ros import RosValidationError
from compas_fab.backends.ros import MoveItErrorCodes

from compas_fab.robots import PlanningScene

guid_obj = ghenv.Component.InstanceGuid
guid = str(guid_obj)
if st.get("ppl_components"):
    st["ppl_components"].add(guid_obj)
else:
    st["ppl_components"] = set([guid_obj])

trajectory_key = "ppl_pipeline_trajectory_" + guid
response = "response_" + guid

start_frame = pick_egress_frame

if len(path_constraints) == 0 or not path_constraints[0]:
    path_constraints = None

if len(acm) == 0:
    acm = None

if robot and robot.client and robot.client.is_connected:
    scene = PlanningScene(robot)
    scene.remove_collision_mesh("cylinders")

conf_constraint_tolerances = [tolerance_joints] * 5 + [tolerance_joint6]
conf_constraint_tolerances = [math.radians(tol) for tol in conf_constraint_tolerances]

if robot and robot.client and robot.client.is_connected and pick_egress_frame and goal_frame and compute:
    st[trajectory_key] = []

    if robot.attached_tool:
        start_frame, goal_frame = robot.from_attached_tool_to_tool0([start_frame, goal_frame])
    start_conf = robot.inverse_kinematics(start_frame,
                                          group=group,
                                          attempts=200,
                                          constraints=path_constraints,
                                          avoid_collisions=False)

    scene = PlanningScene(robot)
    for mesh in new_cylinder_collision_meshes:
        c_mesh = RhinoMesh.from_geometry(mesh).to_compas()
        scene.append_collision_mesh(CollisionMesh(c_mesh, "cylinders"), scale=True)

    goal_conf = robot.inverse_kinematics(goal_frame,
                                         start_configuration=start_conf,
                                         group=group,
                                         attempts=200,
                                         constraints=path_constraints)
    goal_constraints = robot.constraints_from_configuration(goal_conf,
                                                            conf_constraint_tolerances,
                                                            conf_constraint_tolerances,
                                                            group=group)

    trajectory = robot.plan_motion(goal_constraints,
                                   start_configuration=start_conf,
                                   group=group,
                                   planner_id=str(planner_id),
                                   num_planning_attempts=16,
                                   allowed_planning_time=2.5,
                                   path_constraints=path_constraints,
                                   attached_collision_meshes=acm)

    if trajectory.fraction < 1.0:
        raise RuntimeException("Could only plan {} % of path.".format(trajectory.fraction * 100))

    st[trajectory_key] = trajectory

trajectory = st.get(trajectory_key)
if trajectory:
    last_conf = Configuration.from_revolute_values(trajectory.points[-1].values)
    print("Ppl ok!")
else:
    print("Ready to plan!")
# ---------- end plan_motion ----------
trajectory_pick_egress_to_segment_egress = RemoteSender(plan_motion.trajectory)

plan_motion_2 = PythonScript(
    robot=robot_10,
    group=main_planning_group_4,
    pick_egress_frame=python_11,
    path_constraints=path_constraints_2,
    compute=gate.Target0,
    acm=acm_6)  # -> out, pick_egress_conf; inputs path_constraints: list, acm: list
# ---------- plan_motion_2: Python ----------
import math

from scriptcontext import sticky as st

from compas_rhino.geometry import RhinoMesh
from compas_fab.robots import Configuration
from compas_fab.robots import CollisionMesh
from compas_fab.backends.ros import RosValidationError
from compas_fab.backends.ros import MoveItErrorCodes

from compas_fab.robots import PlanningScene

guid_obj = ghenv.Component.InstanceGuid
guid = str(guid_obj)
if st.get("ppl_components"):
    st["ppl_components"].add(guid_obj)
else:
    st["ppl_components"] = set([guid_obj])

pick_egress_conf_key = "ppl_pipeline_conf_" + guid

if len(path_constraints) == 0 or not path_constraints[0]:
    path_constraints = None

if len(acm) == 0:
    acm = None

if robot and robot.client and robot.client.is_connected and pick_egress_frame and compute:
    if robot.attached_tool:
        pick_egress_frame = robot.from_attached_tool_to_tool0([pick_egress_frame])[0]

    st[pick_egress_conf_key] = robot.inverse_kinematics(pick_egress_frame,
                                          group=group,
                                          attempts=200,
                                          constraints=path_constraints)

pick_egress_conf = st.get(pick_egress_conf_key)

if pick_egress_conf:
    print("Pick egress conf ok!")
else:
    print("Ready to plan!")
# ---------- end plan_motion_2 ----------
filter_3 = StreamFilter(Gate=list_3, Stream0=plan_motion_2.pick_egress_conf, Stream1=plan_motion.last_conf)

main_planning_group_5 = RemoteReceiver(main_planning_group)
robot_11 = RemoteReceiver(robot_2)
path_constraints_3 = RemoteReceiver(path_constraints)
python_16 = PythonScript(
    robot=robot_11,
    group=main_planning_group_5,
    start_conf=filter_3,
    clay_cylinders=python_10.transformed_elems,
    tolerance_joints_deg=travel_joint_tolerance_2,
    ik_constraints=path_constraints_3,
    new_cylinder_collision_meshes=cylinder_coll_meshes_2,
    attempt_loops=round.Floor,
    attempts_per_call=attempts_per_call,
    run=compute_ik_3)  # -> out, start_configuration, start_conf_constraint, goal_constraints_sets, goal_configurations, no_IK_idx, start_conf; inputs clay_cylinders: list, ik_constraints: list, new_cylinder_collision_meshes: list, attempt_loops: Int32, attempts_per_call: Int32, run: Boolean
# ---------- python_16: Python ----------
import math

from scriptcontext import sticky as st

from compas_fab.robots import PlanningScene
from compas_fab.backends import RosValidationError
from compas_fab.backends.ros.messages import MoveItErrorCodes

from rapid_clay_formations_fab.rhino import cgframe_to_rgplane

guid_obj = ghenv.Component.InstanceGuid
guid = str(guid_obj)
if st.get("ppl_components"):
    st["ppl_components"].add(guid_obj)
else:
    st["ppl_components"] = set([guid_obj])

goal_constraints_sets_key = "ppl_pipeline_goal_constraints_sets" + guid
goal_configurations_key = "goal_configurations" + guid
no_IK_idx_key = "no_IK_planes" + guid
start_configuration_key = "start_configuration" + guid
start_conf_constraint_key = "start_conf_constraint" + guid

if not start_conf:
    raise Exception("Need start configuration from previous planner")

if len(ik_constraints) == 0 or not ik_constraints[0]:
    ik_constraints = None

goal_frames = [cylinder.get_egress_frame() for cylinder in clay_cylinders]

# Joint tolerances for goal_constraints
conf_constraint_tolerances = [tolerance_joints_deg] * 6
conf_constraint_tolerances = [math.radians(tol) for tol in conf_constraint_tolerances]
tolerances_above = tolerances_below = conf_constraint_tolerances


if robot and robot.client and robot.client.is_connected:
    scene = PlanningScene(robot)
    scene.remove_collision_mesh(new_cylinder_collision_meshes[0].id)

if robot and robot.client and robot.client.is_connected and run:

    if robot.attached_tool:
        goal_frames = robot.from_attached_tool_to_tool0(goal_frames)


    st[goal_configurations_key] = []
    st[goal_constraints_sets_key] = []
    st[no_IK_idx_key] = []

    scene = PlanningScene(robot)

    for i, frame in enumerate(goal_frames):

        for _ in range(attempt_loops):
            try:
                goal_conf = robot.inverse_kinematics(frame,
                                                     start_configuration=start_conf,
                                                     group=group,
                                                     attempts=attempts_per_call,
                                                     constraints=ik_constraints,
                                                     avoid_collisions=True)
            except RosValidationError as e:
                if e.original_exception.error_code == MoveItErrorCodes.NO_IK_SOLUTION:
                    continue
                else:
                    raise
            break
        else:
            goal_conf = None
            st[no_IK_idx_key].append(i)

        st[goal_configurations_key].append(goal_conf)
        scene.append_collision_mesh(new_cylinder_collision_meshes[i], scale=True)



    if len(st[no_IK_idx_key]) == 0:
        for goal_conf in st[goal_configurations_key]:
            goal_constraints = robot.constraints_from_configuration(goal_conf, tolerances_below, tolerances_above, group=group)

            st[goal_constraints_sets_key].append(goal_constraints)

goal_configurations = st.get(goal_configurations_key)
goal_constraints_sets = st.get(goal_constraints_sets_key)
no_IK_idx = st.get(no_IK_idx_key)
start_configuration = st.get(start_configuration_key)
start_conf_constraint = st.get(start_conf_constraint_key)

if goal_constraints_sets:
    print("IK done!")
elif  no_IK_idx and len(no_IK_idx) > 0:
    print("Couldn't find IK for {}".format(no_IK_idx))
else:
    print("Ready to calculate IK!")
# ---------- end python_16 ----------
start_configuration_for_travel = RemoteSender(python_16.start_configuration)
travel_goal_configurations = RemoteSender(python_16.goal_configurations)
out_ik = RemoteSender(python_16.out)

out_ik_2 = RemoteReceiver(out_ik)
panel_23 = Panel(out_ik_2)

filter_4 = StreamFilter(Gate=list_3, Stream0=plan_motion_2.out, Stream1=plan_motion.out)

out_pick_egress_to_segment_egress = RemoteSender(filter_4)

out_pick_egress_to_segment_egress_2 = RemoteReceiver(out_pick_egress_to_segment_egress)
panel_24 = Panel(out_pick_egress_to_segment_egress_2)

panel_25 = Panel(python_16.no_IK_idx)
item_3 = ListItem(List=translated_elements_2, Index=panel_25, Wrap=False)
read_claybullets_from_json_4 = GhPythonScript(
    clay_cylinders=item_3,
    show_place_egress_planes=Toggle(True),
    show_top_planes=Toggle(False),
    show_compressed_top_planes=Toggle(False),
    show_location_planes=Toggle(False),
    show_cylinders=Toggle(False),
    show_circles=Toggle(False),
    show_meshes=Toggle(False),
    face_count=Slider(8, range=0..10))  # -> out, place_egress_planes, top_planes, compressed_top_planes, location_planes, cylinders, circles, meshes, placed; same code as read_claybullets_from_json_2

pln_6 = Plane(python_16.no_IK_idx)
deplane = DeconstructPlane(Plane=pln_6)  # -> Origin, XAxis, YAxis, ZAxis
multiplication = Multiplication(A=deplane.ZAxis, B=distance_egress_to_location_plane)
move_2 = Move(Geometry=pln_6, Motion=multiplication)  # -> Geometry, Transform
cp = ClosestPoint(Point=move_2.Geometry, Cloud=python_10.location_planes)  # -> ClosestPoint, CPIndex, Distance
panel_26 = Panel(cp.CPIndex)

num = Number(cp.CPIndex)
preview_4 = CustomPreview(
    Geometry=read_claybullets_from_json_4.place_egress_planes,
    Material={diffuse=RGB(221, 160, 221), emission=RGB(66, 48, 66), shine=0.5, specular=RGB(255, 255, 255), transparency=0})

# ---- group: plan motion (continued)
robot_12 = RemoteReceiver(robot_2)
main_planning_group_6 = RemoteReceiver(main_planning_group)
path_constraints_4 = RemoteReceiver(path_constraints)
plan_motion_3 = PythonScript(
    robot=robot_12,
    group=main_planning_group_6,
    start_conf=filter_3,
    goal_constraints_sets=python_16.goal_constraints_sets,
    planner_id=planner_segment_egress_to_place_egress_2,
    path_constraints=path_constraints_4,
    new_elem_collision_meshes=cylinder_coll_meshes_3,
    planning_attempts_per_traj=planning_attempts_per_traj_2,
    allowed_planning_time_per_traj=allowed_planning_time_per_traj_2,
    compute=compute_plan_to_2,
    acm=acm_3)  # -> out, start_configurations, trajectories, last_confs, succesful, failed_idx; inputs goal_constraints_sets: list, path_constraints: list, new_elem_collision_meshes: list, acm: list
# ---------- plan_motion_3: Python ----------
from scriptcontext import sticky as st

from compas_fab.robots import PlanningScene
from compas_fab.robots import Configuration
from compas_fab.backends.ros import RosValidationError
from compas_fab.backends.ros import MoveItErrorCodes

guid_obj = ghenv.Component.InstanceGuid
guid = str(guid_obj)
if st.get("ppl_components"):
    st["ppl_components"].add(guid_obj)
else:
    st["ppl_components"] = set([guid_obj])

trajectories_key = "ppl_pipeline_trajectories_" + guid
failed_trajectories_key = "ppl_pipeline_failed_trajectories_" + guid

if len(goal_constraints_sets) == 0 or not goal_constraints_sets[0]:
    raise Exception("Need goal constraints from IK node")

if len(path_constraints) == 0 or not path_constraints[0]:
    path_constraints = None

if robot and robot.client and robot.client.is_connected:
    scene = PlanningScene(robot)
    scene.remove_collision_mesh(new_elem_collision_meshes[0].id)

if robot and robot.client and robot.client.is_connected and start_conf and compute:
    st[trajectories_key] = []
    st[failed_trajectories_key] = {}
    st[failed_trajectories_key]["PLANNING_FAILED"] = []
    st[failed_trajectories_key]["not_whole_path"] = []
    i = 0
    for constraints, elem_collision_mesh in zip(goal_constraints_sets, new_elem_collision_meshes):
        try:
            trajectory = robot.plan_motion(constraints,
                                           start_configuration=start_conf,
                                           group=group,
                                           planner_id=str(planner_id),
                                           num_planning_attempts=planning_attempts_per_traj,
                                           allowed_planning_time=allowed_planning_time_per_traj,
                                           path_constraints=path_constraints,
                                           attached_collision_meshes=list(acm))
        except RosValidationError as e:
                if e.original_exception.error_code == MoveItErrorCodes.PLANNING_FAILED:
                    st[failed_trajectories_key]["PLANNING_FAILED"].append(i)
                else:
                    raise

        if trajectory.fraction < 1.0:
            st[failed_trajectories_key]["not_whole_path"].append(i)

        st[trajectories_key].append(trajectory)
        scene.append_collision_mesh(elem_collision_mesh, scale=True)
        i += 1

succesful = None
if st.get(failed_trajectories_key):
    failed = False
    for value in st[failed_trajectories_key].values():
        if len(value) > 0:
            succesful = False
            break
    if succesful is False:

        n_planning_failed = len(st[failed_trajectories_key]["PLANNING_FAILED"])
        n_failed_trajs = len(st[failed_trajectories_key]["not_whole_path"])
        print("{} PLANNING_FAILED and {} trajectories with fraction less than one. Failed trajectories: {}".format(n_planning_failed, n_failed_trajs, st[failed_trajectories_key]))
    else:
        succesful = True
else:
    succesful = True

if st[failed_trajectories_key]:
    failed_idx = list(set(st[failed_trajectories_key]["PLANNING_FAILED"] + st[failed_trajectories_key]["not_whole_path"]))
trajectories = st.get(trajectories_key)

if succesful:
    if trajectories:
        last_confs = [Configuration.from_revolute_values(traj.points[-1].values) for traj in trajectories]
        print("Planning done!")
    else:
        print("Ready to plan!")
# ---------- end plan_motion_3 ----------
out_travel_to = RemoteSender(plan_motion_3.out)
item_4 = ListItem(List=plan_motion_3.trajectories, Index=Slider(0, range=0..140), Wrap=True)
trajectory_segment_egress_to_place_egres = RemoteSender(plan_motion_3.trajectories)  # "trajectory_segment_egress_to_place_egress"
vis = PythonScript(trajectory=item_4)  # -> P, V, A, time
# ---------- vis: Python ----------
from compas_ghpython import list_to_ghtree

if trajectory:

    positions = []
    velocities = []
    accelerations = []
    time_from_start = []

    for p in trajectory.points:
        positions.append(p.positions)
        velocities.append(p.velocities)
        accelerations.append(p.accelerations)
        time_from_start.append(p.time_from_start.seconds)

    P = list_to_ghtree(list(zip(*positions)))
    V = list_to_ghtree(list(zip(*velocities)))
    A = list_to_ghtree(list(zip(*accelerations)))

    time = time_from_start[-1]
    print time
# ---------- end vis ----------
vis_2 = PythonScript(trajectories=plan_motion_3.trajectories)  # -> cycle_times; inputs trajectories: list
# ---------- vis_2: Python ----------
from compas_ghpython import list_to_ghtree

cycle_times = []
for trajectory in trajectories:
    time = trajectory.points[-1].time_from_start.seconds
    cycle_times.append(time)
    print(time)
# ---------- end vis_2 ----------
travel_goal_configurations_2 = RemoteReceiver(travel_goal_configurations)
prismatic = QuickGraph(vis.P, SortOrder=0)
sort = SortList(Keys=vis_2, ValuesA=plan_motion_3.trajectories)  # -> reverse(Keys), reverse(ValuesA)
time_s = Panel(vis.time)
robot_13 = RemoteReceiver(robot_2)
animate = PythonScript(
    robot=robot_13,
    start_configurations=simplify(plan_motion_3.start_configurations),
    trajectories=simplify(plan_motion_3.trajectories),
    goal_configurations=travel_goal_configurations_2)  # -> trajectory_pts; inputs start_configurations: list, trajectories: list, goal_configurations: list
# ---------- animate: Python ----------
from ghpythonlib.treehelpers import list_to_tree

from compas_fab.utilities import map_range

from rapid_clay_formations_fab.utils import wrap_list

trajectory_pts = []

for i in range(len(trajectories)):
    _positions = []

    _positions.append(wrap_list(start_configurations, i))
    _positions.extend([p for p in trajectories[i].points if p])
    _positions.append(goal_configurations[i])

    trajectory_pts.append(_positions)

trajectory_pts = list_to_tree(trajectory_pts)
"""
if len(full_result) and robot:
    idx = int(map_range(value, 0, 1, 0, len(full_result) - 1))
    configuration = full_result[idx]
"""
# ---------- end animate ----------
graph = QuickGraph(vis.V, SortOrder=0)
graph_2 = QuickGraph(vis.A, SortOrder=0)

# ----
out_travel_to_2 = RemoteReceiver(out_travel_to)
panel_27 = Panel(out_travel_to_2)

# ---- group: cartesian motion (continued)
robot_14 = RemoteReceiver(robot_2)
main_planning_group_7 = RemoteReceiver(main_planning_group)
plan_cartesian_motion = PythonScript(
    robot=robot_14,
    group=main_planning_group_7,
    ready=plan_motion_3.succesful,
    start_confs=plan_motion_3.last_confs,
    elements=simplify(translated_elements_4),
    max_step=first_cartesian_max_step_2,
    compute=compute_egress_to_top_2,
    acm=acm_4)  # -> out, trajectories, last_confs; inputs start_confs: list, elements: list, acm: list
# ---------- plan_cartesian_motion: Python ----------
from scriptcontext import sticky as st

from compas_fab.robots import Configuration

guid_obj = ghenv.Component.InstanceGuid
guid = str(guid_obj)
if st.get("ppl_components"):
    st["ppl_components"].add(guid_obj)
else:
    st["ppl_components"] = set([guid_obj])

trajectories_key = "ppl_pipeline_trajectories_" + guid


if not start_confs or len(start_confs) == 0 or not start_confs[0]:
    raise Exception("Need start configuration from previous planner")

if robot and robot.client and robot.client.is_connected and compute:
    st[trajectories_key] = []

    for start_conf, elem in zip(start_confs, elements):
        frame = [elem.get_uncompressed_top_frame()]

        if robot.attached_tool:
            frame = robot.from_attached_tool_to_tool0(frame)

        trajectory = robot.plan_cartesian_motion(frame,
                                                 start_configuration=start_conf,
                                                 max_step=float(max_step),
                                                 avoid_collisions=False,
                                                 group=group,
                                                 attached_collision_meshes=list(acm))

        st[trajectories_key].append(trajectory)

trajectories = st.get(trajectories_key)

if trajectories:
    failed_trajectories = 0
    for i, trajectory in enumerate(trajectories):
        if trajectory and trajectory.fraction < 1.0:
            failed_trajectories += 1
            print("Trajectory idx {} only completeted {} % of its path.".format(i, trajectory.fraction * 100))
    #if failed_trajectories > 0:
        #raise Exception("{} failed trajectories".format(failed_trajectories))
    last_confs = [Configuration.from_revolute_values(traj.points[-1].values) for traj in trajectories]
    print("Planning done!")
else:
    print("Ready to plan!")
# ---------- end plan_cartesian_motion ----------
out_egress_to_top = RemoteSender(plan_cartesian_motion.out)
trajectory_egress_to_top = RemoteSender(plan_cartesian_motion.trajectories)
vis_3 = PythonScript(response=plan_cartesian_motion.trajectories)  # -> P, V, A
# ---------- vis_3: Python ----------
from compas_ghpython import list_to_ghtree

if response:

    positions = []
    velocities = []
    accelerations = []

    for p in response.points:
        positions.append(p.positions)
        velocities.append(p.velocities)
        accelerations.append(p.accelerations)

    P = list_to_ghtree(list(zip(*positions)))
    V = list_to_ghtree(list(zip(*velocities)))
    A = list_to_ghtree(list(zip(*accelerations)))
# ---------- end vis_3 ----------
prismatic_2 = QuickGraph(vis_3.P, SortOrder=0)
robot_15 = RemoteReceiver(robot_2)
graph_3 = QuickGraph(vis_3.V, SortOrder=0)
graph_4 = QuickGraph(vis_3.A, SortOrder=0)
animate_2 = PythonScript(
    robot=robot_15,
    start_configurations=simplify(plan_motion_3.last_confs),
    trajectories=simplify(plan_cartesian_motion.trajectories))  # -> trajectory_pts; inputs start_configurations: list, trajectories: list
# ---------- animate_2: Python ----------
from ghpythonlib.treehelpers import list_to_tree

from compas_fab.utilities import map_range

from rapid_clay_formations_fab.utils import wrap_list

trajectory_pts = []

for i in range(len(trajectories)):
    _positions = []

    _positions.append(wrap_list(start_configurations, i))
    _positions.extend([p for p in trajectories[i].points if p])

    trajectory_pts.append(_positions)

trajectory_pts = list_to_tree(trajectory_pts)
"""
if len(full_result) and robot:
    idx = int(map_range(value, 0, 1, 0, len(full_result) - 1))
    configuration = full_result[idx]
"""
# ---------- end animate_2 ----------

robot_16 = RemoteReceiver(robot_2)
main_planning_group_8 = RemoteReceiver(main_planning_group)
plan_cartesian_motion_2 = PythonScript(
    robot=robot_16,
    group=main_planning_group_8,
    start_confs=plan_cartesian_motion.last_confs,
    cylinders=simplify(translated_elements_5),
    max_step=second_cartesian_max_step_2,
    compute=compute_top_to_compressed_2,
    acm=acm_5,
    tool_w_cylinder=tool_w_cylinder_3,
    tool_wo_cylinder=tool_wo_cylinder_2)  # -> out, trajectories, last_confs; inputs start_confs: list, cylinders: list, acm: list
# ---------- plan_cartesian_motion_2: Python ----------
from scriptcontext import sticky as st

from compas_fab.robots import Configuration

guid_obj = ghenv.Component.InstanceGuid
guid = str(guid_obj)
if st.get("ppl_components"):
    st["ppl_components"].add(guid_obj)
else:
    st["ppl_components"] = set([guid_obj])

trajectories_key = "ppl_pipeline_trajectories_" + guid

if len(start_confs) == 0 or not start_confs[0]:
    raise Exception("Need start configuration from previous planner")

if robot.attached_tool and tool_w_cylinder and robot.attached_tool != tool_w_cylinder:
        robot.detach_tool()
        robot.attach_tool(tool_w_cylinder)

if robot and robot.client and robot.client.is_connected and compute:
    st[trajectories_key] = []
    if robot.attached_tool and tool_wo_cylinder and robot.attached_tool != tool_wo_cylinder:
        robot.detach_tool()
        robot.attach_tool(tool_wo_cylinder)

    for start_conf, cylinder in zip(start_confs, cylinders):
        frames = [cylinder.get_compressed_top_frame()]

        if robot.attached_tool:
            frames = robot.from_attached_tool_to_tool0(frames)

        trajectory = robot.plan_cartesian_motion(frames,
                                                 start_configuration=start_conf,
                                                 max_step=float(max_step),
                                                 avoid_collisions=False,
                                                 group=group,
                                                 attached_collision_meshes=list(acm))

        st[trajectories_key].append(trajectory)

trajectories = st.get(trajectories_key)

if trajectories:
    failed_trajectories = 0
    for i, trajectory in enumerate(trajectories):
        if trajectory.fraction < 1.0:
            failed_trajectories += 1
            print("Trajectory idx {} only completeted {} % of its path.".format(i, trajectory.fraction * 100))
    #if failed_trajectories > 0:
        #raise Exception("{} failed trajectories".format(failed_trajectories))
    last_confs = [Configuration.from_revolute_values(traj.points[-1].values) for traj in trajectories]
    print("Planning done!")
else:
    print("Ready to plan!")
# ---------- end plan_cartesian_motion_2 ----------
out_top_to_compressed = RemoteSender(plan_cartesian_motion_2.out)
trajectory_top_to_compressed_top = RemoteSender(plan_cartesian_motion_2.trajectories)
vis_4 = PythonScript(response=plan_cartesian_motion_2.trajectories)  # -> P, V, A; same code as vis_3
prismatic_3 = QuickGraph(vis_4.P, SortOrder=0)
robot_17 = RemoteReceiver(robot_2)
animate_3 = PythonScript(
    robot=robot_17,
    start_configurations=simplify(plan_cartesian_motion.last_confs),
    trajectories=simplify(plan_cartesian_motion_2.trajectories))  # -> trajectory_pts; inputs start_configurations: list, trajectories: list
# ---------- animate_3: Python ----------
from ghpythonlib.treehelpers import list_to_tree

from rapid_clay_formations_fab.utils import wrap_list

trajectory_pts = []

for i in range(len(trajectories)):
    _positions = []

    _positions.append(wrap_list(start_configurations, i))
    _positions.extend([p for p in trajectories[i].points if p])

    trajectory_pts.append(_positions)

trajectory_pts = list_to_tree(trajectory_pts)
# ---------- end animate_3 ----------
graph_5 = QuickGraph(vis_4.V, SortOrder=0)
graph_6 = QuickGraph(vis_4.A, SortOrder=0)

# ----
out_top_to_compressed_2 = RemoteReceiver(out_top_to_compressed)
out_egress_to_top_2 = RemoteReceiver(out_egress_to_top)
panel_28 = Panel(out_egress_to_top_2)
panel_29 = Panel(out_top_to_compressed_2)

trajectory_pick_egress_to_segment_egress_2 = RemoteReceiver(trajectory_pick_egress_to_segment_egress)
trajectory_segment_egress_to_place_egres_2 = RemoteReceiver(trajectory_segment_egress_to_place_egres)  # "trajectory_segment_egress_to_place_egress"
trajectory_egress_to_top_2 = RemoteReceiver(trajectory_egress_to_top)
trajectory_top_to_compressed_top_2 = RemoteReceiver(trajectory_top_to_compressed_top)
python_17 = GhPythonScript(
    robot=robot_7,
    pick_egress_to_segment_egress=trajectory_pick_egress_to_segment_egress_2,
    segment_egress_to_place_egress=trajectory_segment_egress_to_place_egres_2,
    egress_to_top=trajectory_egress_to_top_2,
    top_to_compressed_top=trajectory_top_to_compressed_top_2,
    elements=translated_elements_3)  # -> out, elements_w_ppl; inputs segment_egress_to_place_egress: list, egress_to_top: list, top_to_compressed_top: list, elements: list
# ---------- python_17: Python ----------
from rapid_clay_formations_fab.robots import MinimalTrajectories
from rapid_clay_formations_fab.robots import MinimalTrajectory

elements_w_ppl = []

for i, elem in enumerate(elements):
    elem_w_ppl = elem.copy()

    elem_w_ppl.travel_trajectories = MinimalTrajectories([])
    
    if pick_egress_to_segment_egress:
        elem_w_ppl.travel_trajectories.append(MinimalTrajectory.from_joint_trajectory(pick_egress_to_segment_egress))
    elem_w_ppl.travel_trajectories.append(MinimalTrajectory.from_joint_trajectory(segment_egress_to_place_egress[i]))

    elem_w_ppl.place_trajectories = MinimalTrajectories([
                                     MinimalTrajectory.from_joint_trajectory(egress_to_top[i]),
                                     MinimalTrajectory.from_joint_trajectory(top_to_compressed_top[i])
                                 ])

    elements_w_ppl.append(elem_w_ppl)
# ---------- end python_17 ----------
item_5 = ListItem(List=python_17.elements_w_ppl, Index=0, Wrap=True)
python_18 = GhPythonScript(skipped_elems=skipped_elems_2, elems_w_ppl=python_17.elements_w_ppl)  # -> out, fab_elems; inputs skipped_elems: list, elems_w_ppl: list
# ---------- python_18: Python ----------
fab_elems = skipped_elems + elems_w_ppl

fab_elems.sort(key=lambda x: x.id_)
for elem in fab_elems:
    for key, value in elem.__dict__.iteritems():
        if isinstance(key, str) and key.startswith("trajectory"):
            if not value or len(value) == 0:
                print("id: {} No trajectory for {}".format(elem.id_, key))
# ---------- end python_18 ----------
python_19 = GhPythonScript(
    old_run_data=read_placeelements_from_json.run_data,
    new_fab_data=simplify(python_18.fab_elems),
    input_file_path=input_json_path_3,
    save=save_ppl_json_2)  # -> out; inputs new_fab_data: list, save: Boolean
# ---------- python_19: Python ----------
import json
import os
from time import strftime
from time import localtime

import System

from rapid_clay_formations_fab.utils import CompasObjEncoder

if old_run_data is None:
    raise Exception("No run_data specified.")

run_data = old_run_data.data

if new_fab_data:
    run_data["fab_data"] = new_fab_data

if new_xform:
    run_data["xform"] = new_xform

if new_conf_path:
    run_data["conf_path"] = new_conf_path

if new_pick_conf:
    run_data["pick_conf"] = new_pick_conf

date_stamp_format = "%Y%m%d-%H.%M.%S"
timestamp = strftime(date_stamp_format, localtime())

run_data["last_modified"] = timestamp

run_data["last_hostname"] = System.Net.Dns.GetHostName()
#print(run_data["fab_data"][0].trajectory_to.points[-1].time_from_start.nsecs)

input_dir, input_basename = os.path.split(input_file_path)
input_dir = r"G:\Shared drives\2020_MAS\T2_P1_BuildingWorkshop\02_robot_control\03_rundata"
new_basename = input_basename.replace(".json", "-with-ppl.json")
new_file_path = os.path.join(input_dir, new_basename)

if save:
    with open(new_file_path, mode='w') as fp:
        json.dump(run_data, fp, cls=CompasObjEncoder)

print(new_file_path)
# ---------- end python_19 ----------
out_save_ppl_json = RemoteSender(python_19)

out_save_ppl_json_2 = RemoteReceiver(out_save_ppl_json)
panel_30 = Panel(out_save_ppl_json_2)

dam_3 = DataDam(DataA=python_17.elements_w_ppl, BufferDelay=10000000, BufferMode=0)
animate_4 = PythonScript(robot=robot_8, cylinders_w_ppl=dam_3)  # -> trajectory_pts; inputs cylinders_w_ppl: list
# ---------- animate_4: Python ----------
from ghpythonlib.treehelpers import list_to_tree

trajectory_pts = []

for cylinder in cylinders_w_ppl:
    _positions = []

    # pick_egress_to_segment_egress
    _positions.extend(cylinder.trajectory_pick_egress_to_segment_egress.points)

    # segment_egress_to_place_egress
    _positions.extend(cylinder.trajectory_segment_egress_to_place_egress.points)

    # egress_to_top
    _positions.extend(cylinder.trajectory_egress_to_top.points)

    # top_to_compressed_top
    _positions.extend(cylinder.trajectory_top_to_compressed_top.points)

    # compressed_top_to_top
    _positions.extend(cylinder.trajectory_compressed_top_to_top.points)

    # top_to_egress
    _positions.extend(cylinder.trajectory_top_to_egress.points)

    # cylinder egress to segment egress
    _positions.extend(cylinder.trajectory_place_egress_to_segment_egress.points)

    # segment egress to pick egress
    _positions.extend(cylinder.trajectory_segment_egress_to_pick_egress.points)

    trajectory_pts.append(_positions)

trajectory_pts = list_to_tree(trajectory_pts)
# ---------- end animate_4 ----------
dam_4 = DataDam(DataA=animate_4, DataB=robot_8, BufferDelay=10000000, BufferMode=0)  # -> DataA, DataB
python_20 = GhPythonScript(robot=dam_4.DataB, configurations=dam_4.DataA)  # -> out, pts
# ---------- python_20: Python ----------
from rapid_clay_formations_fab.rhino import cgframe_to_rgplane

if robot and robot.client and robot.client.is_connected:
    frames = robot.forward_kinematics(configurations)
    pts = cgframe_to_rgplane(frames).Origin
# ---------- end python_20 ----------
pline = PolyLine(Vertices=python_20.pts, Closed=False)
travel_goal_configurations_3 = RemoteReceiver(travel_goal_configurations)

filter_5 = StreamFilter(
    Gate=list_5,
    Stream0=forward_kinematics,
    Stream1=inverse_kinematics.configuration,
    Stream2=travel_goal_configurations_3,
    Stream3=animate,
    Stream4=animate_2,
    Stream5=animate_3,
    Stream6=animate_4)

tstat = TreeStatistics(Tree=filter_5)  # -> Paths, Length, Count
lng_2 = ListLength(List=flatten(tstat.Paths))  # -> expr("x-1", Length)
remap = RemapNumbers(Value=Slider(0, range=0..1), Source=Domain(0, 1), Target=lng_2)  # -> Mapped, Clipped
item_6 = ListItem(List=flatten(tstat.Paths), Index=remap.Mapped, Wrap=True)

branch = TreeBranch(Tree=filter_5, Path=item_6, MaintainPaths=True)

lng_3 = ListLength(List=flatten(branch))  # -> expr("x-1", Length)
remap_2 = RemapNumbers(Value=Slider(0.978972, range=0..1), Source=Domain(0, 1), Target=lng_3)  # -> Mapped, Clipped
item_7 = ListItem(List=flatten(branch), Index=remap_2.Mapped, Wrap=True)

visualize = PythonScript(
    robot=robot_9,
    group=main_planning_group_3,
    configuration=item_7,
    show_visual=show_visual,
    show_collision=show_collision,
    show_frames=show_frames,
    show_base_frame=show_base_frame,
    show_end_effector_frame=show_end_effector_frame)  # -> out, visual, collision, frames, ee_frame, base_frame
# ---------- visualize: Python ----------
"""Calculates a cartesian motion path (linear in tool space).
    Inputs:
        robot: The robot
        group: str
            The planning group used for visualisation
        full_configuration: :class:`compas_fab.robots.Configuration`
            The robot's full configuration to display.
        show_visual: bool
           Whether or not to show the robot's visual meshes.
        show_collision: bool
           Whether or not to show the robot's collision meshes.
        show_frames: bool
           Whether or not to show the robot's joint frames.
        show_base_frame: bool
           Whether or not to show the robot's base frame.
        show_end_effector_frame: bool
            Whether or not to show the robot's end-effector frame.
    Output:
        visual: The robot's visual meshes.
        collision: The robot's collision meshes.
        frames: The robot's joint frames.
        base_frame_WCF: The robot's base frame.
        ee_frame_WCF: The robot's end-effector frame.
"""
from __future__ import print_function

import copy

import Rhino.Geometry as rg
from compas.geometry import Scale
from compas_ghpython import draw_frame

if robot and configuration:
    robot.update(configuration, visual=show_visual, collision=show_collision)

    if show_visual:
        visual = list(robot.draw_visual())
        has_tool_attached = visual and robot.attached_tool
        needs_ee_scaling = robot.scale_factor != 1 and has_tool_attached
        if needs_ee_scaling and visual[-1] == robot.attached_tool.native_geometry[0]:
            ee_frame = robot.get_end_effector_frame(group, configuration)
            pln = rg.Plane(rg.Point3d(*list(ee_frame.point)), rg.Vector3d(*list(ee_frame.normal)))
            visual.append(pln)
            T = rg.Transform.Scale(pln, robot.scale_factor, robot.scale_factor, robot.scale_factor)
            ee_mesh = copy.copy(robot.attached_tool.native_geometry[0])
            ee_mesh.Transform(T)
            visual[-1] = ee_mesh

    if show_collision:
        collision = robot.draw_collision()

    if show_frames:
        axes = robot.transformed_axes(configuration)
        frames = robot.transformed_frames(configuration)
        frames = [draw_frame(frame) for frame in frames]

    if show_base_frame:
        base_frame = draw_frame(robot.get_base_frame(group, configuration))

    if show_end_effector_frame:
        ee_frame = draw_frame(robot.get_end_effector_frame(group, configuration))
        print("End-effector", ee_frame)
# ---------- end visualize ----------
geo = Geometry(visualize.frames)
geo_2 = Geometry(visualize.base_frame)  # disabled
geo_3 = Geometry(visualize.ee_frame)  # disabled
geo_4 = Geometry(visualize.collision)

geo_5 = Geometry(visualize.visual)

preview_5 = CustomPreview(Geometry=[geo_5, geo_4])

# ==== cluster Cluster
planes = ClusterInput()
axis_length = ClusterInput()
axis_radius = ClusterInput()
deconstruct_plane = DeconstructPlane(Plane=graft(planes))  # -> Origin, XAxis, YAxis, ZAxis
amplitude = Amplitude(Vector=deconstruct_plane.XAxis, Amplitude=axis_length)
amplitude_2 = Amplitude(Vector=deconstruct_plane.YAxis, Amplitude=axis_length)
amplitude_3 = Amplitude(Vector=deconstruct_plane.ZAxis, Amplitude=axis_length)
move = Move(Geometry=deconstruct_plane.Origin, Motion=amplitude_2)  # -> Geometry, Transform
move_2 = Move(Geometry=deconstruct_plane.Origin, Motion=amplitude_3)  # -> Geometry, Transform
move_3 = Move(Geometry=deconstruct_plane.Origin, Motion=amplitude)  # -> Geometry, Transform
ln = Line(StartPoint=deconstruct_plane.Origin, EndPoint=move.Geometry)
ln_2 = Line(StartPoint=deconstruct_plane.Origin, EndPoint=move_3.Geometry)
ln_3 = Line(StartPoint=deconstruct_plane.Origin, EndPoint=move_2.Geometry)
pipe = Pipe(Curve=ln, Radius=axis_radius, Caps=0)
pipe_2 = Pipe(Curve=ln_2, Radius=axis_radius, Caps=0)
pipe_3 = Pipe(Curve=ln_3, Radius=axis_radius, Caps=0)
entwine = Entwine(
    Branch00=ColourSwatch(SwatchColor=RGB(255, 0, 0)),
    Branch01=ColourSwatch(SwatchColor=RGB(0, 255, 0)),
    Branch02=ColourSwatch(SwatchColor=RGB(0, 0, 255)),
    FlattenInputs=True)
entwine_2 = Entwine(Branch00=pipe_2, Branch01=pipe, Branch02=pipe_3, FlattenInputs=True)
geo = ClusterOutput(entwine_2)
color = ClusterOutput(entwine)

# ==== cluster Cluster_2
plane = ClusterInput()
amplitude = ClusterInput()
R = ClusterInput()
deconstruct_plane = DeconstructPlane(Plane=graft(plane))  # -> Origin, XAxis, YAxis, ZAxis
amplitude_2 = Amplitude(Vector=deconstruct_plane.XAxis, Amplitude=amplitude)
amplitude_3 = Amplitude(Vector=deconstruct_plane.YAxis, Amplitude=amplitude)
amplitude_4 = Amplitude(Vector=deconstruct_plane.ZAxis, Amplitude=amplitude)
move = Move(Geometry=deconstruct_plane.Origin, Motion=amplitude_3)  # -> Geometry, Transform
move_2 = Move(Geometry=deconstruct_plane.Origin, Motion=amplitude_4)  # -> Geometry, Transform
move_3 = Move(Geometry=deconstruct_plane.Origin, Motion=amplitude_2)  # -> Geometry, Transform
ln = Line(StartPoint=deconstruct_plane.Origin, EndPoint=move.Geometry)
ln_2 = Line(StartPoint=deconstruct_plane.Origin, EndPoint=move_3.Geometry)
ln_3 = Line(StartPoint=deconstruct_plane.Origin, EndPoint=move_2.Geometry)
pipe = Pipe(Curve=ln, Radius=R, Caps=0)  # -> simplify(Pipe)
pipe_2 = Pipe(Curve=ln_2, Radius=R, Caps=0)  # -> simplify(Pipe)
pipe_3 = Pipe(Curve=ln_3, Radius=R, Caps=0)  # -> simplify(Pipe)
path_mapper = PathMapper(pipe_2, source="{*}", target="{0}")
path_mapper_2 = PathMapper(ColourSwatch(SwatchColor=RGB(255, 0, 0)), source="{*}", target="{0}")
path_mapper_3 = PathMapper(pipe, source="{*}", target="{1}")
path_mapper_4 = PathMapper(ColourSwatch(SwatchColor=RGB(0, 255, 0)), source="{*}", target="{1}")
path_mapper_5 = PathMapper(ColourSwatch(SwatchColor=RGB(0, 0, 255)), source="{*}", target="{2}")
path_mapper_6 = PathMapper(pipe_3, source="{*}", target="{2}")
data = Data([path_mapper_6, path_mapper_3, path_mapper])
data_2 = Data([path_mapper_5, path_mapper_4, path_mapper_2])
geo = ClusterOutput(data)
color = ClusterOutput(data_2)

# ==== cluster Cluster_3
F = ClusterInput()
G = ClusterInput()
A = ClusterInput()
X = UnitX(Factor=F)
move = Move(Geometry=G, Motion=X)  # -> Geometry, Transform
curvepoint = PointOnCurve(G, parameter=1)
curvepoint_2 = PointOnCurve(G, parameter=0)
rotate = Rotate(Geometry=move.Geometry, Angle=degrees(A), Plane=curvepoint_2)  # -> Geometry, Transform
curvepoint_3 = PointOnCurve(rotate.Geometry, parameter=1)
vec2pt = Vector2Pt(PointA=curvepoint_3, PointB=curvepoint, Unitize=Toggle(True))  # -> Vector, Length
neg = Negative(Value="90")
rotate_2 = Rotate(Geometry=vec2pt.Vector, Angle=degrees(["90", neg]), Plane=PlaneXY(0, 0, 0))  # -> Geometry, Transform
amp = Amplitude(Vector=rotate_2.Geometry, Amplitude="100")
item = ListItem(List=amp, Index=0, Wrap=True)  # -> Item, Item1
move_2 = Move(Geometry=curvepoint_3, Motion=item.Item)  # -> Geometry, Transform
move_3 = Move(Geometry=curvepoint_2, Motion=item.Item1)  # -> Geometry, Transform
pl_3pt = Plane3Pt(PointA=move_2.Geometry, PointB=curvepoint_3, PointC=curvepoint)
box = Box2Pt(PointA=move_2.Geometry, PointB=move_3.Geometry, Plane=pl_3pt)
B = ClusterOutput(box)

# ==== cluster Cluster_4
rot_around_x = ClusterInput()
rot_around_y = ClusterInput()
rot_around_z = ClusterInput()
plane = ClusterInput()
pln = Plane(graft(plane))
neg = Negative(Value=rot_around_x)
deplane = DeconstructPlane(Plane=pln)  # -> Origin, XAxis, YAxis, ZAxis
rot3d = Rotate3D(Angle=degrees(neg), Center=deplane.Origin, Axis=deplane.XAxis)  # -> Geometry, Transform
rot3d_2 = Rotate3D(Angle=degrees(rot_around_y), Center=deplane.Origin, Axis=deplane.YAxis)  # -> Geometry, Transform
rot3d_3 = Rotate3D(Angle=degrees(rot_around_z), Center=deplane.Origin, Axis=deplane.ZAxis)  # -> Geometry, Transform
comp = Compound(Transforms=[rot3d.Transform, rot3d_2.Transform, rot3d_3.Transform])
transform = Transform(Geometry=pln, Transform=comp)  # -> flatten(Geometry)
oriented_plane = ClusterOutput(transform)
