# Grasshopper definition pick_conf_creator.ghx (Grasshopper 1.0.7)

# ----
# Set up picking station frames
# 0,0,0
pt = Point(Point(0, 0, 0))

# ---- group: Origin station
number_slider = Slider(-791.16, range=-2000..0)
number_slider_2 = Slider(81.5, range=-1000..1000)
number_slider_3 = Slider(-1058.27, range=-2000..0)

# ---- group: Point on X axis
number_slider_4 = Slider(-790.12, range=-2000..0)
number_slider_5 = Slider(80.23, range=-1000..1000)
number_slider_6 = Slider(-1423.68, range=-2000..0)

# ---- group: Point on Y axis
number_slider_7 = Slider(-1055.37, range=-2000..0)
number_slider_8 = Slider(-393, range=-2000..0)
number_slider_9 = Slider(82.05, range=-1000..1000)

# ----
pt_2 = ConstructPoint(XCoordinate=number_slider_6, YCoordinate=number_slider_4, ZCoordinate=number_slider_5)
pt_3 = ConstructPoint(XCoordinate=number_slider_7, YCoordinate=number_slider_8, ZCoordinate=number_slider_9)
pt_4 = ConstructPoint(XCoordinate=number_slider_3, YCoordinate=number_slider, ZCoordinate=number_slider_2)

# ----
# Origin picking array, defined from origin pick station
number_slider_10 = Slider(54, range=0..100)

subtraction = Subtraction(A=pt_2, B=pt_4)
subtraction_2 = Subtraction(A=pt_3, B=pt_4)
pt_5 = ConstructPoint(XCoordinate=number_slider_10, YCoordinate=Slider(60, range=0..100), ZCoordinate=Slider(2, range=0..10))
pl = ConstructPlane(Origin=pt_4, XAxis=subtraction, YAxis=subtraction_2)
python = GhPythonScript(pick_origin=pl)  # -> out, xform; inputs pick_origin: Plane
# ---------- python: Python ----------
import Rhino.Geometry as rg

from compas.geometry import Transformation
from compas.geometry import Frame

from rapid_clay_formations_fab.rhino import matrix_to_rgtransform
from rapid_clay_formations_fab.utils import ensure_frame

frame = ensure_frame(pick_origin)

xform = Transformation.from_frame_to_frame(Frame.worldXY(), frame)

xform = matrix_to_rgtransform(xform)
# ---------- end python ----------

# ---- group: Picking array
number_slider_11 = Slider(6, range=0..10)
number_slider_12 = Slider(2, range=0..10)
number_slider_13 = Slider(125, range=0..1000)
number_slider_14 = Slider(125, range=0..1000)

# ----
transform = Transform(python.xform)
rectangle = Rectangle(Plane=pt_5, XSize=number_slider_13, YSize=number_slider_14, Radius=0)  # -> Rectangle, Length
arrrec = RectangularArray(Geometry=pt_5, Cell=rectangle.Rectangle, XCount=number_slider_11, YCount=number_slider_12)  # -> Geometry, Transform
xy = XYPlane(Origin=arrrec.Geometry)
transform_2 = Transform(Geometry=xy, Transform=transform)
path = FilePath("G:\Shared drives\2020_MAS\T3\RCF-T3-Thesis\09-robot-control\05_picking_confs\picking_conf_03.json")
panel = Panel(path)
python_2 = GhPythonScript(transformed_planes=simplify(transform_2), file_path=path, save=Button())  # -> out, a; inputs transformed_planes: list of Plane, save: Boolean
# ---------- python_2: Python ----------
import json

from rapid_clay_formations_fab.utils import ensure_frame

frames = []
for plane in transformed_planes:
    frame = ensure_frame(plane)
    frames.append(frame)

frames = [ensure_frame(plane) for plane in transformed_planes]
frames = [frame.to_data() for frame in frames]


if save:
    if not file_path.endswith(".json"):
        file_path =+ ".json"
    with open(file_path, mode="w") as fp:
        json.dump(frames, fp)
# ---------- end python_2 ----------
