# Grasshopper definition pick_frame_list_generator.ghx (Grasshopper 1.0.7)

# ---- group: Origin station
number_slider = Slider(-785.75, range=-2000..0)
number_slider_2 = Slider(-1043.31, range=-2000..0)
number_slider_3 = Slider(66.19, range=-1000..1000)

# ----
# Right picking station
# 0,0,0
pt = Point(Point(0, 0, 0))

# ---- group: Point on X axis
number_slider_4 = Slider(-1793.23, range=-2000..0)
number_slider_5 = Slider(-790.05, range=-2000..0)
number_slider_6 = Slider(62, range=-1000..1000)

# ---- group: Point on Y axis
number_slider_7 = Slider(-1044.87, range=-2000..0)
number_slider_8 = Slider(-549.75, range=-2000..0)
number_slider_9 = Slider(68.11, range=-1000..1000)

# ----
pt_2 = ConstructPoint(XCoordinate=number_slider_2, YCoordinate=number_slider, ZCoordinate=number_slider_3)
pt_3 = ConstructPoint(XCoordinate=number_slider_4, YCoordinate=number_slider_5, ZCoordinate=number_slider_6)
pt_4 = ConstructPoint(XCoordinate=number_slider_7, YCoordinate=number_slider_8, ZCoordinate=number_slider_9)

# ----
# Origin picking array, defined from origin pick station
number_slider_10 = Slider(57, range=0..100)

subtraction = Subtraction(A=pt_3, B=pt_2)
subtraction_2 = Subtraction(A=pt_4, B=pt_2)
pt_5 = ConstructPoint(XCoordinate=number_slider_10, YCoordinate=Slider(55.27, range=0..100), ZCoordinate=Slider(-12, range=-100..0))
pl = ConstructPlane(Origin=pt_2, XAxis=subtraction, YAxis=subtraction_2)
python = GhPythonScript(pick_origin=pl)  # -> out, xform; inputs pick_origin: Plane
# ---------- python: Python ----------
import Rhino.Geometry as rg

from compas.geometry import Transformation
from compas.geometry import Frame

from rapid_clay_formations_fab.rhino import matrix_to_rgtransform
from rapid_clay_formations_fab.utils import ensure_frame

frame = ensure_frame(pick_origin)

xform = Transformation.from_frame_to_frame(Frame.worldXY(), frame)

xform = matrix_to_rgtransform(xform)
# ---------- end python ----------

# ---- group: Picking array
number_slider_11 = Slider(125, range=0..1000)
number_slider_12 = Slider(6, range=0..10)
number_slider_13 = Slider(2, range=0..10)
number_slider_14 = Slider(124.7, range=0..1000)

# ----
rectangle = Rectangle(Plane=pt_5, XSize=number_slider_14, YSize=number_slider_11, Radius=0)  # -> Rectangle, Length
transform = Transform(python.xform)
arrrec = RectangularArray(Geometry=pt_5, Cell=rectangle.Rectangle, XCount=number_slider_12, YCount=number_slider_13)  # -> Geometry, Transform
item = ListItem(List=arrrec.Geometry, Index=[0, 6], Wrap=True)
item_2 = ListItem(List=item, Index=0, Wrap=True)  # -> Item, Item1
vec2pt = Vector2Pt(PointA=item_2.Item, PointB=item_2.Item1, Unitize=False)  # -> Vector, Length
amp = Amplitude(Vector=vec2pt.Vector, Amplitude=Slider(235.76, range=0..1000))
move = Move(Geometry=arrrec.Geometry, Motion=amp)  # -> Geometry, Transform
merge = Merge(Data1=arrrec.Geometry, Data2=move.Geometry)
xy = XYPlane(Origin=merge)
transform_2 = Transform(Geometry=xy, Transform=transform)
points = PointList(Points=transform_2, Size=60)
path = FilePath("C:\rcf_robotcontrol\02_pick_frame_lists\201027-right-pick-conf_twotray.json")
panel = Panel(path)
python_2 = GhPythonScript(transformed_planes=simplify(transform_2), file_path=path, save=Button())  # -> out, a; inputs transformed_planes: list of Plane, save: Boolean
# ---------- python_2: Python ----------
import json

from compas.utilities import DataEncoder

from rapid_clay_formations_fab.utils import ensure_frame

frames = [ensure_frame(plane) for plane in transformed_planes]

if save:
    if not file_path.endswith(".json"):
        file_path += ".json"
    with open(file_path, mode="w") as fp:
        json.dump(frames, fp, cls=DataEncoder)
# ---------- end python_2 ----------
